# Grasshopper definition 01_Extracting decimal numbers from a list(python script).gh (Grasshopper 1.0.7)
# plug-ins: RhinoCodePluginGH

# 3 Level - 01
panel = Panel("""2
4
2.5
8
7
3
1.65
5
9
5.2
1
6""")
panel_2 = Panel("""2
4
2.5
8
7
3
1.65
5
9
5.2
1
6""")
S = Script(input_list=panel)  # -> out, a; inputs input_list: list
# ---------- S: Python ----------
def is_integer(s):
    try:
        int(s)
        return True
    except ValueError:
        return False

output_list = list(map(int, filter(is_integer, input_list)))

print(type(input_list[0]))
# 'output_list'를 출력
a = output_list
# ---------- end S ----------
S_2 = Script(input_list=panel_2)  # -> out, a; inputs input_list: list
# ---------- S_2: Python ----------
output_list = [s for s in input_list if '.' in s]

# 'output_list'를 출력
a = output_list
# ---------- end S_2 ----------
panel_3 = Panel(S.out)
panel_4 = Panel(S_2.out)
panel_5 = Panel(S.a)
panel_6 = Panel(S_2.a)
