# Grasshopper definition 02_How to use vector multiplication.gh (Grasshopper 1.0.7)

panel = Panel("""위치벡터
단위벡터""")
crv = Curve([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])
crv_2 = Curve([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])
join = JoinCurves(Curves=crv, Preserve=False)
join_2 = JoinCurves(Curves=crv_2, Preserve=False)
crv_3 = Curve([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])
crv_4 = Curve([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])
line = Line(Line((5, 2, 0), (12, 14, 0)))
crv_5 = Curve([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])
crv_6 = Curve(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)
crv_7 = Curve(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)
pt = Point(Point(12, 8, 0))
pt_2 = Point(Point(4, 6, 0))
# 3 Level - 02
panel_2 = Panel(crv_4)
explode = Explode(Curve=crv_4, Recursive=True)  # -> flatten(Segments), Vertices
explode_2 = Explode(Curve=join_2, Recursive=True)  # -> Segments, Vertices
explode_3 = Explode(Curve=join, Recursive=True)  # -> Segments, Vertices
line_2 = Line(crv_7)
join_3 = JoinCurves(Curves=crv_5, Preserve=False)
vec = Vector(crv_6)
vec_2 = Vector(line)
vec_3 = Vector(pt)
vec2pt = Vector2Pt(PointA=pt_2, PointB=pt, Unitize=Toggle(True))  # -> Vector, Length
shift = ShiftList(List=explode_2.Segments, Shift="-1", Wrap=True)
vec_4 = Vector(line_2)
shift_2 = ShiftList(List=explode_3.Segments, Shift="-1", Wrap=True)
vlen = VectorLength(Vector=vec_3)
explode_4 = Explode(Curve=join_3, Recursive=True)  # -> Segments, Vertices
panel_3 = Panel(vec2pt.Length)
shift_3 = ShiftList(List=explode.Segments, Shift=1, Wrap=True)
pt_3 = Point(explode_2.Vertices)
pi = Pi(Factor=Slider(0.52, range=0..2))
vec_5 = Vector(explode_2.Segments)
vec_6 = Vector(shift)
vec_7 = Vector(explode_3.Segments)
vec_8 = Vector(shift_2)
item = ListItem(List=shift_2, Index=0, Wrap=True)
panel_4 = Panel(vlen)
multiplication = Multiplication(A=vec_5, B=vec_6)
kinkcrv = KinkyCurve(Vertices=explode_4.Vertices, Degree="3", Angle=pi)  # -> Curve, Length, Domain
angle = Angle(VectorA=explode.Segments, VectorB=shift_3)  # -> Angle, Reflex
dprod = DotProduct(Unitize=False)
multiplication_2 = Multiplication(A=vec_7, B=vec_8)
box = Box()
smaller = SmallerThan(FirstNumber=multiplication, SecondNumber="0")  # -> SmallerThan, OrEqualTo
disc = Discontinuity(Curve=kinkcrv.Curve, Level=1)  # -> Points, Parameters
num = Number(angle.Angle)
xprod = CrossProduct(Unitize=False)  # -> Vector, Length
smaller_2 = SmallerThan(FirstNumber=multiplication_2, SecondNumber="0")  # -> SmallerThan, OrEqualTo
pline = PolyLine(Vertices=disc.Points, Closed=invert(False))
sort = SortList(Keys=num, ValuesA=angle.Angle)  # -> Keys, ValuesA
cull = CullPattern(List=explode_2.Vertices, CullPattern=smaller.SmallerThan)
cull_2 = CullPattern(List=explode_3.Vertices, CullPattern=smaller_2.SmallerThan)
pline_2 = PolyLine(Vertices=cull, Closed=False)
item_2 = ListItem(List=sort.ValuesA, Index=Slider(10, range=0..10), Wrap=True)
panel_5 = Panel(sort.ValuesA)
pline_3 = PolyLine(Vertices=cull_2, Closed=False)
xy = XYPlane(Origin=Point(0, 0, 0))
xy_2 = XYPlane(Origin=Point(0, 0, 0))
crv_8 = Curve(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)
crv_9 = Curve(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)
crv_10 = Curve(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)
crv_11 = Curve(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)
angle_2 = Angle(VectorA=crv_9, VectorB=crv_8, Plane=xy)  # -> Angle, Reflex
angle_3 = Angle(VectorA=crv_10, VectorB=crv_11, Plane=xy_2)  # -> Angle, Reflex
deg = Degrees(Radians=angle_3.Angle)
deg_2 = Degrees(Radians=angle_2.Angle)
panel_6 = Panel([angle_3.Angle, angle_3.Reflex])
panel_7 = Panel([angle_2.Angle, deg_2])
panel_8 = Panel(deg)
