# Grasshopper definition 03_Extruding a quadrilateral polyline according to given conditions..gh (Grasshopper 1.0.7)
# plug-ins: Human

# 3 Level - 03
crv = Curve([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])
crv_2 = Curve([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])
crv_3 = Curve([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])
item = ListItem(List=crv_2, Index=0, Wrap=True)
neg = Negative(Value=Slider(0.2, range=0..1))
crv_4 = Curve([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])
neg_2 = Negative(Value=Slider(0.2, range=0..1))
number_slider = Slider(10, range=0..10)
item_2 = ListItem(List=crv_4, Index=0, Wrap=True)
crv_5 = Curve([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])
flip = FlipCurve(Curve=crv_2, Guide=item)  # -> Curve, Flag
offset = OffsetCurve(Curve=crv, Distance=neg, Corners=1)  # -> flatten(Curve)
crv_6 = Curve([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])
neg_3 = Negative(Value=Slider(0.2, range=0..1))
offset_2 = OffsetCurve(Curve=crv_3, Distance=neg_2, Corners=1)  # -> flatten(Curve)
toggle = BooleanToggle(False)
neg_4 = Negative(Value=Slider(0.2, range=0..1))
runion = RegionUnion(Curves=crv_6)
flip_2 = FlipCurve(Curve=crv_4, Guide=item_2)  # -> Curve, Flag
neg_5 = Negative(Value=Slider(0.2, range=0..1))
area = Area(Geometry=offset)  # -> Area, Centroid
offset_3 = OffsetCurve(Curve=flip.Curve, Distance=neg_3, Corners=1)  # -> flatten(Curve)
offset_4 = OffsetCurve(Curve=crv_5, Distance=neg_4, Corners=1)  # -> flatten(Curve)
area_2 = Area(Geometry=offset_2)  # -> Area, Centroid
crv_7 = Curve([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])
colom = CollisionOneMany(Collider=crv_6, Obstacles=runion)  # -> Collision, Index
offset_5 = OffsetCurve(Curve=crv_6, Distance=neg_5, Corners=1)  # -> flatten(Curve)
avr = Average(Input=flatten(area.Centroid))
area_3 = Area(Geometry=offset_3)  # -> Area, Centroid
runion_2 = RegionUnion(Curves=crv_7)
avr_2 = Average(Input=flatten(area_2.Centroid))
area_4 = Area(Geometry=offset_4)  # -> Area, Centroid
cull = CullPattern(List=crv_6, CullPattern=colom.Collision)
runion_3 = RegionUnion()
area_5 = Area(Geometry=offset_5)  # -> Area, Centroid
dist = Distance(PointA=area.Centroid, PointB=avr)
series = Series(Start=0, Step="8", Count="4")
avr_3 = Average(Input=flatten(area_3.Centroid))
colom_2 = CollisionOneMany(Collider=crv_7, Obstacles=runion_2)  # -> Collision, Index
avr_4 = Average(Input=flatten(area_4.Centroid))
dist_2 = Distance(PointA=area_2.Centroid, PointB=avr_2)
colom_3 = CollisionOneMany(Obstacles=runion_3)  # -> Collision, Index
crv_8 = Curve(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)
sort = SortList(Keys=dist, ValuesA=offset)  # -> Keys, ValuesA
panel = Panel(series)
lng = ListLength(List=cull)
dist_3 = Distance(PointA=area_3.Centroid, PointB=avr_3)
sort_2 = SortList(Keys=dist_2, ValuesA=offset_2)  # -> Keys, ValuesA
planar = IsPlanar(Surface=crv_8, Interior=True)  # -> Planar, Plane
dist_4 = Distance(PointA=area_4.Centroid, PointB=avr_4)
equals = Equality()  # -> Equality, Inequality
dispatch = Dispatch(DispatchPattern=colom_3.Collision)  # -> ListA, ListB
item_3 = ListItem(List=sort.ValuesA, Index=0, Wrap=True)
series_2 = Series(Start=Slider(0.4, range=0..10), Step=Slider(2, range=0..10), Count=Slider(4, range=0..10))
number_slider_2 = Slider(3, range=0..10)
crv_cp = CurveClosestPoint(Point=area_5.Centroid, Curve=graft(runion))  # -> Point, Parameter, Distance
sort_3 = SortList(Keys=dist_3, ValuesA=offset_3)  # -> Keys, ValuesA
series_3 = Series(Start=Slider(0.4, range=0..10), Step=Slider(2, range=0..10), Count=Slider(4, range=0..10))
item_4 = ListItem(List=sort_2.ValuesA, Index=0, Wrap=True)
disc = Discontinuity(Curve=crv_8, Level=1)  # -> Points, Parameters
lng_2 = ListLength(List=dispatch.ListB)
sort_4 = SortList(Keys=dist_4, ValuesA=offset_4)  # -> Keys, ValuesA
planar_2 = Planar(Curve=crv_8)  # -> Planar, Plane, Deviation
area_6 = Area(Geometry=item_3)  # -> Area, Centroid
item_5 = ListItem(List=sort_3.ValuesA, Index=0, Wrap=True)
series_4 = Series(Start=Slider(0.4, range=0..10), Step=Slider(2, range=0..10), Count=Slider(4, range=0..10))
bool = Boolean(invert(lng_2))
item_6 = ListItem(List=sort_4.ValuesA, Index=0, Wrap=True)
series_5 = Series(Start=Slider(0.4, range=0..10), Step=Slider(2, range=0..10), Count=Slider(4, range=0..10))
scale = Scale(Geometry=item_4, Center=avr_2, Factor=series_3)  # -> Geometry, Transform
line = LineSDL(Start=disc.Points, Direction=planar_2.Plane, Length=Slider(4.45, range=0..10))
scale_2 = Scale(Geometry=item_3, Center=area_6.Centroid, Factor=series_2)  # -> Geometry, Transform
deplane = DeconstructPlane(Plane=item_3)  # -> Origin, XAxis, YAxis, ZAxis
boundary = BoundarySurfaces(Edges=sort_3.ValuesA)
sort_5 = SortList(Keys=crv_cp.Distance, ValuesA=offset_5)  # -> Keys, ValuesA
number_slider_3 = Slider(2, range=0..10)
panel_2 = Panel("""1
8
16
24""")
scale_3 = Scale(Geometry=item_5, Center=avr_3, Factor=series_4)  # -> Geometry, Transform
scale_4 = Scale(Geometry=item_6, Center=avr_4, Factor=series_5)  # -> Geometry, Transform
crv_cp_2 = CurveClosestPoint(Point=area_2.Centroid, Curve=graft(scale.Geometry))  # -> Point, Parameter, Distance
partition = PartitionList(List=sort_5.ValuesA, Size=reverse(panel_2))
viewer = ParamViewer()
colom_4 = CollisionOneMany(Collider=boundary, Obstacles=graft(scale_3.Geometry))  # -> Collision, Index
colom_5 = CollisionOneMany(Collider=sort_4.ValuesA, Obstacles=graft(scale_4.Geometry))  # -> Collision, Index
crv_cp_3 = CurveClosestPoint(Point=area.Centroid, Curve=graft(scale_2.Geometry))  # -> Point, Parameter, Distance
panel_3 = Panel(item_6)
planar_3 = IsPlanar(Interior=True)  # -> Planar, Plane
crv_9 = Curve(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)
number_slider_4 = Slider(2, range=0..10)
series_6 = Series(Start=number_slider_3, Step=number_slider_3, Count=Slider(4, range=0..10))
smaller = SmallerThan(FirstNumber=crv_cp_2.Distance, SecondNumber=Slider(3, range=0..10))  # -> SmallerThan, OrEqualTo
viewer_2 = ParamViewer(partition)
number_slider_5 = Slider(2, range=0..10)
end = EndPoints(Curve=crv_9)  # -> Start, End
cull_2 = CullPattern(List=boundary, CullPattern=colom_4.Collision)
vec = Vector(crv_9)
cull_3 = CullPattern(List=sort_4.ValuesA, CullPattern=colom_5.Collision)
cull_4 = CullPattern(List=offset_2, CullPattern=smaller.SmallerThan)
amp = Amplitude(Vector=planar_3.Plane, Amplitude=graft(series_6))
smaller_2 = SmallerThan(FirstNumber=crv_cp_3.Distance, SecondNumber=Slider(3, range=0..10))  # -> SmallerThan, OrEqualTo
merge = Merge(Data1=simplify(cull_3), Data2=item_6)
line_2 = LineSDL(Start=end.End, Direction=vec, Length=Slider(4.6, range=0..10))
viewer_3 = ParamViewer(cull_2)
tstat = TreeStatistics(Tree=cull_4)  # -> Paths, Length, Count
series_7 = Series(Start=number_slider_4, Step=number_slider_4, Count=Slider(4, range=0..10))  # -> reverse(Series)
viewer_4 = ParamViewer(cull_3)
planar_4 = IsPlanar(Surface=cull_2, Interior=True)  # -> Planar, Plane
extr = Extrude(Direction=amp)
cull_5 = CullPattern(List=offset, CullPattern=smaller_2.SmallerThan)
series_8 = Series(Start=number_slider_5, Step=number_slider_5, Count=tstat.Count)  # -> reverse(Series)
viewer_5 = ParamViewer(merge)
amp_2 = Amplitude(Vector=planar_4.Plane, Amplitude=graft(series_7))
cap = CapHoles(Brep=extr)
number_slider_6 = Slider(2, range=0..10)
tstat_2 = TreeStatistics(Tree=cull_5)  # -> Paths, Length, Count
amp_3 = Amplitude(Vector=item_4, Amplitude=series_8)
extr_2 = Extrude(Base=cull_2, Direction=amp_2)
previewmat = CustomPreviewMaterials(Geometry=cap, DiffuseColor=RGB(255, 255, 255))
cap_2 = CapHoles(Brep=extr_2)
extr_3 = Extrude(Base=cull_4, Direction=graft(amp_3))
series_9 = Series(Start=number_slider_6, Step=number_slider_6, Count=tstat_2.Count)  # -> reverse(Series)
cap_3 = CapHoles(Brep=extr_3)
previewmat_2 = CustomPreviewMaterials(Geometry=cap_2, DiffuseColor=RGB(255, 255, 255))
amp_4 = Amplitude(Vector=deplane.ZAxis, Amplitude=series_9)
extr_4 = Extrude(Base=cull_5, Direction=graft(amp_4))
cap_4 = CapHoles(Brep=extr_4)
