# Grasshopper definition 04_Creating a tree branch shape using the given line.gh (Grasshopper 1.0.7)

number_slider = Slider(6, range=0..10)
number_slider_2 = Slider(6, range=0..10)
xy = XYPlane(Origin=Point(0, 0, 0))
X = UnitX(Factor=1)
# 3 Level - 04
xy_2 = XYPlane(Origin=Point(0, 0, 0))
range = Range(Domain=Domain(0, 1), Steps=expr("x-1", number_slider))
X_2 = UnitX(Factor=1)
line = LineSDL(Start=xy_2, Direction=X, Length=Slider(10, range=0..10))
series = Series(Start=Slider(0, range=0..10), Step=Slider(3.5, range=0..10), Count=number_slider_2)
graph = GraphMapper(
    range,
    x0=0,
    x1=1,
    y0=0,
    y1=1,
    container_name="Bezier",
    cpx=[0, 0.299689889, 0.6259439588, 1],
    cpy=[0, 0.369762063, 0.6129698753, 1])
line_2 = LineSDL(Start=xy, Direction=X_2, Length=Slider(20, range=0..20))
Z = UnitZ(Factor=series)
bnd = Bounds(Numbers=graph)
move = Move(Geometry=line, Motion=Z)  # -> Geometry, Transform
remap = RemapNumbers(Value=graph, Source=bnd, Target=Slider(30, range=0..30))  # -> Mapped, Clipped
series_2 = Series(Start=0, Step=1, Count=number_slider_2)
_2º = PowerOf2(Value=series_2)
Z_2 = UnitZ(Factor=remap.Mapped)
move_2 = Move(Geometry=line_2, Motion=Z_2)  # -> Geometry, Transform
divide = DivideCurve(Curve=move.Geometry, Count=_2º, Kinks=False)  # -> Points, Tangents, Parameters
series_3 = Series(Start=0, Step=1, Count=number_slider)
_2º_2 = PowerOf2(Value=series_3)
shatter = Shatter(Curve=graft(move.Geometry), Parameters=divide.Parameters)
divide_2 = DivideCurve(Curve=move_2.Geometry, Count=_2º_2, Kinks=False)  # -> Points, Tangents, Parameters
midpt = CurveMiddle(Curve=shatter)
shatter_2 = Shatter(Curve=graft(move_2.Geometry), Parameters=divide_2.Parameters)
tstat = TreeStatistics(Tree=midpt)  # -> Paths, Length, Count
midpt_2 = CurveMiddle(Curve=shatter_2)
shift = ShiftList(List=tstat.Paths, Shift=1, Wrap=invert(True))
tstat_2 = TreeStatistics(Tree=midpt_2)  # -> Paths, Length, Count
short = ShortestList(ListA=tstat.Paths, ListB=shift, TrimMode=2)  # -> ListA, ListB
shift_2 = ShiftList(List=tstat_2.Paths, Shift=1, Wrap=invert(True))
branch = TreeBranch(Tree=midpt, Path=short.ListA, MaintainPaths=True)
branch_2 = TreeBranch(Tree=midpt, Path=short.ListB, MaintainPaths=True)
short_2 = ShortestList(ListA=tstat_2.Paths, ListB=shift_2, TrimMode=2)  # -> ListA, ListB
cps = ClosestPoints(Point=branch, Cloud=branch_2, Count="2")  # -> ClosestPoint, CPIndex, Distance
branch_3 = TreeBranch(Tree=midpt_2, Path=short_2.ListA, MaintainPaths=True)
branch_4 = TreeBranch(Tree=midpt_2, Path=short_2.ListB, MaintainPaths=True)
ln = Line(StartPoint=graft(branch), EndPoint=cps.ClosestPoint)
cps_2 = ClosestPoints(Point=branch_3, Cloud=branch_4, Count="2")  # -> ClosestPoint, CPIndex, Distance
pshift = ShiftPaths(Data=ln, Offset=-1)  # -> simplify(Data)
ln_2 = Line(StartPoint=graft(branch_3), EndPoint=cps_2.ClosestPoint)
dom = ConstructDomain(DomainStart=Slider(0.3, range=0..1), DomainEnd=Slider(0.1, range=0..0.1))
tstat_3 = TreeStatistics(Tree=pshift)  # -> Paths, Length, Count
panel = Panel(branch_4)
range_2 = Range(Domain=dom, Steps=expr("x - 1", tstat_3.Count))  # -> graft(Range)
pipe = Pipe(Curve=pshift, Radius=range_2, Caps=0)
cap = CapHoles(Brep=pipe)
