# Grasshopper definition 05_Data Tree - Shift Paths.gh (Grasshopper 1.0.7)
# plug-ins: Human

crv = Curve([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])
panel = Panel(crv)
divide = DivideCurve(Curve=crv, Count="2", Kinks=False)  # -> Points, Tangents, Parameters
viewer = ParamViewer(divide.Points)
cir = Circle(Plane=divide.Points, Radius="5")
number_slider = Slider(1, range=0..10)
divide_2 = DivideCurve(Curve=cir, Count=Slider(8, range=0..10), Kinks=False)  # -> Points, Tangents, Parameters
viewer_2 = ParamViewer(cir)
cir_2 = Circle(Plane=divide_2.Points, Radius="1")
tstat = TreeStatistics(Tree=cir_2)  # -> Paths, Length, Count
item = ListItem(List=tstat.Length, Index=0, Wrap=True)
series = Series(Start=number_slider, Step=number_slider, Count=item)  # -> simplify(graft(Series))
viewer_3 = ParamViewer(tstat.Length)
Z = UnitZ(Factor=series)
extr = Extrude(Base=cir_2, Direction=Z)
cap = CapHoles(Brep=extr)
previewmat = CustomPreviewMaterials(Geometry=cap, DiffuseColor=RGB(255, 255, 255))
panel_2 = Panel(series)
viewer_4 = ParamViewer(series)
