# Grasshopper definition 06_Converting the given line into a flat surface.gh (Grasshopper 1.0.7)

crv = Curve([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])
crv_2 = Curve([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])
# 3 Level - 17
crv_3 = Curve([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])
item = ListItem(List=crv, Index=0, Wrap=True)  # -> Item, Item1
mcx = MultipleCurves(Curves=crv)  # -> Points, IndexA, IndexB, ParamA, ParamB
item_2 = ListItem(List=crv_2, Index=0, Wrap=True)  # -> Item, Item1
mcx_2 = MultipleCurves(Curves=crv_3)  # -> Points, IndexA, IndexB, ParamA, ParamB
mcx_3 = MultipleCurves(Curves=crv_2)  # -> Points, IndexA, IndexB, ParamA, ParamB
ccx = CurveCurve(CurveA=item.Item, CurveB=item.Item1)  # -> Points, ParamsA, ParamsB
bbox = BoundingBox(Content=mcx.Points, Plane=PlaneXY(0, 0, 0), UnionBox=True)  # -> Box, Box_2
ccx_2 = CurveCurve(CurveA=item_2.Item, CurveB=item_2.Item1)  # -> Points, ParamsA, ParamsB
avr = Average(Input=mcx.Points)
avr_2 = Average(Input=mcx_2.Points)
pl = ConstructPlane(Origin=ccx.Points, XAxis=item.Item, YAxis=item.Item1)
pl_2 = ConstructPlane(Origin=ccx_2.Points, XAxis=item_2.Item, YAxis=item_2.Item1)
debox = DeconstructBox(Box=bbox.Box)  # -> Plane, X, Y, Z
box = EvaluateBox(Box=bbox.Box, UParameter=0.5, VParameter=0.5, WParameter=Slider(0.5, range=0..1))  # -> Plane, Point, Include
cir = Circle(Plane=avr_2, Radius=1)
cp = PlaneClosestPoint(Point=mcx_3.Points, Plane=pl_2)  # -> Point, UVPoint, Distance
num = Number(debox.Z)
pl_origin = PlaneOrigin(Base=pl, Origin=box.Point)
alongcrv = SortAlongCurve(Points=mcx_2.Points, Curve=cir)  # -> Points, Indices
sort = SortList(Keys=cp.Distance, ValuesA=mcx_3.Points)  # -> Keys, ValuesA
vec = Vector(pl_origin)
neg = Negative(Value=num)
item_3 = ListItem(List=mcx_2.Points, Index=alongcrv.Indices, Wrap=True)
line = LineSDL(Start=pl_origin, Direction=vec, Length=flatten([num, neg]))
int = Integer(sort.Keys)
partition = PartitionList(List=item_3, Size="8")
cset = CreateSet(List=int)  # -> Set, Map
join = JoinCurves(Curves=line, Preserve=False)
pdecon = Deconstruct(Point=partition)  # -> XComponent, YComponent, ZComponent
mindex = MemberIndex(Set=int, Member=cset.Set)  # -> Index, Count
crv_cp = CurveClosestPoint(Point=mcx.Points, Curve=join)  # -> Point, Parameter, Distance
divide = DivideCurve(Count=10, Kinks=False)  # -> Points, Tangents, Parameters
sdivide = DivideSurface(UCount=10, VCount=10)  # -> Points, Normals, Parameters
sort_2 = SortList(Keys=pdecon.ZComponent, ValuesA=partition)  # -> Keys, ValuesA
item_4 = ListItem(List=sort.ValuesA, Index=mindex.Index, Wrap=True)
sort_3 = SortList(Keys=crv_cp.Parameter, ValuesA=mcx.Points, ValuesB=crv_cp.Point)  # -> Keys, ValuesA, ValuesB
flip = FlipMatrix(Data=sort_2.ValuesA)
vec_2 = Vector(divide.Tangents)
num_2 = Number(divide.Parameters)
avr_3 = Average(Input=item_4)
pgroups = PointGroups(Points=sort_3.ValuesB, Distance="1")  # -> Groups, Indices
pline = PolyLine(Vertices=flip, Closed="1")
cir_2 = Circle(Plane=avr_3, Radius=1)
item_5 = ListItem(List=sort_3.ValuesA, Index=pgroups.Indices, Wrap=True)
alongcrv_2 = SortAlongCurve(Points=item_4, Curve=cir_2)  # -> Points, Indices
boundary = BoundarySurfaces(Edges=pline)
avr_4 = Average(Input=item_5)
pline_2 = PolyLine(Vertices=alongcrv_2.Points, Closed=invert(False))
cir_3 = Circle(Plane=avr_4, Radius=1)
boundary_2 = BoundarySurfaces(Edges=pline_2)
alongcrv_3 = SortAlongCurve(Points=item_5, Curve=cir_3)  # -> Points, Indices
pline_3 = PolyLine(Vertices=alongcrv_3.Points, Closed=invert(False))
boundary_3 = BoundarySurfaces(Edges=pline_3)  # -> flatten(Surfaces)
item_6 = ListItem(List=boundary_3, Index=Slider(7, range=0..7), Wrap=True)
random = Random(Range=Slider(5, range=0..10), Number=Slider(20, range=0..20), Seed=Slider(3, range=0..10), Integers=True)
sort_4 = SortList(Keys=random)  # -> Keys, ValuesA
panel = Panel(random)
cset_2 = CreateSet(List=sort_4.Keys)  # -> Set, Map
mindex_2 = MemberIndex(Set=sort_4.Keys, Member=cset_2.Set)  # -> Index, Count
panel_2 = Panel(cset_2.Set)
item_7 = ListItem(List=sort_4.Keys, Index=mindex_2.Index, Wrap=True)
panel_3 = Panel(item_7)
