# Grasshopper definition 07_Variable offset curve.gh (Grasshopper 1.0.7)

number_slider = Slider(27, range=0..50)
number_slider_2 = Slider(7, range=0..10)
# 3 Level - 18
crv = Curve(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)
number_slider_3 = Slider(6, range=0..10)
panel = Panel("""0
1""")
crv_2 = Curve(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)
pframe = PerpFrame(Curve=reparameterize(crv), Parameter=panel)
dom = ConstructDomain(DomainStart=Slider(1.73, range=0..10), DomainEnd=Slider(5.05, range=0..10))
hframes = HorizontalFrames(Curve=crv_2, Count=number_slider)  # -> Frames, Parameters
divide = DivideCurve(Curve=crv_2, Count=Slider(27, range=0..50), Kinks=False)  # -> Points, Tangents, Parameters
neg = Negative(Value=number_slider_2)
neg_2 = Negative(Value=number_slider_3)
deplane = DeconstructPlane(Plane=hframes.Frames)  # -> graft(Origin), XAxis, graft(YAxis), ZAxis
range = Range(Domain=dom, Steps=number_slider)
merge = Merge(Data1=number_slider_2, Data2=neg)  # -> graft(Result)
merge_2 = Merge(Data1=number_slider_3, Data2=neg_2)  # -> graft(Result)
dispatch = Dispatch(List=pframe, DispatchPattern=[True, False])  # -> ListA, ListB
neg_3 = Negative(Value=range)
merge_3 = Merge(Data1=graft(neg_3), Data2=graft(range))
line = LineSDL(Start=dispatch.ListA, Direction=Vector(0, 0, 1), Length=merge)
line_2 = LineSDL(Start=dispatch.ListB, Direction=Vector(0, 0, 1), Length=merge_2)
amp = Amplitude(Vector=deplane.YAxis, Amplitude=merge_3)
rotate = Rotate(Geometry=line, Angle=1.570796327, Plane=dispatch.ListA)  # -> Geometry, Transform
rotate_2 = Rotate(Geometry=line_2, Angle=1.570796327, Plane=dispatch.ListB)  # -> Geometry, Transform
move = Move(Geometry=deplane.Origin, Motion=amp)  # -> Geometry, Transform
flip = FlipMatrix(Data=move.Geometry)
merge_4 = Merge(Data1=rotate.Geometry, Data2=rotate_2.Geometry)
intcrv = Interpolate(Vertices=flip, Degree=3, Periodic=False, KnotStyle=1)  # -> flatten(Curve), Length, Domain
flip_2 = FlipMatrix(Data=merge_4)
tstat = TreeStatistics(Tree=flip_2)  # -> Paths, Length, Count
divide_2 = DivideCurve(Curve=intcrv.Curve, Count="1", Kinks=False)  # -> Points, Tangents, Parameters
dispatch_2 = Dispatch(List=tstat.Paths, DispatchPattern=[True, False])  # -> ListA, ListB
flip_3 = FlipMatrix(Data=divide_2.Points)
flip_4 = FlipMatrix(Data=divide_2.Tangents)
branch = TreeBranch(Tree=flip_2, Path=dispatch_2.ListA, MaintainPaths=True)
branch_2 = TreeBranch(Tree=flip_2, Path=dispatch_2.ListB, MaintainPaths=True)
item = ListItem(List=flip_3, Index=0, Wrap=True)  # -> Item, Item1
item_2 = ListItem(List=flip_4, Index=0, Wrap=True)
panel_2 = Panel("""-1
1""")
swp2 = Sweep2(Rail1=branch, Rail2=branch_2, Sections=crv, SameHeight=False)
multiplication = Multiplication(A=item_2, B=graft(panel_2))
arc = ArcSED(Start=item.Item, End=item.Item1, Direction=multiplication)  # -> Arc, Plane, Radius
