# Grasshopper definition 09_Creating a polyline by connecting points.gh (Grasshopper 1.0.7)

pt = Point(Tree({0;0}: [Point(8.360102611, 23.03302887, 0), Point(8.553503518, 13.43984358, 0)], {0;1}: [Point(17.06463073, 27.0165522, 0.9579941696), Point(17.06463073, 21.59253462, 4.654937278), Point(17.06463073, 15.77078763, 4.653572714), Point(17.06463073, 9.385434981, 1.626177295)], {0;2}: [Point(27.84526556, 24.06891358, 4.549172877), Point(27.84526556, 19.94086009, 7.041467193), Point(27.84526556, 16.12728719, 6.620386851), Point(27.84526556, 12.26803701, 2.769042926)], {0;3}: [Point(39.13667581, 27.11716779, 0), Point(39.13667581, 21.47096223, 5.760048053), Point(39.13667581, 15.65736813, 5.628133802), Point(39.13667581, 10.22893265, 1.56347406)], {0;4}: [Point(49.06322942, 25.38107834, 0), Point(49.34294195, 12.37331728, 0)]))
pt_2 = Point(Tree({0;0}: [Point(8.360102611, 23.03302887, 0), Point(8.553503518, 13.43984358, 0)], {0;1}: [Point(17.06463073, 27.0165522, 0.9579941696), Point(17.06463073, 21.59253462, 4.654937278), Point(17.06463073, 15.77078763, 4.653572714), Point(17.06463073, 9.385434981, 1.626177295)], {0;2}: [Point(27.84526556, 24.06891358, 4.549172877), Point(27.84526556, 19.94086009, 7.041467193), Point(27.84526556, 16.12728719, 6.620386851), Point(27.84526556, 12.26803701, 2.769042926)], {0;3}: [Point(39.13667581, 27.11716779, 0), Point(39.13667581, 21.47096223, 5.760048053), Point(39.13667581, 15.65736813, 5.628133802), Point(39.13667581, 10.22893265, 1.56347406)], {0;4}: [Point(49.06322942, 25.38107834, 0), Point(49.34294195, 12.37331728, 0)]))
tstat = TreeStatistics(Tree=pt)  # -> Paths, Length, Count
tstat_2 = TreeStatistics(Tree=pt_2)  # -> Paths, Length, Count
panel = Panel("""0
-1""")
# 3 Level - 05
pline = PolyLine(Vertices=pt_2, Closed=False)
panel_2 = Panel("""0
-1""")
explode = Explode(Curve=pline, Recursive=True)  # -> Segments, Vertices
item = ListItem(List=tstat.Paths, Index=panel_2, Wrap=True)
cull_i = CullIndex(List=tstat.Paths, Indices=panel_2, Wrap=True)
item_2 = ListItem(List=tstat_2.Paths, Index=panel, Wrap=True)
cull_i_2 = CullIndex(List=tstat_2.Paths, Indices=panel, Wrap=True)
branch = TreeBranch(Tree=pt, Path=cull_i, MaintainPaths=True)
branch_2 = TreeBranch(Tree=pt_2, Path=cull_i_2, MaintainPaths=True)
branch_3 = TreeBranch(Tree=pt, Path=item, MaintainPaths=True)
branch_4 = TreeBranch(Tree=pt_2, Path=item_2, MaintainPaths=True)
panel_3 = Panel("""0
-1""")
panel_4 = Panel("""0
-1""")
ins = InsertItems(List=branch_4, Indices=panel_3, Wrap=True)
ins_2 = InsertItems(List=branch_3, Item="0,0,0", Indices=panel_4, Wrap=True)
pshift = ShiftPaths(Data=ins, Offset=-1)
merge = Merge(Data1=simplify(ins_2), Data2=simplify(branch))
pshift_2 = ShiftPaths(Data=ins_2, Offset=-1)
merge_2 = Merge(Data1=pshift, Data2=branch_2)
flip = FlipMatrix(Data=merge)
viewer = ParamViewer(ins_2)
flip_2 = FlipMatrix(Data=merge_2)
cullpt = CullDuplicates(Points=flip, Tolerance=0.1, CullMode=2)  # -> Points, Indices, Valence
pline_2 = PolyLine(Vertices=flip_2, Closed=False)
pline_3 = PolyLine(Vertices=cullpt.Points, Closed=False)
pline_4 = PolyLine(Vertices=pt, Closed=False)
