# Grasshopper definition 10_Arrange the given units at the edges.gh (Grasshopper 1.0.7)
# plug-ins: Human, Kangaroo2 Components

brep = Brep(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)
brep_2 = Brep(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)
# 3 Level - 19
brep_3 = Brep(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)
brep_4 = Brep(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)
brep_5 = Brep(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)
debrep = DeconstructBrep(Brep=brep)  # -> Faces, Edges, Vertices
brep_6 = Brep(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)
debrep_2 = DeconstructBrep(Brep=brep_2)  # -> Faces, Edges, Vertices
smesh = SimpleMesh(Brep=brep_5)
debrep_3 = DeconstructBrep(Brep=brep_3)  # -> Faces, Edges, Vertices
debrep_4 = DeconstructBrep(Brep=brep_6)  # -> Faces, Edges, Vertices
expression = Expression(p=debrep.Vertices, Expression="p.X+p.Y")
debrep_5 = DeconstructBrep(Brep=brep_4)  # -> Faces, Edges, Vertices
midpt = CurveMiddle(Curve=debrep_2.Edges)
crv = Curve(flatten(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))
clean = CombineClean(Meshes=smesh)
item = ListItem(List=debrep_3.Faces, Index=0, Wrap=True)  # -> Item, Item1, Item2, Item3, Item4, Item5
pt = Point(debrep_2.Vertices)
crv_2 = Curve(flatten(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))
crv_3 = Curve(flatten(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))
pt_2 = Point(Point(5.553024042, 5.429078394, 0))
pt_3 = Point(Point(11.83952019, 14.51984488, 0))
pt_4 = Point(Point(10.17544768, 1.607874855, 0))
pt_5 = Point(Point(21.82395524, 3.518476625, 0))
pt_6 = Point(debrep_4.Vertices)
pt_7 = Point(Point(9.656081487, 6.614180005, 0))
pt_8 = Point(Point(21.71623204, 8.858813705, 0))
item_2 = ListItem(List=debrep_5.Vertices, Index=0, Wrap=True)
cps = ClosestPoints(Point=graft(pt), Cloud=midpt, Count="3")  # -> ClosestPoint, CPIndex, Distance
sort = SortList(Keys=expression, ValuesA=debrep.Vertices)  # -> Keys, ValuesA
explode = Explode(Curve=crv, Recursive=True)  # -> Segments, Vertices
demesh = DeconstructMesh(Mesh=clean)  # -> Vertices, Faces, Colours, Normals
sph = Sphere(Base=pt_6, Radius=1)
explode_2 = Explode(Curve=crv_2, Recursive=True)  # -> Segments, Vertices
vec2pt = Vector2Pt(PointA=pt_4, PointB=pt_5, Unitize=False)  # -> Vector, Length
vec2pt_2 = Vector2Pt(PointA=pt_2, PointB=pt_3, Unitize=False)  # -> Vector, Length
explode_3 = Explode(Curve=crv_3, Recursive=True)  # -> Segments, Vertices
disc = Discontinuity(Curve=[item.Item4, item.Item5], Level=1)  # -> Points, Parameters
vec2pt_3 = Vector2Pt(PointA=pt_7, PointB=pt_8, Unitize=False)  # -> Vector, Length
lng = ListLength(List=pt)
item_3 = ListItem(List=sort.ValuesA, Index="-2", Wrap=True)
panel = Panel("""-1
1""")
split = SplitWithBrep(Curve=debrep_4.Edges, Brep=graft(sph))  # -> Curve, Points
pdecon = Deconstruct(Point=demesh.Vertices)  # -> XComponent, YComponent, ZComponent
shift = ShiftList(List=explode.Segments, Shift="-1", Wrap=True)
vec2pt_4 = Vector2Pt(PointA=graft(pt), PointB=cps.ClosestPoint, Unitize=invert(False))  # -> Vector, Length
cull_i = CullIndex(List=explode.Vertices, Indices="-1", Wrap=True)
lng_2 = ListLength(List=demesh.Normals)
shift_2 = ShiftList(List=explode_2.Segments, Shift="-1", Wrap=True)
shift_3 = ShiftList(List=explode_3.Segments, Shift="-1", Wrap=True)
subtraction = Subtraction(A=vec2pt_2.Vector, B=vec2pt.Vector)
pl_origin = PlaneOrigin(Base=item.Item4, Origin=disc.Points)
panel_2 = Panel("""0,0,-1
0,0,1""")
cull_i_2 = CullIndex(List=explode_2.Vertices, Indices="-1", Wrap=True)
pt_9 = Point(vec2pt_3.Vector)
cull_i_3 = CullIndex(List=explode_3.Vertices, Indices="-1", Wrap=True)
panel_3 = Panel(vec2pt_3.Vector)
sort_2 = SortList(Keys=pdecon.ZComponent, ValuesA=demesh.Vertices, ValuesB=demesh.Normals)  # -> Keys, ValuesA, ValuesB
repeat = RepeatData(Data=graft(panel), Length=expr("x/2", lng))  # -> flatten(Data)
Z = UnitZ(Factor=1)
pshift = ShiftPaths(Data=split.Points, Offset=-1)
vec = Vector(shift)
cps_2 = ClosestPoints(Point=item_3, Cloud=sort.ValuesA, Count="2")  # -> ClosestPoint, CPIndex, Distance
vec_2 = Vector(explode.Segments)
vec_3 = Vector(explode_2.Segments)
vec_4 = Vector(shift_2)
pt_10 = Point(subtraction)
vec_5 = Vector(explode_3.Segments)
vec_6 = Vector(shift_3)
ma = MassAddition(Input=vec2pt_4.Vector)  # -> Result, PartialResults
panel_4 = Panel(subtraction)
repeat_2 = RepeatData(Data=graft(panel_2), Length=expr("x/2", lng_2))  # -> flatten(Data)
rev = Reverse(Vector=vec)
neg = Negative(Value=vec_4)
line = LineSDL(Start=cull_i, Direction=vec_2, Length="2")
item_4 = ListItem(List=cps_2.ClosestPoint, Index="1", Wrap=True)
subtraction_2 = Subtraction(A=vec_5, B=vec_6)
vec2pt_5 = Vector2Pt(PointA=graft(pt_6), PointB=pshift, Unitize=invert(False))  # -> Vector, Length
panel_5 = Panel("""-pi / 2
0
pi / 2
pi""")
multiplication = Multiplication(A=graft(repeat), B=Z)
addition = Addition(A=vec_3, B=neg)
orient = Orient(Geometry=brep_4, Source=item_2, Target=pl_origin)  # -> Geometry, Transform
pl = ConstructPlane(Origin=sort_2.ValuesA, XAxis=sort_2.ValuesB, YAxis=repeat_2)
angle = Angle(VectorA=vec_2, VectorB=rev)  # -> Angle, Reflex
vec2pt_6 = Vector2Pt(PointA=item_4, PointB=item_3, Unitize=False)  # -> Vector, Length
Z_2 = UnitZ(Factor=1)
line_2 = LineSDL(Start=cull_i_3, Direction=subtraction_2, Length=1)
ma_2 = MassAddition(Input=vec2pt_5.Vector)  # -> Result, PartialResults
pl_2 = ConstructPlane(Origin=graft(pt), XAxis=ma.Result, YAxis=multiplication)  # -> flatten(Plane)
pl_3 = ConstructPlane(Origin=item_3, XAxis=vec2pt_6.Vector, YAxis=Z_2)
line_3 = LineSDL(Start=cull_i_2, Direction=addition, Length=1)
division = Division(A=angle.Angle, B="2")
rot3d = Rotate3D(Geometry=orient.Geometry, Angle=panel_5, Center=disc.Points, Axis=Vector(0, 0, 1))  # -> Geometry, Transform
rotate = Rotate(Geometry=line, Angle=division, Plane=cull_i)  # -> Geometry, Transform
orient_2 = Orient(Geometry=brep, Source=pl_3, Target=pl_2)  # -> Geometry, Transform
crv_4 = Curve(flatten(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))
panel_6 = Panel(angle.Angle)
tstat = TreeStatistics(Tree=rot3d.Geometry)  # -> Paths, Length, Count
panel_7 = Panel("""10
20
30""")
previewmat = CustomPreviewMaterials(Geometry=orient_2.Geometry, DiffuseColor=RGB(255, 255, 255))
offset = OffsetCurve(Curve=crv_4, Distance=1, Corners=1)  # -> flatten(Curve)
ma_3 = MassAddition(Input=panel_7)  # -> Result, PartialResults
dispatch = Dispatch(List=tstat.Paths, DispatchPattern=[True, False])  # -> ListA, ListB
merge = Merge(Data1=graft(crv_4), Data2=graft(offset))
panel_8 = Panel(ma_3.PartialResults)
branch = TreeBranch(Tree=rot3d.Geometry, Path=dispatch.ListB, MaintainPaths=True)
branch_2 = TreeBranch(Tree=rot3d.Geometry, Path=dispatch.ListA, MaintainPaths=True)
disc_2 = Discontinuity(Curve=merge, Level=1)  # -> Points, Parameters
mirror = Mirror(Geometry=branch, Plane=item.Item5)  # -> Geometry, Transform
panel_9 = Panel("""-1
1""")
flip = FlipMatrix(Data=disc_2.Points)
repeat_3 = RepeatData(Data=graft(panel_9), Length=Slider(4, range=0..10))  # -> flatten(Data)
item_5 = ListItem(List=flip, Index=0, Wrap=True)  # -> Item, Item1
brep_7 = Brep(mirror.Geometry)
dup = DuplicateData(Data=panel_9, Number=Slider(4, range=0..10), Order=Toggle(False))
brep_8 = Brep(branch_2)
vec2pt_7 = Vector2Pt(PointA=item_5.Item, PointB=item_5.Item1, Unitize=False)  # -> Vector, Length
panel_10 = Panel(dup)
panel_11 = Panel(repeat_3)
dist = Distance()
pt_11 = Point(graft([Point(21, -16, 0), Point(24, -16, 0), Point(27, -16, 0), Point(31, -16, 0), Point(34, -16, 0)]))
pt_12 = Point([Point(24.20154273, -24.35507821, 0), Point(30.41685355, -24.55476691, 0)])
pt_13 = Point([Point(21, -16, 0), Point(24, -16, 0), Point(27, -16, 0), Point(31, -16, 0), Point(34, -16, 0)])
pt_14 = Point([Point(24.20154273, -24.35507821, 0), Point(30.41685355, -24.55476691, 0)])
crv_cp = CurveClosestPoint()  # -> Point, Parameter, Distance
pull = PullPoint(ClosestOnly=True)  # -> ClosestPoint, Distance
dist_2 = Distance(PointA=pt_11, PointB=pt_12)
srf_cp = SurfaceClosestPoint()  # -> Point, UVPoint, Distance
pull_2 = PullPoint(Point=pt_13, Geometry=pt_14, ClosestOnly=True)  # -> ClosestPoint, Distance
sort_3 = SortList(Keys=dist_2, ValuesA=pt_12)  # -> Keys, ValuesA
ln = Line(StartPoint=pt_13, EndPoint=pull_2.ClosestPoint)
brep_cp = BrepClosestPoint()  # -> Point, Normal, Distance
item_6 = ListItem(List=sort_3.ValuesA, Index=0, Wrap=True)
ln_2 = Line(StartPoint=pt_11, EndPoint=item_6)
pt_15 = Point([Point(24.20154273, -24.35507821, 0), Point(30.41685355, -24.55476691, 0)])
pt_16 = Point([Point(21, -16, 0), Point(24, -16, 0), Point(27, -16, 0), Point(31, -16, 0), Point(34, -16, 0)])
panel_12 = Panel(pull_2.Distance)
panel_13 = Panel(item_6)
cps_3 = ClosestPoints(Point=pt_16, Cloud=pt_15, Count="2")  # -> ClosestPoint, CPIndex, Distance
ln_3 = Line(StartPoint=pt_16, EndPoint=cps_3.ClosestPoint)
