# Grasshopper definition 12_3Level-06.gh (Grasshopper 1.0.7)

srf = Surface(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)
# 3 Level - 06
srfsplit = SurfaceSplit()
sdivide = DivideSurface(Surface=srf, UCount=Slider(3, range=0..100), VCount=10)  # -> Points, Normals, Parameters
bbox = BoundingBox(Content=sdivide.Points, Plane=PlaneXY(0, 0, 0), UnionBox=True)  # -> Box, Box_2
area = Area(Geometry=bbox.Box)  # -> Area, Centroid
scale = Scale(Geometry=bbox.Box, Center=area.Centroid, Factor=Slider(1.7, range=0..10))  # -> Geometry, Transform
bbx = BrepBrep(BrepA=srf, BrepB=scale.Geometry)  # -> flatten(Curves), Points
srf_2 = Surface(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)
srf_3 = Surface(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)
srfsplit_2 = SurfaceSplit(Surface=srf, Curves=bbx.Curves)
srf_4 = Surface(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)
srf_5 = Surface(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)
divide = DivideDomain²(Domain=srf_2, UCount=Slider(4, range=0..10), VCount="1")
divide_2 = DivideDomain²(Domain=srf_3, UCount=Slider(4, range=0..10), VCount="1")
divide_3 = DivideDomain²(Domain=srfsplit_2, UCount="1", VCount=Slider(6, range=0..10))
subsrf = Isotrim(Surface=srf_2, Domain=divide)  # -> graft(Surface)
subsrf_2 = Isotrim(Surface=srfsplit_2, Domain=divide_3)
subsrf_3 = Isotrim(Surface=srf_3, Domain=divide_2)  # -> graft(Surface)
divide_4 = DivideDomain²(Domain=srf_4, UCount=Slider(8, range=0..100), VCount="1")
number_slider = Slider(63, range=0..100)
divide_5 = DivideDomain²(Domain=srf_5, UCount=Slider(4, range=0..10), VCount="1")
edges = BrepEdges(Brep=subsrf)  # -> simplify(Naked), Interior, NonManifold
edges_2 = BrepEdges(Brep=subsrf_3)  # -> simplify(Naked), Interior, NonManifold
subsrf_4 = Isotrim(Surface=srf_4, Domain=divide_4)  # -> graft(Surface)
subsrf_5 = Isotrim(Surface=srf_5, Domain=divide_5)  # -> graft(Surface)
item = ListItem(List=edges.Naked, Index=0, Wrap=True)  # -> flatten(Item), flatten(Item1)
tstat = TreeStatistics(Tree=subsrf_4)  # -> Paths, Length, Count
number_slider_2 = Slider(25, range=0..100)
tstat_2 = TreeStatistics(Tree=edges_2.Naked)  # -> Paths, Length, Count
edges_3 = BrepEdges(Brep=subsrf_5)  # -> simplify(Naked), Interior, NonManifold
dispatch = Dispatch(List=tstat.Paths, DispatchPattern=[True, False])  # -> ListA, ListB
dispatch_2 = Dispatch(List=tstat_2.Paths, DispatchPattern=[True, False])  # -> ListA, ListB
dispatch_3 = Dispatch(List=item.Item1, DispatchPattern=[True, False])  # -> graft(ListA), ListB
branch = TreeBranch(Tree=edges_2.Naked, Path=dispatch_2.ListA, MaintainPaths=True)
tstat_3 = TreeStatistics(Tree=edges_3.Naked)  # -> Paths, Length, Count
branch_2 = TreeBranch(Tree=edges_2.Naked, Path=dispatch_2.ListB, MaintainPaths=True)
branch_3 = TreeBranch(Tree=subsrf_4, Path=dispatch.ListB, MaintainPaths=True)  # -> simplify(Branch)
branch_4 = TreeBranch(Tree=subsrf_4, Path=dispatch.ListA, MaintainPaths=True)
item_2 = ListItem(List=branch, Index=0, Wrap=True)
divide_6 = DivideCurve(Curve=dispatch_3.ListA, Count=number_slider_2, Kinks=False)  # -> Points, Tangents, Parameters
dispatch_4 = Dispatch(List=tstat_3.Paths, DispatchPattern=[True, False])  # -> ListA, ListB
loft = Loft(Curves=branch_2, Options={Adjust=False, Closed=False, LoftEnds=0, LoftSimp=0, LoftType=0, Rebuild=10, Refit=0.01})
edges_4 = BrepEdges(Brep=branch_4)  # -> simplify(Naked), Interior, NonManifold
flip = FlipCurve(Curve=branch, Guide=item_2)  # -> graft(Curve), Flag
shatter = Shatter(Curve=dispatch_3.ListA, Parameters=divide_6.Parameters)
branch_5 = TreeBranch(Tree=edges_3.Naked, Path=dispatch_4.ListB, MaintainPaths=True)
branch_6 = TreeBranch(Tree=edges_3.Naked, Path=dispatch_4.ListA, MaintainPaths=True)
item_3 = ListItem(List=edges_4.Naked, Index=0, Wrap=True)
divide_7 = DivideCurve(Curve=flip.Curve, Count=Slider(8, range=0..100), Kinks=False)  # -> Points, Tangents, Parameters
midpt = CurveMiddle(Curve=shatter)
number_slider_3 = Slider(0.5, range=0..1)
number_slider_4 = Slider(19, range=0..100)
flip_2 = FlipCurve(Curve=edges_4.Naked, Guide=item_3)  # -> graft(Curve), Flag
crv_cp = CurveClosestPoint(Point=midpt, Curve=graft(dispatch_3.ListB))  # -> Point, Parameter, Distance
shatter_2 = Shatter(Curve=flip.Curve, Parameters=divide_7.Parameters)
curvepoint = PointOnCurve(parameter=0.5)
divide_8 = DivideCurve(Curve=flip_2.Curve, Count=number_slider_4, Kinks=False)  # -> Points, Tangents, Parameters
midpt_2 = CurveMiddle(Curve=shatter_2)
merge = Merge(Data1=divide_6.Points, Data2=crv_cp.Point)
crv_cp_2 = CurveClosestPoint(Point=midpt_2, Curve=flip.Curve)  # -> Point, Parameter, Distance
shatter_3 = Shatter(Curve=flip_2.Curve, Parameters=divide_8.Parameters)
midpt_3 = CurveMiddle(Curve=shatter_3)
item_4 = ListItem(List=crv_cp_2.Parameter, Index=0, Wrap=True)
partition = PartitionList(List=merge, Size=number_slider_2)  # -> simplify(Chunks)
seam = Seam(Curve=flip.Curve, Seam=item_4)
crv_cp_3 = CurveClosestPoint(Point=midpt_3, Curve=flip_2.Curve)  # -> Point, Parameter, Distance
pshift = ShiftPaths(Data=seam, Offset="-2")
item_5 = ListItem(List=crv_cp_3.Parameter, Index=0, Wrap=True)
loft_2 = Loft(Curves=pshift, Options={Adjust=False, Closed=False, LoftEnds=0, LoftSimp=0, LoftType=0, Rebuild=10, Refit=0.01})
seam_2 = Seam(Curve=flip_2.Curve, Seam=item_5)
panel = Panel(seam)
pshift_2 = ShiftPaths(Data=seam_2, Offset="-2")
loft_3 = Loft(Curves=pshift_2, Options={Adjust=False, Closed=False, LoftEnds=0, LoftSimp=0, LoftType=0, Rebuild=10, Refit=0.01})
merge_2 = Merge(Data1=loft_3, Data2=branch_3)
divide_9 = DivideDomain²(Domain=merge_2, UCount="1", VCount=number_slider_4)
subsrf_6 = Isotrim(Surface=merge_2, Domain=divide_9)
