# Grasshopper definition 13_Grasshopper Parametric Light.gh (Grasshopper 1.0.7)

merge = Merge(Data1=Slider(1.1, range=0..10), Data2=Slider(2.3, range=0..10))
repeat = RepeatData(Data=merge, Length=Slider(22, range=0..100))
number_slider = Slider(0.25, range=0..1)
ma = MassAddition(Input=repeat)  # -> Result, PartialResults
bnd = Bounds(Numbers=ma.PartialResults)
dom = ConstructDomain(DomainStart=Slider(20, range=0..100), DomainEnd=Slider(50, range=0..100))
number_slider_2 = Slider(1.9, range=0..5)
xz = XZPlane(Origin=Point(0, 0, 0))
remap = RemapNumbers(Value=ma.PartialResults, Source=bnd, Target=dom)  # -> Mapped, Clipped
expression = Expression(x=number_slider, Expression="If(x ≥ 0.5, x - 0.5, x + 0.5)")
cir = Circle(Plane=xz, Radius=remap.Mapped)
panel = Panel("""0
-1""")
amp = Amplitude(Vector=xz, Amplitude=number_slider_2)
partition = PartitionList(List=cir, Size="2")
item = ListItem(List=cir, Index=panel, Wrap=True)
rev = Reverse(Vector=amp)
loft = Loft(Curves=partition, Options={Adjust=False, Closed=False, LoftEnds=0, LoftSimp=0, LoftType=0, Rebuild=10, Refit=0.01})  # -> flatten(Loft)
merge_2 = Merge(Data1=number_slider, Data2=expression)
merge_3 = Merge(Data1=amp, Data2=rev)  # -> graft(Result)
eval = EvaluateCurve(Curve=reparameterize(item), Parameter=graft(merge_2))  # -> Point, Tangent, Angle
move = Move(Geometry=loft, Motion=merge_3)  # -> Geometry, Transform
pline = PolyLine(Vertices=eval.Point, Closed=False)
edges = BrepEdges(Brep=move.Geometry)  # -> Naked, Interior, NonManifold
flip = FlipMatrix(Data=move.Geometry)
ext = ExtendCurve(Curve=pline, Type=0, Start=Slider(0.44, range=0..10), End=Slider(5, range=0..10))
pshift = ShiftPaths(Data=edges.Naked, Offset=-1)
multiplication = Multiplication(A=number_slider_2, B=Slider(0.6, range=0..0.99))
flip_2 = FlipMatrix(Data=pshift)
pipe = Pipe(Curve=ext, Radius=multiplication, Caps=0)
loft_2 = Loft(Curves=flip_2, Options={Adjust=False, Closed=False, LoftEnds=0, LoftSimp=0, LoftType=0, Rebuild=10, Refit=0.01})  # -> flatten(Loft)
partition_2 = PartitionList(List=loft_2, Size="2")
cap = CapHoles(Brep=pipe)
merge_4 = Merge(Data1=partition_2, Data2=flip)
join = BrepJoin(Breps=merge_4)  # -> flatten(Breps), Closed
lng = ListLength(List=join.Breps)
pi = Pi(Factor=1)
range = Range(Domain=Domain(0, 1), Steps=expr("x-1", lng))
multiplication_2 = Multiplication(A=pi, B=Slider(0.7, range=0..1))
item_2 = ListItem(List=flatten(pline), Index=0, Wrap=True)
bnd_2 = Bounds(Numbers=range)
dom_2 = ConstructDomain(DomainStart=0, DomainEnd=multiplication_2)
remap_2 = RemapNumbers(Value=range, Source=bnd_2, Target=dom_2)  # -> Mapped, Clipped
rotax = RotateAxis(Geometry=join.Breps, Angle=remap_2.Mapped, Axis=item_2)  # -> Geometry, Transform
sdiff = SolidDifference(BrepsA=rotax.Geometry, BrepsB=flatten(cap))
