# Grasshopper definition 14_Kinetic facade Tutorial_(from adam youtube).gh (Grasshopper 1.0.7)

number_slider = Slider(39, range=0..100)
xy = XYPlane(Origin=Point(0, 0, 0))
rectangle = Rectangle(Plane=xy, XSize=number_slider, YSize=number_slider, Radius=0)  # -> Rectangle, Length
division = Division(A=number_slider, B="2")
boxrec = BoxRectangle(Rectangle=rectangle.Rectangle, Height=division)
debrep = DeconstructBrep(Brep=boxrec)  # -> Faces, Edges, Vertices
pt = ConstructPoint(XCoordinate=0, YCoordinate=Slider(0.26, range=0..1), ZCoordinate=0)
item = ListItem(List=debrep.Faces, Index=0, Wrap=True)
iso = IsoCurve(Surface=reparameterize(item), UVPoint=pt)  # -> UIsocurve, VIsocurve
srfsplit = SurfaceSplit(Surface=item, Curves=iso.UIsocurve)
item_2 = ListItem(List=srfsplit, Index=0, Wrap=True)
planar = IsPlanar(Surface=item_2, Interior=True)  # -> Planar, Plane
range = Range(Domain=Domain(0, 1), Steps=Slider(108, range=0..1000))
amp = Amplitude(Vector=planar.Plane, Amplitude=Slider(5, range=0..10))
move = Move(Geometry=item_2, Motion=amp)  # -> Geometry, Transform
pt_2 = ConstructPoint(XCoordinate=range, YCoordinate=0, ZCoordinate=0)
iso_2 = IsoCurve(Surface=reparameterize(move.Geometry), UVPoint=pt_2)  # -> UIsocurve, flatten(VIsocurve)
graph = GraphMapper(range, x0=0, x1=1, y0=0, y1=1, container_name="Gaussian", factor=0.3705917597, mean=0.4770065546, sdev=0.1602057815)
lng = ListLength(List=iso_2.VIsocurve)
multiplication = Multiplication(A=Slider(0.46, range=0..1), B=lng)
bnd = Bounds(Numbers=graph)
dom = ConstructDomain(DomainStart=Slider(32.2, range=0..100), DomainEnd=Slider(7.7, range=0..100))
item_3 = ListItem(List=iso_2.VIsocurve, Index=multiplication, Wrap=True)
remap = RemapNumbers(Value=graph, Source=bnd, Target=dom)  # -> Mapped, Clipped
midpt = CurveMiddle(Curve=item_3)
midpt_2 = CurveMiddle(Curve=iso_2.VIsocurve)
pull = PullPoint(Point=midpt_2, Geometry=midpt, ClosestOnly=True)  # -> ClosestPoint, Distance
pl = ConstructPlane(Origin=midpt_2, XAxis=amp, YAxis=iso_2.VIsocurve)
sort = SortList(Keys=pull.Distance, ValuesA=iso_2.VIsocurve)  # -> Keys, ValuesA
number_slider_2 = Slider(0.5, range=0..1)
rotate = Rotate(Geometry=sort.ValuesA, Angle=degrees(remap.Mapped), Plane=pl)  # -> graft(Geometry), Transform
offset = OffsetCurve(Curve=rotate.Geometry, Distance=number_slider_2, Plane=graft(pl), Corners=1)
division_2 = Division(A=number_slider_2, B=Slider(7.75, range=0..10))
rulesrf = RuledSurface(CurveA=rotate.Geometry, CurveB=offset)
planar_2 = IsPlanar(Surface=rulesrf, Interior=True)  # -> Planar, Plane
amp_2 = Amplitude(Vector=planar_2.Plane, Amplitude=division_2)
rev = Reverse(Vector=amp_2)
merge = Merge(Data1=amp_2, Data2=rev)
extr = Extrude(Base=rulesrf, Direction=rev)
sunion = SolidUnion(Breps=extr)
fmerge = MergeFaces(Brep=sunion)  # -> Breps, Before, After
