# Grasshopper definition 15_making a gable roof.gh (Grasshopper 1.0.7)

crv = Curve([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])
explode = Explode(Curve=crv, Recursive=True)  # -> Segments, Vertices
disc = Discontinuity(Curve=crv, Level=1)  # -> Points, Parameters
pi = Pi(Factor=Slider(0.2, range=0..2))
pline = PolyLine(Vertices=disc.Points, Closed=invert(False))
kinkcrv = KinkyCurve(Vertices=explode.Vertices, Degree=Slider(3, range=0..10), Angle=pi)  # -> Curve, Length, Domain
disc_2 = Discontinuity(Curve=kinkcrv.Curve, Level=1)  # -> Points, Parameters
pline_2 = PolyLine(Vertices=disc_2.Points, Closed=invert(False))
neg = Negative(Value=Slider(4.1, range=0..100))
offset = OffsetCurve(Curve=pline_2, Distance=neg, Corners=1)
explode_2 = Explode(Curve=offset, Recursive=True)  # -> Segments, Vertices
boundary = BoundarySurfaces(Edges=pline_2)  # -> simplify(Surfaces)
explode_3 = Explode(Curve=pline_2, Recursive=True)  # -> Segments, Vertices
len = Length(Curve=explode_2.Segments)
sort = SortList(Keys=len, ValuesA=explode_3.Segments)  # -> Keys, ValuesA
panel = Panel("""0
1""")
cull_i = CullIndex(List=sort.ValuesA, Indices=panel, Wrap=True)
join = JoinCurves(Curves=cull_i, Preserve=False)
item = ListItem(List=join, Index=0, Wrap=True)
Z = UnitZ(Factor=Slider(3, range=0..10))
flip = FlipCurve(Curve=join, Guide=item)  # -> simplify(Curve), Flag
disc_3 = Discontinuity(Curve=flip.Curve, Level=1)  # -> Points, Parameters
crv_2 = Curve([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])
path_mapper = PathMapper(disc_3.Points, source="{A;B}(i)", target="{A;i}")
item_2 = ListItem(List=flip.Curve, Index=0, Wrap=True)  # -> Item, Item1
disc_4 = Discontinuity(Curve=crv_2, Level=1)  # -> Points, Parameters
move = Move(Geometry=flip.Curve, Motion=Z)  # -> Geometry, Transform
extr = Extrude(Base=flip.Curve, Direction=Z)
explode_4 = Explode(Curve=item_2.Item, Recursive=True)  # -> graft(Segments), Vertices
explode_5 = Explode(Curve=item_2.Item1, Recursive=True)  # -> graft(Segments), Vertices
viewer = ParamViewer(disc_4.Points)
flip_2 = FlipMatrix(Data=disc_4.Points)
item_3 = ListItem(List=move.Geometry, Index=0, Wrap=True)  # -> Item, Item1
avr = Average(Input=path_mapper)
pline_3 = PolyLine(Vertices=path_mapper, Closed=False)
number_slider = Slider(3, range=0..10)
merge = Merge(Data1=explode_4.Segments, Data2=explode_5.Segments)
viewer_2 = ParamViewer(flip_2)
midpt = CurveMiddle(Curve=pline_3)
pshift = ShiftPaths(Data=avr, Offset=-1)
item_4 = ListItem(List=merge, Index=0, Wrap=True)  # -> Item, Item1
pshift_2 = ShiftPaths(Data=midpt, Offset=-1)
pline_4 = PolyLine(Vertices=pshift, Closed=False)
tweencrv = TweenCurve(CurveA=item_4.Item, CurveB=item_4.Item1, Factor=Slider(0.5, range=0..1), BlendType=0)
merge_2 = Merge(Data1=number_slider, Data2=Slider(6, range=0..10), Data3=number_slider)
weave = Weave(Pattern=[0, 1], Stream0=flip.Curve, Stream1=pline_4, NullGaps=False)
pline_5 = PolyLine(Vertices=pshift_2, Closed=False)
pshift_3 = ShiftPaths(Data=tweencrv, Offset=-1)
Z_2 = UnitZ(Factor=merge_2)
Z_3 = UnitZ(Factor=Slider(6, range=0..10))
move_2 = Move(Geometry=weave, Motion=Z_2)  # -> Geometry, Transform
join_2 = JoinCurves(Curves=pshift_3, Preserve=False)
loft = Loft(Curves=move_2.Geometry, Options={Adjust=False, Closed=False, LoftEnds=0, LoftSimp=0, LoftType=3, Rebuild=10, Refit=0.01})
move_3 = Move(Geometry=join_2, Motion=Z_3)  # -> simplify(Geometry), Transform
edges = BrepEdges(Brep=loft)  # -> Naked, Interior, NonManifold
merge_3 = Merge(Data1=item_3.Item, Data2=move_3.Geometry, Data3=item_3.Item1)
join_3 = JoinCurves(Curves=edges.Naked, Preserve=False)
loft_opt = LoftOptions(Closed=False, Adjust=False, Rebuild=0, Refit=0, Type=Slider(3, range=0..10))
project = Project(Geometry=join_3, Plane=PlaneXY(0, 0, 0))  # -> Geometry, Transform
loft_2 = Loft(Curves=merge_3, Options=loft_opt)
merge_4 = Merge(Data1=simplify(join_3), Data2=simplify(project.Geometry))
join_4 = BrepJoin(Breps=[boundary, loft_2, extr])  # -> Breps, Closed
panel_2 = Panel(loft_2)
loft_3 = Loft(Curves=merge_4, Options={Adjust=False, Closed=False, LoftEnds=0, LoftSimp=0, LoftType=3, Rebuild=10, Refit=0.01})
cap = CapHoles(Brep=join_4.Breps)
join_5 = BrepJoin(Breps=flatten([loft, loft_3]))  # -> Breps, Closed
cap_2 = CapHoles(Brep=join_5.Breps)
fmerge = MergeFaces(Brep=cap_2)  # -> Breps, Before, After
