# Grasshopper definition 16_Divide surface.gh (Grasshopper 1.0.7)

crv = Curve(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)
crv_2 = Curve(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)
planar = IsPlanar(Surface=crv, Interior=True)  # -> Planar, Plane
boundary = BoundarySurfaces(Edges=crv)
planar_2 = IsPlanar(Surface=crv_2, Interior=True)  # -> Planar, Plane
number_slider = Slider(13, range=0..100)
srf = Surface([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])
crv_3 = Curve(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)
srf_2 = Surface([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])
crv_4 = Curve(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)
bbox = BoundingBox(Content=crv, Plane=planar.Plane)  # -> Box, Box_2
number_slider_2 = Slider(23, range=0..100)
panel = Panel(crv_2)
disc = Discontinuity(Curve=crv, Level=1)  # -> Points, Parameters
bbox_2 = BoundingBox(Content=crv_2, Plane=planar_2.Plane)  # -> Box, Box_2
planar_3 = IsPlanar(Surface=crv_4, Interior=True)  # -> Planar, Plane
planar_4 = IsPlanar(Surface=srf, Interior=True)  # -> Planar, Plane
item = ListItem(List=srf_2, Index=0, Wrap=True)
planar_5 = IsPlanar(Surface=crv_3, Interior=True)  # -> Planar, Plane
boundary_2 = BoundarySurfaces(Edges=crv_4)
srf_3 = Surface(bbox.Box)
number_slider_3 = Slider(23, range=0..100)
bbox_3 = BoundingBox(Content=crv_4, Plane=planar_3.Plane)  # -> Box, Box_2
devec = DeconstructVector(Vector=planar_4.Plane)  # -> XComponent, YComponent, ZComponent
flip = Flip(Surface=srf_2, Guide=item)  # -> Surface, Result
srf_cp = SurfaceClosestPoint(Point=disc.Points, Surface=srf_3)  # -> Point, UVPoint, Distance
bbox_4 = BoundingBox(Content=crv_3, Plane=planar_5.Plane)  # -> Box, Box_2
divide = DivideDomain²(Domain=bbox_2.Box, UCount=number_slider, VCount=number_slider)
disc_2 = Discontinuity(Curve=crv_4, Level=1)  # -> Points, Parameters
area = Area(Geometry=bbox_2.Box)  # -> Area, Centroid
addition = Addition(A=devec.ZComponent, B="1")
srf_4 = Surface(bbox_3.Box)
planar_6 = IsPlanar(Surface=flip.Surface, Interior=True)  # -> Planar, Plane
srf_5 = Surface(bbox_4.Box)
iso = IsoCurve(Surface=srf_3, UVPoint=srf_cp.UVPoint)  # -> UIsocurve, VIsocurve
dispatch = Dispatch(List=srf, DispatchPattern=addition)  # -> ListA, ListB
srf_cp_2 = SurfaceClosestPoint(Point=disc_2.Points, Surface=srf_4)  # -> Point, UVPoint, Distance
pl_origin = PlaneOrigin(Base=planar_2.Plane, Origin=area.Centroid)
divide_2 = DivideDomain²(Domain=srf_5, UCount=number_slider_3, VCount=number_slider_3)
item_2 = ListItem(List=dispatch.ListA, Index=0, Wrap=True)
crv_5 = Curve(flatten([iso.VIsocurve, iso.UIsocurve]))
line = LineSDL(Start=planar_6.Plane, Direction=planar_6.Plane, Length=Slider(10, range=0..10))
subsrf = Isotrim(Surface=bbox_2.Box, Domain=divide)
srfsplit = SurfaceSplit(Surface=boundary, Curves=crv_5)
iso_2 = IsoCurve(Surface=srf_4, UVPoint=srf_cp_2.UVPoint)  # -> UIsocurve, VIsocurve
flip_2 = Flip(Surface=dispatch.ListB, Guide=dispatch.ListA)  # -> Surface, Result
subsrf_2 = Isotrim(Surface=srf_5, Domain=divide_2)
sqgrid = Square(Plane=pl_origin, Size=pl_origin, ExtentX=number_slider_2, ExtentY=number_slider_2)  # -> Cells, Points
merge = Merge(Data1=dispatch.ListA, Data2=flip_2.Surface)
crv_6 = Curve(flatten([iso_2.VIsocurve, iso_2.UIsocurve]))
project = Project(Curve=subsrf_2, Brep=crv_3, Direction=Vector(0, 0, 1))
project_2 = Project(Curve=sqgrid.Cells, Brep=crv_2, Direction=Vector(0, 0, 1))
srfsplit_2 = SurfaceSplit(Surface=boundary_2, Curves=crv_6)
disc_3 = Discontinuity(Curve=srfsplit, Level=1)  # -> Points, Parameters
edges = BrepEdges(Brep=srfsplit)  # -> Naked, Interior, NonManifold
area_2 = Area(Geometry=srfsplit)  # -> Area, Centroid
planar_7 = IsPlanar(Surface=merge, Interior=True)  # -> Planar, Plane
avr = Average(Input=disc_3.Points)
edges_2 = BrepEdges(Brep=srfsplit_2)  # -> Naked, Interior, NonManifold
disc_4 = Discontinuity(Curve=srfsplit_2, Level=1)  # -> Points, Parameters
cir = Circle(Plane=area_2.Centroid, Radius=1)  # -> graft(Circle)
midpt = CurveMiddle(Curve=edges.Naked)
line_2 = LineSDL(Start=planar_7.Plane, Direction=planar_7.Plane, Length=Slider(10, range=0..10))
item_3 = ListItem(List=edges_2.Naked, Index=0, Wrap=True)  # -> Item, Item1, Item2, Item3
item_4 = ListItem(List=disc_4.Points, Index=0, Wrap=True)  # -> Item, Item1, Item2, Item3
xy = XYPlane(Origin=avr)
alongcrv = SortAlongCurve(Points=midpt, Curve=cir)  # -> Points, Indices
number_slider_4 = Slider(0.22, range=0..1)
srf4pt = _4PointSurface(CornerA=item_4.Item, CornerB=item_4.Item1, CornerC=item_4.Item2, CornerD=item_4.Item3)  # -> flatten(Surface)
edgesrf = EdgeSurface(CurveA=item_3.Item, CurveB=item_3.Item1, CurveC=item_3.Item2, CurveD=item_3.Item3)  # -> flatten(Surface)
cir_2 = Circle(Plane=xy, Radius=Slider(5.07, range=0..10))  # -> graft(Circle)
item_5 = ListItem(List=edges.Naked, Index=alongcrv.Indices, Wrap=True)
dim = Dimensions(Surface=srf4pt)  # -> UDimension, VDimension
alongcrv_2 = SortAlongCurve(Points=disc_3.Points, Curve=cir_2)  # -> Points, Indices
item_6 = ListItem(List=item_5, Index=0, Wrap=True)  # -> Item, Item1, Item2, Item3
multiplication = Multiplication(A=dim.VDimension, B=number_slider_4)
multiplication_2 = Multiplication(A=dim.UDimension, B=number_slider_4)
item_7 = ListItem(List=alongcrv_2.Points, Index=0, Wrap=True)  # -> Item, Item1, Item2, Item3
edgesrf_2 = EdgeSurface(CurveA=item_6.Item, CurveB=item_6.Item1, CurveC=item_6.Item2, CurveD=item_6.Item3)  # -> flatten(Surface)
divide_3 = DivideDomain²(Domain=srf4pt, UCount=multiplication_2, VCount=multiplication)
srf4pt_2 = _4PointSurface(CornerA=item_7.Item, CornerB=item_7.Item1, CornerC=item_7.Item2, CornerD=item_7.Item3)  # -> flatten(Surface)
subsrf_3 = Isotrim(Surface=graft(srf4pt), Domain=divide_3)
