# Grasshopper definition 17_line to surface.gh (Grasshopper 1.0.7)
# plug-ins: Anemone

crv = Curve([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])
crv_2 = Curve([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])
# 3 Level - 09
boundary = BoundarySurfaces(Edges=crv)
crv_3 = Curve([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])
midpt = CurveMiddle(Curve=crv_2)
midpt_2 = CurveMiddle(Curve=crv_3)
boundary_2 = BoundarySurfaces(Edges=crv_2)
planar = IsPlanar(Surface=boundary, Interior=True)  # -> Planar, Plane
hull = ConvexHull(Points=midpt, Plane=PlaneXY(0, 0, 0))  # -> Hull, HullZ, Indices
pdecon = Deconstruct(Point=midpt_2)  # -> XComponent, YComponent, ZComponent
explode = Explode(Curve=boundary_2, Recursive=True)  # -> Segments, Vertices
area = Area(Geometry=boundary)  # -> Area, Centroid
sort = SortList(Keys=pdecon.YComponent, ValuesA=crv_3)  # -> Keys, ValuesA
deplane = DeconstructPlane(Plane=planar.Plane)  # -> Origin, XAxis, YAxis, ZAxis
disc = Discontinuity(Curve=hull.Hull, Level=1)  # -> Points, Parameters
hull_2 = ConvexHull(Points=explode.Vertices, Plane=PlaneXY(0, 0, 0))  # -> Hull, HullZ, Indices
item = ListItem(List=sort.ValuesA, Index=0, Wrap=True)
fline = FitLine(Points=explode.Vertices)
len = Length(Curve=boundary)  # -> expr("x / 4", Length)
ma = MassAddition(Input=[deplane.XAxis, deplane.YAxis])  # -> Result, PartialResults
pline = PolyLine(Vertices=disc.Points, Closed=False)
series = Series(Start=Slider(0, range=0..100), Step=Slider(90, range=0..100), Count=Slider(4, range=0..4))
simplify = SimplifyCurve(Curve=hull_2.Hull)  # -> Curve, Simplified
explode_2 = Explode(Curve=simplify.Curve, Recursive=True)  # -> Segments, Vertices
dprod = DotProduct(VectorA=sort.ValuesA, VectorB=item, Unitize=False)
colom = CollisionOneMany(Collider=explode_2.Segments, Obstacles=fline)  # -> Collision, Index
explode_3 = Explode(Curve=pline, Recursive=True)  # -> Segments, Vertices
explode_4 = Explode(Curve=simplify.Curve, Recursive=True)  # -> Segments, Vertices
cp = ControlPoints(Curve=simplify.Curve)  # -> Points, Weights, Knots
amp = Amplitude(Vector=ma.Result, Amplitude=len)
Z = UnitZ(Factor=1)
larger = LargerThan(FirstNumber=dprod, SecondNumber="0.5")  # -> LargerThan, OrEqualTo
midpt_3 = CurveMiddle(Curve=explode_3.Segments)
cull = CullPattern(List=explode_2.Segments, CullPattern=colom.Collision)
midpt_4 = CurveMiddle(Curve=explode_4.Segments)
dispatch = Dispatch(List=sort.ValuesA, DispatchPattern=larger.LargerThan)  # -> ListA, ListB
crv_cp = CurveClosestPoint(Point=cp.Points, Curve=simplify.Curve)  # -> Point, Parameter, Distance
vrot = Rotate(Vector=amp, Axis=Z, Angle=degrees(series))
midpt_5 = CurveMiddle(Curve=cull)
pdecon_2 = Deconstruct(Point=midpt_3)  # -> XComponent, YComponent, ZComponent
pdecon_3 = Deconstruct(Point=midpt_4)  # -> XComponent, YComponent, ZComponent
entwine = Entwine(Branch00=dispatch.ListA, Branch01=dispatch.ListB, FlattenInputs=True)
cull_i = CullIndex(List=crv_cp.Parameter, Indices="0", Wrap=True)
sort_2 = SortList(Keys=pdecon_2.YComponent, ValuesA=explode_3.Segments)  # -> Keys, reverse(ValuesA)
pdecon_4 = Deconstruct(Point=midpt_5)  # -> XComponent, YComponent, ZComponent
sort_3 = SortList(Keys=pdecon_3.YComponent, ValuesA=explode_4.Segments)  # -> Keys, reverse(ValuesA)
move = Move(Geometry=area.Centroid, Motion=vrot)  # -> Geometry, Transform
item_2 = ListItem(List=cull_i, Index=0, Wrap=True)
join = JoinCurves(Curves=entwine, Preserve=False)
sort_4 = SortList(Keys=pdecon_4.YComponent, ValuesA=cull)  # -> Keys, reverse(ValuesA)
item_3 = ListItem(List=sort_2.ValuesA, Index=0, Wrap=True)
item_4 = ListItem(List=sort_3.ValuesA, Index="1", Wrap=True)
item_5 = ListItem(List=move.Geometry, Index=Slider(4, range=0..4), Wrap=True)
midpt_6 = CurveMiddle(Curve=join)
seam = Seam(Curve=simplify.Curve, Seam=item_2)
item_6 = ListItem(List=sort_4.ValuesA, Index=0, Wrap=True)
pull = PullCurve()
pdecon_5 = Deconstruct(Point=midpt_6)  # -> XComponent, YComponent, ZComponent
end = EndPoints(Curve=seam)  # -> Start, End
simplify_2 = SimplifyCurve(Curve=seam)  # -> Curve, Simplified
midpt_7 = CurveMiddle(Curve=crv)  # -> graft(Midpoint)
sort_5 = SortList(Keys=pdecon_5.YComponent, ValuesA=join)  # -> Keys, ValuesA
explode_5 = Explode(Curve=simplify_2.Curve, Recursive=True)  # -> Segments, Vertices
ln = Line(StartPoint=midpt_7, EndPoint=item_5)
loop_start = LoopStart(Repeat=Slider(10, range=0..10), Trigger=Toggle(False), Data=midpt_7)  # -> port, Counter, Data
shift = ShiftList(List=sort_5.ValuesA, Shift=1, Wrap=invert(True))
lng = ListLength(List=explode_5.Segments)
len_2 = Length(Curve=explode_5.Segments)
colmm = CollisionManyMany()  # -> Collision, Indices
panel = Panel("""0
1""")
colom_2 = CollisionOneMany(Collider=ln, Obstacles=crv)  # -> Collision, Index
short = ShortestList(ListA=sort_5.ValuesA, ListB=shift, TrimMode=2)  # -> ListA, ListB
sort_6 = SortList(Keys=len_2, ValuesA=explode_5.Segments)  # -> Keys, ValuesA
repeat = RepeatData(Data=graft(panel), Length=expr("x / 2", lng))  # -> flatten(Data)
loop_end = LoopEnd(port=loop_start.port, Exit=False, TimeOutVal=0, pausedState=False, state="Constant output")
tweencrv = TweenCurve(CurveA=graft(short.ListA), CurveB=graft(short.ListB), Factor=0.5, BlendType=0)  # -> flatten(Tween)
panel_2 = Panel(colom_2.Collision)
cull_2 = CullPattern(List=sort_6.ValuesA, CullPattern=repeat)
ext = ExtendCurve(Curve=tweencrv, Type=0, Start="-1", End="-1")
item_7 = ListItem(List=cull_2, Index=Slider(0, range=0..4), Wrap=True)  # -> flatten(Item)
mcx = MultipleCurves(Curves=ext)  # -> Points, IndexA, IndexB, ParamA, ParamB
midpt_8 = CurveMiddle(Curve=crv_2)
divide = DivideCurve(Curve=crv_2, Count="1", Kinks=False)  # -> flatten(Points), Tangents, Parameters
cps = ClosestPoints(Point=mcx.Points, Cloud=midpt_2, Count="4")  # -> ClosestPoint, CPIndex, Distance
cir = Circle(Plane=mcx.Points, Radius=1)
crv_cp_2 = CurveClosestPoint(Point=midpt_8, Curve=item_7)  # -> Point, Parameter, Distance
panel_3 = Panel("Collide")
alongcrv = SortAlongCurve(Points=cps.ClosestPoint, Curve=graft(cir))  # -> Points, Indices
sort_7 = SortList(Keys=crv_cp_2.Distance, ValuesA=crv_2)  # -> Keys, ValuesA
crv_cp_3 = CurveClosestPoint(Point=divide.Points, Curve=item_7)  # -> Point, Parameter, Distance
item_8 = ListItem(List=cps.CPIndex, Index=alongcrv.Indices, Wrap=True)
bool = Boolean(crv_cp_3.Distance)
item_9 = ListItem(List=crv_3, Index=item_8, Wrap=True)
cull_3 = CullPattern(List=crv_cp_3.Point, CullPattern=invert(bool))
lng_2 = ListLength(List=cull_3)
item_10 = ListItem(List=item_9, Index=0, Wrap=True)  # -> Item, Item1, Item2, Item3
partition = PartitionList(List=sort_7.ValuesA, Size=lng_2)
edgesrf = EdgeSurface(CurveA=item_10.Item, CurveB=item_10.Item1, CurveC=item_10.Item2, CurveD=item_10.Item3)  # -> flatten(Surface)
tstat = TreeStatistics(Tree=partition)  # -> Paths, Length, Count
dispatch_2 = Dispatch(List=tstat.Paths, DispatchPattern=[True, False])  # -> ListA, ListB
branch = TreeBranch(Tree=partition, Path=dispatch_2.ListA, MaintainPaths=True)
branch_2 = TreeBranch(Tree=partition, Path=dispatch_2.ListB, MaintainPaths=True)
join_2 = JoinCurves(Curves=branch, Preserve=False)
join_3 = JoinCurves(Curves=branch_2, Preserve=False)
