# Grasshopper definition 20_Classify the given square cells into 2 branches.gh (Grasshopper 1.0.7)
# plug-ins: LunchBox

# 3 Level - 12
number_slider = Slider(20, range=0..20)
number_slider_2 = Slider(16, range=0..20)
number_slider_3 = Slider(16, range=0..20)
number_slider_4 = Slider(16, range=0..20)
srf = Surface(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)
srf_2 = Surface(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)
srf_3 = Surface(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)
srf_4 = Surface(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)
panel = Panel("""A
B
C
D
E
F
G
H
I
J
H
K
L""")
quads = QuadPanels(Surface=srf, UDivisions=number_slider, VDivisions=number_slider)
quads_2 = QuadPanels(Surface=srf_2, UDivisions=number_slider_2, VDivisions=number_slider_2)
quads_3 = QuadPanels(Surface=srf_3, UDivisions=number_slider_3, VDivisions=number_slider_3)
quads_4 = QuadPanels(Surface=srf_4, UDivisions=number_slider_4, VDivisions=number_slider_4)
series = Series(Start=0, Step=1, Count=number_slider_3)  # -> graft(Series)
python = GhPythonScript(Panels=quads, U=number_slider, V=number_slider)  # -> out, DT; inputs Panels: list of Surface, U: Int32, V: Int32
# ---------- python: Python ----------
__author__ = "BaekInchan"
__version__ = "2024.02.11"

import rhinoscriptsyntax as rs
import ghpythonlib.treehelpers as th

T = [[], []]

for i in range(U) : 
    for j in range(V) : 
        if(i <= j) :
            T[0].append(Panels[i * V + j])
        else : 
            T[1].append(Panels[i * V + j])

DT = th.list_to_tree(T, none_and_holes = True)
# ---------- end python ----------
split = SplitList(List=panel, Index=Slider(3, range=0..10))  # -> ListA, ListB
series_2 = Series(Start=0, Step=1, Count=number_slider_4)  # -> graft(Series)
series_3 = Series(Start=0, Step=1, Count=number_slider_2)
partition = PartitionList(List=quads_3, Size=number_slider_3)
partition_2 = PartitionList(List=quads_4, Size=number_slider_4)
lng = ListLength(List=partition)
partition_3 = PartitionList(List=quads_2, Size=number_slider_2)
panel_2 = Panel(split.ListA)
panel_3 = Panel(split.ListB)
smaller = SmallerThan(FirstNumber=series_3, SecondNumber=graft(series_3))  # -> SmallerThan, OrEqualTo
shift = ShiftList(List=partition, Shift=series, Wrap=invert(True))
series_4 = Series(Start=0, Step=1, Count=number_slider_3)  # -> graft(Series)
split_2 = SplitList(List=partition_2, Index=series_2)  # -> ListA, ListB
tstat = TreeStatistics(Tree=python.DT)  # -> Paths, Length, Count
series_5 = Series(Start=0, Step=1, Count=lng)
dispatch = Dispatch(List=tstat.Paths, DispatchPattern=[True, False])  # -> ListA, ListB
dispatch_2 = Dispatch(List=partition_3, DispatchPattern=smaller.SmallerThan)  # -> ListA, ListB
index = ItemIndex(List=partition, Item=shift)
shift_2 = ShiftList(List=series_5, Shift=series_4, Wrap=invert(True))
branch = TreeBranch(Tree=python.DT, Path=dispatch.ListA, MaintainPaths=True)
branch_2 = TreeBranch(Tree=python.DT, Path=dispatch.ListB, MaintainPaths=True)
cull_i = CullIndex(List=partition, Indices=index, Wrap=True)
preview = CustomPreview(Geometry=split_2.ListA, Material=ColourSwatch(SwatchColor=RGB(60, 189, 163)))
preview_2 = CustomPreview(Geometry=split_2.ListB, Material=ColourSwatch(SwatchColor=RGB(177, 57, 163)))
difference = SetDifference(SetA=series_5, SetB=shift_2)
preview_3 = CustomPreview(Geometry=branch, Material=ColourSwatch(SwatchColor=RGB(60, 189, 163)))
preview_4 = CustomPreview(Geometry=branch_2, Material=ColourSwatch(SwatchColor=RGB(177, 57, 163)))
item = ListItem(List=partition, Index=difference, Wrap=True)
preview_5 = CustomPreview(Geometry=dispatch_2.ListA, Material=ColourSwatch(SwatchColor=RGB(60, 189, 163)))
preview_6 = CustomPreview(Geometry=dispatch_2.ListB, Material=ColourSwatch(SwatchColor=RGB(177, 57, 163)))
