# Grasshopper definition 23_Surface from points.gh (Grasshopper 1.0.7)
# plug-ins: Human

number_slider = Slider(20, range=0..100)
number_slider_2 = Slider(4, range=0..10)
pt = Point(Point(-8, -47, 0))
pt_2 = Point([Point(-3, -25, 0), Point(0, -25, 0), Point(3, -25, 0), Point(6, -25, 0), Point(-3, -23, 0), Point(0, -23, 0), Point(3, -23, 0), Point(6, -23, 0), Point(-3, -21, 0), Point(0, -21, 0), Point(3, -21, 0), Point(6, -21, 0)])
planesrf = PlaneSurface(Plane=pt, XSize=number_slider, YSize=number_slider)
points = PointList(Points=pt_2, Size=Slider(1.04, range=0..2))
srfgrid = SurfaceFromPoints(Points=pt_2, UCount=Slider(3, range=0..10), Interpolate=False)
sdivide = DivideSurface(Surface=planesrf, UCount=number_slider_2, VCount=number_slider_2)  # -> flatten(Points), Normals, Parameters
avr = Average(Input=flatten(sdivide.Points))
Z = UnitZ(Factor=Slider(20, range=0..20))
move = Move(Geometry=avr, Motion=Z)  # -> Geometry, Transform
replace = ReplaceMembers(Set=sdivide.Points, Find=avr, Replace=move.Geometry)
srfgrid_2 = SurfaceFromPoints(Points=replace, UCount=expr("x+1", number_slider_2), Interpolate=False)
previewmat = CustomPreviewMaterials(Geometry=srfgrid_2, DiffuseColor=RGB(255, 255, 255))
