# Grasshopper definition 24_Wave curve box.gh (Grasshopper 1.0.7)

rectangle = Rectangle(Plane=PlaneXY(0, 0, 0), XSize=Slider(20, range=0..100), YSize=Slider(15, range=0..100), Radius=0)  # -> Rectangle, Length
fillet = Fillet(Curve=rectangle.Rectangle, Radius=Slider(2, range=0..10))
Z = UnitZ(Factor=Slider(13, range=0..100))
dom = ConstructDomain(DomainStart=Slider(0.1, range=0..1), DomainEnd=Slider(0.7, range=0..1))
extr = Extrude(Base=fillet, Direction=Z)
dom² = ConstructDomain²(DomainU=dom, DomainV=Domain(0, 1))
range = Range(Domain=Domain(0, 1), Steps=Slider(5, range=0..10))
subsrf = Isotrim(Surface=reparameterize(extr), Domain=dom²)
pt = ConstructPoint(XCoordinate=range, YCoordinate=0, ZCoordinate=0)
iso = IsoCurve(Surface=reparameterize(subsrf), UVPoint=pt)  # -> UIsocurve, flatten(VIsocurve)
divide = DivideCurve(Curve=iso.VIsocurve, Count=10, Kinks=False)  # -> Points, Tangents, Parameters
srf_cp = SurfaceClosestPoint(Point=divide.Points, Surface=extr)  # -> Point, UVPoint, Distance
panel = Panel(srf_cp.Distance)
