# Grasshopper definition 25_Extract Surface Edges to Create Mid-Surface.gh (Grasshopper 1.0.7)

srf = Surface([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])
# 3 Level - 15
srf_2 = Surface(graft([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]))
area = Area(Geometry=srf)  # -> Area, Centroid
srf_3 = Surface([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])
crv = Curve(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)
crv_2 = Curve(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)
tstat = TreeStatistics(Tree=srf_2)  # -> Paths, Length, Count
number_slider = Slider(0.68, range=0..1)
number_slider_2 = Slider(0.4, range=0..1)
srf_4 = Surface([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])
srf_5 = Surface([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])
flip = FlipCurve(Curve=crv)  # -> Curve, Flag
area_2 = Area(Geometry=srf_3)  # -> Area, Centroid
fline = FitLine(Points=area.Centroid)
area_3 = Area(Geometry=srf_4)  # -> Area, Centroid
series = Series(Start=0, Step=1, Count=tstat.Count)  # -> graft(Series)
area_4 = Area(Geometry=srf_5)  # -> Area, Centroid
alongcrv = SortAlongCurve(Points=area.Centroid, Curve=fline)  # -> Points, Indices
fline_2 = FitLine(Points=area_2.Centroid)
fline_3 = FitLine(Points=area_3.Centroid)
fline_4 = FitLine(Points=area_4.Centroid)
cull_i = CullIndex(List=tstat.Paths, Indices=series, Wrap=True)
item = ListItem(List=tstat.Paths, Index=series, Wrap=True)
blendc = BlendCurve(CurveA=crv_2, CurveB=crv, BulgeA=number_slider, BulgeB=number_slider, Continuity=Slider(2, range=0..2))
alongcrv_2 = SortAlongCurve(Points=area_2.Centroid, Curve=fline_2)  # -> Points, Indices
item_2 = ListItem(List=srf, Index=alongcrv.Indices, Wrap=True)
alongcrv_3 = SortAlongCurve(Points=area_4.Centroid, Curve=fline_4)  # -> Points, Indices
branch = TreeBranch(Tree=srf_2, Path=cull_i, MaintainPaths=True)
branch_2 = TreeBranch(Tree=srf_2, Path=item, MaintainPaths=True)
pull = PullCurve(Curve=fline_3, Surface=srf_4)
explode = Explode(Curve=srf_4, Recursive=True)  # -> Segments, Vertices
explode_2 = Explode(Curve=item_2, Recursive=True)  # -> Segments, Vertices
item_3 = ListItem(List=srf_3, Index=alongcrv_2.Indices, Wrap=True)
pline = PolyLine(Vertices=alongcrv_3.Points, Closed=False)
item_4 = ListItem(List=srf_5, Index=alongcrv_3.Indices, Wrap=True)
Z = UnitZ(Factor=Slider(3, range=0..10))
debrep = DeconstructBrep(Brep=branch)  # -> Faces, Edges, Vertices
debrep_2 = DeconstructBrep(Brep=branch_2)  # -> Faces, Edges, Vertices
project = Project(Geometry=explode_2.Segments, Plane=PlaneXY(0, 0, 0))  # -> Geometry, Transform
area_5 = Area(Geometry=branch_2)  # -> Area, Centroid
connect = ConnectCurves(Curves=pull, Continuity="0", Close=invert(True), Bulge=1)
pshift = ShiftPaths(Data=debrep.Edges, Offset=-1)
move = Move(Geometry=pline, Motion=Z)  # -> Geometry, Transform
expression = Expression(x=Z, Expression="-x*2")
midpt = CurveMiddle(Curve=debrep_2.Edges)
project_2 = Project(Geometry=item_3, Plane=PlaneXY(0, 0, 0))  # -> Geometry, Transform
midpt_2 = CurveMiddle(Curve=project.Geometry)
explode_3 = Explode(Curve=item_4, Recursive=True)  # -> Segments, Vertices
midpt_3 = CurveMiddle(Curve=pshift)
extr = Extrude(Base=move.Geometry, Direction=expression)
avr = Average(Input=midpt_2)  # -> flatten(ArithmeticMean)
colom = CollisionOneMany(Collider=explode.Segments, Obstacles=connect)  # -> Collision, Index
explode_4 = Explode(Curve=item_3, Recursive=True)  # -> Segments, Vertices
area_6 = Area(Geometry=project_2.Geometry)  # -> Area, Centroid
explode_5 = Explode(Curve=project_2.Geometry, Recursive=True)  # -> Segments, Vertices
cps = ClosestPoints(Point=midpt, Cloud=midpt_3, Count="2")  # -> ClosestPoint, CPIndex, Distance
colom_2 = CollisionOneMany(Collider=explode_3.Segments, Obstacles=extr)  # -> Collision, Index
pline_2 = PolyLine(Vertices=avr, Closed=False)
cull = CullPattern(List=explode.Segments, CullPattern=colom.Collision)  # -> flatten(List)
panel = Panel(midpt_3)
pline_3 = PolyLine(Vertices=area_6.Centroid, Closed=False)
cull_2 = CullPattern(List=explode_3.Segments, CullPattern=colom_2.Collision)
item_5 = ListItem(List=cps.ClosestPoint, Index=cps.CPIndex, Wrap=True)
colom_3 = CollisionOneMany(Collider=project.Geometry, Obstacles=pline_2)  # -> Collision, Index
midpt_4 = CurveMiddle(Curve=cull)
item_6 = ListItem(List=item_5, Index=0, Wrap=True)
colom_4 = CollisionOneMany(Collider=explode_5.Segments, Obstacles=pline_3)  # -> Collision, Index
cull_3 = CullPattern(List=explode_2.Segments, CullPattern=colom_3.Collision)  # -> flatten(List)
alongcrv_4 = SortAlongCurve(Points=midpt_4, Curve=fline_3)  # -> Points, Indices
cull_4 = CullPattern(List=explode_4.Segments, CullPattern=colom_4.Collision)  # -> flatten(List)
item_7 = ListItem(List=cull, Index=alongcrv_4.Indices, Wrap=True)
midpt_5 = CurveMiddle(Curve=cull_3)
partition = PartitionList(List=item_7, Size="2")
midpt_6 = CurveMiddle(Curve=cull_4)
fline_5 = FitLine(Points=midpt_5)
loft = Loft(Curves=partition, Options={Adjust=True, Closed=False, LoftEnds=0, LoftSimp=0, LoftType=0, Rebuild=10, Refit=0.01})  # -> flatten(Loft)
alongcrv_5 = SortAlongCurve(Points=midpt_5, Curve=fline_5)  # -> Points, Indices
fline_6 = FitLine(Points=midpt_6)
alongcrv_6 = SortAlongCurve(Points=midpt_6, Curve=fline_6)  # -> Points, Indices
item_8 = ListItem(List=cull_3, Index=alongcrv_5.Indices, Wrap=True)
partition_2 = PartitionList(List=item_8, Size="2")
item_9 = ListItem(List=cull_4, Index=alongcrv_6.Indices, Wrap=True)
srf_6 = Surface(srf)
partition_3 = PartitionList(List=item_9, Size="2")
loft_2 = Loft(Curves=partition_2, Options={Adjust=True, Closed=False, LoftEnds=0, LoftSimp=0, LoftType=0, Rebuild=10, Refit=0.01})  # -> flatten(Loft)
srf_7 = Surface(srf_3)
loft_3 = Loft(Curves=partition_3, Options={Adjust=True, Closed=False, LoftEnds=0, LoftSimp=0, LoftType=0, Rebuild=10, Refit=0.01})  # -> flatten(Loft)
join = BrepJoin(Breps=[srf_6, loft_2])  # -> Breps, Closed
join_2 = BrepJoin(Breps=[srf_7, loft_3])  # -> Breps, Closed
panel_2 = Panel(join.Breps)
panel_3 = Panel(join_2.Breps)
