# Grasshopper definition 26_Apply Fillet to Specific Edges in Brep.gh (Grasshopper 1.0.7)
# plug-ins: Human

brep = Brep(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)
brep_2 = Brep(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)
brep_3 = Brep(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)
brep_4 = Brep(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)
# 3 Level - 23
brep_5 = Brep(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)
edges = BrepEdges(Brep=brep)  # -> Naked, Interior, NonManifold
edges_2 = BrepEdges(Brep=brep_2)  # -> Naked, Interior, NonManifold
edges_3 = BrepEdges(Brep=brep_3)  # -> Naked, Interior, NonManifold
edges_4 = BrepEdges(Brep=brep_4)  # -> Naked, Interior, NonManifold
debrep = DeconstructBrep(Brep=brep_5)  # -> Faces, Edges, Vertices
bbox = BoundingBox(Content=brep_4, Plane=PlaneXY(0, 0, 0), UnionBox=True)  # -> Box, Box_2
cls = Closed(Curve=edges_2.Interior)  # -> Closed, Periodic
cls_2 = Closed(Curve=edges_3.Interior)  # -> Closed, Periodic
panel = Panel(edges.Naked)
crv = Curve(edges.Interior)
tmatch = MatchText(Text=edges_4.Interior, Pattern="Cir*", Case=True)
crv_2 = Curve(debrep.Edges)
cull = CullPattern(List=edges_2.Interior, CullPattern=cls.Closed)
cull_2 = CullPattern(List=edges_3.Interior, CullPattern=cls_2.Closed)
tmatch_2 = MatchText(Text=crv_2, Pattern="Circular*", Case=True)
cull_3 = CullPattern(List=edges_4.Interior, CullPattern=tmatch)
end = EndPoints(Curve=cull)  # -> Start, End
end_2 = EndPoints(Curve=cull_2)  # -> Start, End
midpt = CurveMiddle(Curve=cull_3)
lng = ListLength(List=cull_2)
cull_4 = CullPattern(List=crv_2, CullPattern=tmatch_2)
pdecon = Deconstruct(Point=end.Start)  # -> XComponent, YComponent, ZComponent
pdecon_2 = Deconstruct(Point=end_2.Start)  # -> XComponent, YComponent, ZComponent
division = Division(A=lng, B="2")
brep_cp = BrepClosestPoint(Point=midpt, Brep=bbox.Box)  # -> Point, Normal, Distance
area = Area(Geometry=cull_4)  # -> Area, Centroid
cset = CreateSet(List=pdecon.ZComponent)  # -> Set, Map
sort = SortList(Keys=pdecon_2.ZComponent, ValuesA=cull_2)  # -> Keys, ValuesA
cull_5 = CullPattern(List=cull_3, CullPattern=invert(brep_cp.Distance))
pdecon_3 = Deconstruct(Point=area.Centroid)  # -> XComponent, YComponent, ZComponent
lng_2 = ListLength(List=cull_4)
mindex = MemberIndex(Set=pdecon.ZComponent, Member=cset.Set)  # -> Index, Count
partition = PartitionList(List=sort.ValuesA, Size=division)  # -> simplify(Chunks)
index = ItemIndex(List=edges_4.Interior, Item=cull_5)
division_2 = Division(A=lng_2, B="2")
sort_2 = SortList(Keys=reverse(pdecon_3.ZComponent), ValuesA=cull_4)  # -> Keys, ValuesA
item = ListItem(Index=0, Wrap=True)
item_2 = ListItem(List=cull, Index=mindex.Index, Wrap=True)  # -> simplify(Item)
bang = ExplodeTree(Data=partition)  # -> Branch0, Branch1
filedge = FilletEdge(Shape=brep_4, Blend=0, Metric=0, Edges=index, Radii=Slider(0.66, range=0..1))
bang_2 = ExplodeTree(Data=item_2)  # -> Branch0, Branch1
split = SplitList(List=sort_2.ValuesA, Index=division_2)  # -> ListA, ListB
crv_3 = Curve(bang.Branch1)
previewmat = CustomPreviewMaterials(Geometry=filedge, DiffuseColor=RGB(255, 255, 255))
crv_4 = Curve(bang_2.Branch1)
crv_5 = Curve(split.ListA)
panel_2 = Panel(split.ListA)
