# Grasshopper definition 27_Select Rectangular Cells within a Given Area.gh (Grasshopper 1.0.7)

crv = Curve(graft([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]))
crv_2 = Curve([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])

# ---- group: Region Curve
crv_3 = Curve(graft([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]))

# ---- group: Rectangle Cell
crv_4 = Curve([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])

# ----
crv_5 = Curve([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])
crv_6 = Curve([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])
crv_7 = Curve(graft([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]))
crv_8 = Curve([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])
crv_9 = Curve([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])
crv_10 = Curve([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])
area = Area(Geometry=crv_4)  # -> Area, Centroid
rint = RegionIntersection(CurvesA=crv_2, CurvesB=crv)
disc = Discontinuity(Curve=crv_5, Level=1)  # -> Points, Parameters
boundary = BoundarySurfaces(Edges=crv_6)
area_2 = Area(Geometry=crv_9)  # -> Area, Centroid
cls = Closed(Curve=crv_7)  # -> Closed, Periodic
area_3 = Area(Geometry=crv_8)  # -> Area, Centroid
brep = Brep(crv_7)
# 3 Level - 24
minc = MeshInclusion(Strict=False)
incurve = PointInCurve(Point=area.Centroid, Curve=crv_3)  # -> flatten(Relationship), Point
incurves = PointInCurves(Point=area_2.Centroid, Curves=crv_10)  # -> Relationship, Index, Point
pull = PullPoint(Point=disc.Points, Geometry=boundary, ClosestOnly=True)  # -> ClosestPoint, Distance
tmatch = MatchText(Text=rint, Pattern="Polyline*", Case=True)
brepinc = PointInBrep(Brep=brep, Point=area_3.Centroid, Strict=invert(False))
cull = CullPattern(List=crv_9, CullPattern=incurves.Relationship)
ma = MassAddition(Input=pull.Distance)  # -> flatten(Result), PartialResults
cull_2 = CullPattern(List=rint, CullPattern=tmatch)  # -> flatten(List)
cset = CreateSet(List=incurve.Relationship)  # -> Set, Map
colom = CollisionOneMany(Collider=cull, Obstacles=flatten(crv_10))  # -> Collision, Index
cull_3 = CullPattern(List=crv_5, CullPattern=invert(ma.Result))
brep_2 = Brep(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)
pt = Point([Point(25.02172705, -20.76726035, 5.54905604), Point(23.65044206, -20.94609836, 1.454937841)])
mindex = MemberIndex(Set=incurve.Relationship, Member=cset.Set)  # -> Index, Count
boundary_2 = BoundarySurfaces(Edges=cull_2)
cull_4 = CullPattern(List=cull, CullPattern=invert(colom.Collision))
boundary_3 = BoundarySurfaces(Edges=cull_3)
brepinc_2 = PointInBrep(Brep=brep_2, Point=pt, Strict=False)
item = ListItem(List=crv_4, Index=mindex.Index, Wrap=True)  # -> simplify(Item)
panel = Panel(brepinc_2)
boundary_4 = BoundarySurfaces(Edges=cull_4)
bang = ExplodeTree(Data=item)  # -> Branch0, Branch1
crv_11 = Curve(graft([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]))
crv_12 = Curve([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])
crv_13 = Curve(bang.Branch1)
colom_2 = CollisionOneMany(Collider=crv_13, Obstacles=flatten(crv_3))  # -> Collision, Index
bbx = BrepBrep(BrepA=crv_12, BrepB=crv_11)  # -> flatten(Curves), Points
expression = Expression(Expression="if((x>0) and (x<10))")
cull_5 = CullPattern(List=crv_13, CullPattern=invert(colom_2.Collision))
tmatch_2 = MatchText(Text=bbx.Curves, Pattern="Polyline*", Case=True)
and = GateAnd()
or = GateOr()
cull_6 = CullPattern(List=bbx.Curves, CullPattern=tmatch_2)
crv_14 = Curve(graft([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]))
crv_15 = Curve([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])
bbx_2 = BrepBrep(BrepA=crv_15, BrepB=crv_14)  # -> flatten(Curves), Points
colom_3 = CollisionOneMany(Collider=bbx_2.Curves, Obstacles=flatten(crv_14))  # -> Collision, Index
cull_7 = CullPattern(List=bbx_2.Curves, CullPattern=invert(colom_3.Collision))
