# Grasshopper definition 28_Create Surfaces between Adjacent Polygons.gh (Grasshopper 1.0.7)
# plug-ins: Human

number_slider = Slider(3, range=0..10)
crv = Curve([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])
crv_2 = Curve([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])
crv_3 = Curve([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])
number_slider_2 = Slider(3, range=0..10)
crv_4 = Curve([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])
project = Project(Geometry=crv, Plane=PlaneXY(0, 0, 0))  # -> Geometry, Transform
# 3 Level - 25
crv_5 = Curve([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])
crv_6 = Curve([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])
number_slider_3 = Slider(2.75, range=0..10)
project_2 = Project(Geometry=crv_2, Plane=PlaneXY(0, 0, 0))  # -> Geometry, Transform
project_3 = Project(Geometry=crv_3, Plane=PlaneXY(0, 0, 0))  # -> Geometry, Transform
explode = Explode(Curve=project.Geometry, Recursive=True)  # -> flatten(Segments), Vertices
offset = OffsetCurve(Curve=crv_4, Distance=number_slider, Corners=1)  # -> flatten(Curve)
project_4 = Project(Geometry=crv_5, Plane=PlaneXY(0, 0, 0))  # -> Geometry, Transform
xy = XYPlane(Origin=Point(0, 0, 0))
project_5 = Project(Geometry=crv_6, Plane=PlaneXY(0, 0, 0))  # -> Geometry, Transform
bbox = BoundingBox(Content=project.Geometry, Plane=PlaneXY(0, 0, 0), UnionBox=True)  # -> Box, Box_2
shift = ShiftList(List=project_2.Geometry, Shift=1, Wrap=invert(True))
shift_2 = ShiftList(List=project_3.Geometry, Shift=1, Wrap=invert(True))
runion = RegionUnion(Curves=offset, Plane=xy)
offset_2 = OffsetCurve(Curve=project_5.Geometry, Distance=number_slider_2, Corners=1)  # -> flatten(Curve)
rec = Rectangle(bbox.Box)
xy_2 = XYPlane(Origin=Point(0, 0, 0))
disc = Discontinuity(Curve=project_4.Geometry, Level=1)  # -> flatten(Points), Parameters
srf = Surface(project_4.Geometry)
ext = ExtendCurve(Curve=explode.Segments, Type=0, Start=number_slider_3, End=number_slider_3)
srf_2 = Surface(project_4.Geometry)
short = ShortestList(ListA=project_2.Geometry, ListB=shift, TrimMode=2)  # -> ListA, ListB
short_2 = ShortestList(ListA=project_3.Geometry, ListB=shift_2, TrimMode=2)  # -> ListA, ListB
area = Area(Geometry=rec)  # -> Area, Centroid
offset_3 = OffsetCurve(Curve=runion, Distance=expr("-x", number_slider), Corners=1)  # -> flatten(Curve)
runion_2 = RegionUnion(Curves=offset_2, Plane=xy_2)
srf_cp = SurfaceClosestPoint(Point=disc.Points, Surface=srf)  # -> Point, UVPoint, Distance
merge = Merge(Data1=graft(short.ListA), Data2=graft(short.ListB))
scale = Scale(Geometry=rec, Center=area.Centroid, Factor="1.2")  # -> Geometry, Transform
disc_2 = Discontinuity(Curve=short_2.ListB, Level=1)  # -> Points, Parameters
disc_3 = Discontinuity(Curve=short_2.ListA, Level=1)  # -> Points, Parameters
offset_4 = OffsetCurve(Curve=runion_2, Distance=expr("-x", number_slider_2), Corners=1)  # -> flatten(Curve)
srfsplit = SurfaceSplit(Surface=offset_3, Curves=crv_4)
xy_3 = XYPlane(Origin=Point(0, 0, 0))
srfsplit_2 = SurfaceSplit(Surface=scale.Geometry, Curves=ext)
iso = IsoCurve(Surface=srf, UVPoint=srf_cp.UVPoint)  # -> UIsocurve, VIsocurve
disc_4 = Discontinuity(Curve=reverse(merge), Level=1)  # -> Points, Parameters
crv_cp = CurveClosestPoint(Point=disc_3.Points, Curve=graft(short_2.ListB))  # -> Point, Parameter, Distance
crv_cp_2 = CurveClosestPoint(Point=disc_2.Points, Curve=graft(short_2.ListA))  # -> Point, Parameter, Distance
area_2 = Area(Geometry=srfsplit)  # -> Area, Centroid
rdiff = RegionDifference(CurvesA=offset_4, CurvesB=project_5.Geometry)
edges = BrepEdges(Brep=srfsplit_2)  # -> Naked, Interior, NonManifold
area_3 = Area(Geometry=srfsplit_2)  # -> Area, Centroid
crv_7 = Curve(flatten([iso.UIsocurve, iso.VIsocurve]))
crv_cp_3 = CurveClosestPoint(Point=disc_4.Points, Curve=graft(merge))  # -> simplify(Point), Parameter, Distance
fline = FitLine(Points=area_2.Centroid)
merge_2 = Merge(Data1=crv_cp.Point, Data2=crv_cp_2.Point)
boundary = BoundarySurfaces(Edges=rdiff)
sort = SortList(Keys=area_3.Area, ValuesA=srfsplit_2)  # -> Keys, reverse(ValuesA)
lng = ListLength(List=edges.Naked)  # -> flatten(Length)
alongcrv = SortAlongCurve(Points=area_2.Centroid, Curve=fline)  # -> Points, Indices
pshift = ShiftPaths(Data=crv_cp_3.Point, Offset=-1)
bbox_2 = BoundingBox(Content=merge_2, Plane=PlaneXY(0, 0, 0), UnionBox=True)  # -> Box, Box_2
srfsplit_3 = SurfaceSplit(Surface=srf_2, Curves=crv_7)
sort_2 = SortList(Keys=lng, ValuesA=srfsplit_2)  # -> Keys, ValuesA
item = ListItem(List=sort.ValuesA, Index=0, Wrap=True)
item_2 = ListItem(List=srfsplit, Index=alongcrv.Indices, Wrap=True)
bbox_3 = BoundingBox(Content=pshift, Plane=PlaneXY(0, 0, 0), UnionBox=True)  # -> Box, Box_2
srf_3 = Surface(flatten(bbox_2.Box))
panel = Panel(srfsplit_3)
cull_i = CullIndex(List=sort_2.ValuesA, Indices="-1", Wrap=True)
dispatch = Dispatch(List=item_2, DispatchPattern=[True, False])  # -> ListA, ListB
offset_5 = OffsetCurve(Curve=project.Geometry, Distance="-0.5", Corners=1)  # -> flatten(Curve)
xy_4 = XYPlane(Origin=Point(0, 0, 0))
rec_2 = Rectangle(bbox_3.Box)
rdiff_2 = RegionDifference(CurvesA=srf_3, CurvesB=project_3.Geometry)
previewmat = CustomPreviewMaterials(Geometry=dispatch.ListB, DiffuseColor=RGB(255, 255, 255))
rdiff_3 = RegionDifference(CurvesA=rec_2, CurvesB=merge, Plane=xy_4)
boundary_2 = BoundarySurfaces(Edges=offset_5)
boundary_3 = BoundarySurfaces(Edges=rdiff_2)
colom = CollisionOneMany(Collider=cull_i, Obstacles=boundary_2)  # -> Collision, Index
boundary_4 = BoundarySurfaces(Edges=rdiff_3)
cull = CullPattern(List=cull_i, CullPattern=invert(colom.Collision))
join = BrepJoin(Breps=cull)  # -> Breps, Closed
crv_8 = Curve(join.Breps)
boundary_5 = BoundarySurfaces(Edges=crv_8)
