# Grasshopper definition 29_Inscribe a Circle in the Empty Space between Two Curves.gh (Grasshopper 1.0.7)

# 3 Level - 27
crv = Curve(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)
crv_2 = Curve(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)
crv_3 = Curve(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)
crv_4 = Curve(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)
crv_5 = Curve(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)
crv_6 = Curve(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)
crv_7 = Curve(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)
crv_8 = Curve(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)
crv_9 = Curve(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)
disc = Discontinuity(Curve=crv, Level=1)  # -> Points, Parameters
crv_10 = Curve(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)
crv_11 = Curve(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)
crv_12 = Curve(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)
crv_13 = Curve(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)
explode = Explode(Curve=crv_3, Recursive=True)  # -> Segments, Vertices
disc_2 = Discontinuity(Curve=crv_4, Level=1)  # -> Points, Parameters
explode_2 = Explode(Curve=crv_5, Recursive=True)  # -> Segments, Vertices
disc_3 = Discontinuity(Curve=crv_6, Level=1)  # -> Points, Parameters
disc_4 = Discontinuity(Curve=crv_7, Level=1)  # -> Points, Parameters
disc_5 = Discontinuity(Curve=crv_9, Level=1)  # -> Points, Parameters
crv_cp = CurveClosestPoint(Point=disc.Points, Curve=crv_2)  # -> Point, Parameter, Distance
ccx = CurveCurve(CurveA=crv_10, CurveB=crv_11)  # -> Points, ParamsA, ParamsB
midpt = CurveMiddle(Curve=explode.Segments)
midpt_2 = CurveMiddle(Curve=explode_2.Segments)
crv_cp_2 = CurveClosestPoint(Point=disc_4.Points, Curve=crv_8)  # -> Point, Parameter, Distance
item = ListItem(List=disc_5.Points, Index=0, Wrap=True)  # -> Item, Item1, Item2
shatter = Shatter(Curve=crv_2, Parameters=crv_cp.Parameter)
cp = ClosestPoint(Point=midpt, Cloud=disc_2.Points)  # -> ClosestPoint, CPIndex, Distance
cp_2 = ClosestPoint(Point=midpt_2, Cloud=disc_3.Points)  # -> ClosestPoint, CPIndex, Distance
end = EndPoints(Curve=explode_2.Segments)  # -> Start, End
explode_3 = Explode(Curve=crv_7, Recursive=True)  # -> Segments, Vertices
shatter_2 = Shatter(Curve=crv_8, Parameters=crv_cp_2.Parameter)
shatter_3 = Shatter(Curve=crv_11, Parameters=ccx.ParamsB)  # -> graft(Segments)
explode_4 = Explode(Curve=shatter, Recursive=True)  # -> flatten(Segments), Vertices
circle = Circle3Pt(PointA=item.Item, PointB=item.Item1, PointC=item.Item2)  # -> Circle, Plane, Radius
incircle = InCircle(CornerA=item.Item, CornerB=item.Item1, CornerC=item.Item2)  # -> Circle, Plane, Radius
extr = ExtrudePoint(Base=explode.Segments, Point=cp.ClosestPoint)
end_2 = EndPoints(Curve=shatter_3)  # -> Start, End
shift = ShiftList(List=shatter_2, Shift=1, Wrap=True)
midpt_3 = CurveMiddle(Curve=explode_4.Segments)
disc_6 = Discontinuity(Curve=extr, Level=1)  # -> Points, Parameters
incircle_2 = InCircle(CornerA=end.Start, CornerB=cp_2.ClosestPoint, CornerC=end.End)  # -> Circle, Plane, Radius
ln = Line(StartPoint=end_2.Start, EndPoint=end_2.End)
merge = Merge(Data1=simplify(graft(explode_3.Segments)), Data2=simplify(graft(shift)))
alongcrv = SortAlongCurve(Points=midpt_3, Curve=crv)  # -> Points, Indices
item_2 = ListItem(List=disc_6.Points, Index=0, Wrap=True)  # -> Item, Item1, Item2
merge_2 = Merge(Data1=ln, Data2=shatter_3)
crv_14 = Curve(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)
crv_15 = Curve(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)
join = JoinCurves(Curves=merge, Preserve=False)
incircle_3 = InCircle(CornerA=item_2.Item, CornerB=item_2.Item1, CornerC=item_2.Item2)  # -> Circle, Plane, Radius
crv_16 = Curve(flatten(join))
item_3 = ListItem(List=explode_4.Segments, Index=alongcrv.Indices, Wrap=True)
explode_5 = Explode(Curve=crv, Recursive=True)  # -> graft(Segments), Vertices
explode_6 = Explode(Curve=crv_14, Recursive=True)  # -> Segments, Vertices
disc_7 = Discontinuity(Curve=crv_15, Level=1)  # -> Points, Parameters
join_2 = JoinCurves(Curves=merge_2, Preserve=False)
area = Area(Geometry=crv_16)  # -> Area, graft(Centroid)
explode_7 = Explode(Curve=crv_16, Recursive=True)  # -> Segments, Vertices
midpt_4 = CurveMiddle(Curve=explode_6.Segments)
disc_8 = Discontinuity(Curve=join_2, Level=1)  # -> Points, Parameters
disc_9 = Discontinuity(Curve=join, Level=1)  # -> Points, Parameters
partition = PartitionList(List=item_3, Size="2")
avr = Average(Input=explode_7.Vertices)
item_4 = ListItem(List=explode_7.Segments, Index=0, Wrap=True)  # -> Item, Item1, Item2
cp_3 = ClosestPoint(Point=midpt_4, Cloud=disc_7.Points)  # -> graft(ClosestPoint), CPIndex, Distance
divide = DivideCurve(Curve=explode_6.Segments, Count="1", Kinks=False)  # -> Points, Tangents, Parameters
merge_3 = Merge(Data1=partition, Data2=explode_5.Segments)
item_5 = ListItem(List=disc_8.Points, Index=0, Wrap=True)  # -> Item, Item1, Item2
item_6 = ListItem(List=disc_9.Points, Index=0, Wrap=True)  # -> Item, Item1, Item2
circlettt = CircleTanTanTan(CurveA=item_4.Item, CurveB=item_4.Item1, CurveC=item_4.Item2, Point=avr)
join_3 = JoinCurves(Curves=merge_3, Preserve=False)
weave = Weave(Pattern=[0, 1], Stream0=divide.Points, Stream1=cp_3.ClosestPoint, NullGaps=False)
incircle_4 = InCircle(CornerA=item_5.Item, CornerB=item_5.Item1, CornerC=item_5.Item2)  # -> Circle, Plane, Radius
incircle_5 = InCircle(CornerA=item_6.Item, CornerB=item_6.Item1, CornerC=item_6.Item2)  # -> Circle, Plane, Radius
disc_10 = Discontinuity(Curve=join_3, Level=1)  # -> Points, Parameters
pline = PolyLine(Vertices=weave, Closed=invert(False))
item_7 = ListItem(List=disc_10.Points, Index=0, Wrap=True)  # -> Item, Item1, Item2
incircle_6 = InCircle(CornerA=item_7.Item, CornerB=item_7.Item1, CornerC=item_7.Item2)  # -> Circle, Plane, Radius
