# Grasshopper definition 30_Create a Pipe Twisting Along an Arc Curve.gh (Grasshopper 1.0.7)

xz = XZPlane(Origin=Point(0, 0, 0))
# 3 Level - 20
xz_2 = XZPlane(Origin=Point(0, 0, 0))
prot = RotatePlane(Plane=xz, Angle="-0.5*pi")
line = Line(Line((10.2288321, 6.445953133, 0), (42.88048728, 11.61280846, 0)))
prot_2 = RotatePlane(Plane=xz_2, Angle="-0.5*pi")
number_slider = Slider(20, range=0..100)
number_slider_2 = Slider(48, range=0..100)
xz_3 = XZPlane(Origin=Point(0, 0, 0))
xz_4 = XZPlane(Origin=Point(0, 0, 0))
len = Length(Curve=line)
xz_5 = XZPlane(Origin=Point(0, 0, 0))
cir = Circle(Plane=prot, Radius=Slider(48, range=0..100))
cir_2 = Circle(Plane=prot_2, Radius=Slider(36, range=0..100))
hframe = HorizontalFrame(Curve=reparameterize(line), Parameter="0.5")
prot_3 = RotatePlane(Plane=xz_3, Angle="-0.5*pi")
prot_4 = RotatePlane(Plane=xz_4, Angle="-0.5*pi")
expression = Expression(L=len, Expression="sqrt(3)*(L/2)")
number_slider_3 = Slider(100, range=0..100)
prot_5 = RotatePlane(Plane=xz_5, Angle="-0.5*pi")
divide = DivideCurve(Curve=cir, Count=Slider(18, range=0..100), Kinks=False)  # -> Points, Tangents, Parameters
deplane = DeconstructPlane(Plane=hframe)  # -> Origin, XAxis, YAxis, ZAxis
divide_2 = DivideCurve(Curve=cir_2, Count=Slider(12, range=0..100), Kinks=False)  # -> Points, Tangents, Parameters
cir_3 = Circle(Plane=prot_3, Radius=Slider(48, range=0..100))
vec = Vector(prot_4)
cir_4 = Circle(Plane=prot_4, Radius=number_slider_2)
expression_2 = Expression(n=number_slider, r=number_slider_2, Expression="tan(pi/n)*r")
cir_5 = Circle(Plane=prot_5, Radius=Slider(48, range=0..100))
vec2pt = Vector2Pt(PointA=cir, PointB=divide.Points, Unitize=False)  # -> Vector, Length
divide_3 = DivideCurve(Curve=cir_3, Count=Slider(20, range=0..100), Kinks=False)  # -> Points, Tangents, Parameters
vec2pt_2 = Vector2Pt(PointA=cir_2, PointB=divide_2.Points, Unitize=False)  # -> Vector, Length
shift = ShiftList(List=divide_2.Points, Shift=1, Wrap=True)
divide_4 = DivideCurve(Curve=cir_4, Count=number_slider, Kinks=False)  # -> Points, Tangents, Parameters
vec_2 = Vector(cir_4)
amp = Amplitude(Vector=deplane.YAxis, Amplitude=expression)
divide_5 = DivideCurve(Curve=cir_5, Count=Slider(22, range=0..100), Kinks=False)  # -> Points, Tangents, Parameters
vec_3 = Vector(cir_5)
line_2 = LineSDL(Start=divide.Points, Direction=divide.Tangents, Length=expr("-x", number_slider_3))
line_3 = LineSDL(Start=divide.Points, Direction=divide.Tangents, Length=number_slider_3)  # -> graft(Line)
shatter = Shatter(Curve=cir_3, Parameters=divide_3.Parameters)
rev = Reverse(Vector=vec_2)
pl = PlaneNormal(Origin=divide.Points, ZAxis=vec2pt.Vector)
pl_2 = PlaneNormal(Origin=divide_2.Points, ZAxis=vec2pt_2.Vector)
move = Move(Geometry=deplane.Origin, Motion=amp)  # -> Geometry, Transform
rev_2 = Reverse(Vector=vec_3)
merge = Merge(Data1=divide_2.Points, Data2=shift)
shift_2 = ShiftList(List=line_2, Shift=1, Wrap=True)  # -> graft(List)
cpoly = ControlPolygon(Curve=shatter)  # -> Polygon, Points
item = ListItem(List=shatter, Index=0, Wrap=True)
pl_3 = ConstructPlane(Origin=divide_4.Points, XAxis=rev, YAxis=divide_4.Tangents)
prot_6 = RotatePlane(Plane=pl, Angle=degrees("30"))  # -> graft(Plane)
pl_4 = ConstructPlane(Origin=divide_5.Points, XAxis=vec_3, YAxis=divide_5.Tangents)
flip = FlipMatrix(Data=merge)
polygon = Polygon(Plane=pl_2, Radius=3, Segments="6", FilletRadius=0)  # -> Polygon, Length
deplane_2 = DeconstructPlane(Plane=pl_4)  # -> Origin, XAxis, YAxis, ZAxis
ccx = CurveCurve(CurveA=line_3, CurveB=shift_2)  # -> Points, ParamsA, ParamsB
panel = Panel(merge)
shift_3 = ShiftList(List=pl_4, Shift=1, Wrap=True)
tan = TangentLines()  # -> Tangent1, Tangent2
tan_2 = TangentLines()  # -> Tangent1, Tangent2
ln = Line(StartPoint=prot_6, EndPoint=ccx.Points)
line_4 = LineSDL(Start=deplane_2.Origin, Direction=deplane_2.YAxis, Length=Slider(2, range=0..10))
ppx = PlanePlane(PlaneA=pl_4, PlaneB=shift_3)
polygon_2 = Polygon(Plane=pl_3, Radius=expression_2, Segments=6, FilletRadius=0)  # -> Polygon, Length
len_2 = Length(Curve=ln)
rotate = Rotate(Geometry=line_4, Angle="pi/6", Plane=pl_4)  # -> Geometry, Transform
item_2 = ListItem(List=len_2, Index=0, Wrap=True)
llx = LineLine(Line1=rotate.Geometry, Line2=ppx)  # -> ParamA, ParamB, PointA, PointB
dist = Distance(PointA=deplane_2.Origin, PointB=llx.PointA)
polygon_3 = Polygon(Plane=prot_6, Radius=item_2, Segments="6", FilletRadius=0)  # -> Polygon, Length
polygon_4 = Polygon(Plane=pl_4, Radius=dist, Segments=6, FilletRadius=0)  # -> Polygon, Length
boundary = BoundarySurfaces(Edges=polygon_3.Polygon)
divide_6 = DivideCurve(Count=10, Kinks=False)  # -> Points, Tangents, Parameters
