# Grasshopper definition 31_Create a Pipe Twisting Along an Arc Curve.gh (Grasshopper 1.0.7)
# plug-ins: Human

arc_radius = Slider(50, range=30..100)
arc_angle = Slider(1.5, range=0..2)
number_slider = Slider(20, range=0..100)
pi = Pi(Factor=Slider(4.2, range=0..10))
# 3 Level - 21
arc_radius_2 = Slider(50, range=30..100)
arc_angle_2 = Slider(1.5, range=0..2)
pi_2 = Pi(Factor=arc_angle)
dom = ConstructDomain(DomainStart=Slider(0, range=0..100), DomainEnd=pi)
number_slider_2 = Slider(20, range=0..100)
arc = Arc(Plane=PlaneXY(0, 0, 0), Radius=arc_radius, Angle=pi_2)  # -> Arc, Length
range = Range(Domain=dom, Steps=number_slider)
pi_3 = Pi(Factor=Slider(9, range=0..10))
pi_4 = Pi(Factor=arc_angle_2)
dom_2 = ConstructDomain(DomainStart=Slider(0, range=0..100), DomainEnd=pi_3)
pframes = PerpFrames(Curve=arc.Arc, Count=number_slider, Align=True)  # -> Frames, Parameters
arc_2 = Arc(Plane=PlaneXY(0, 0, 0), Radius=arc_radius_2, Angle=pi_4)  # -> Arc, Length
range_2 = Range(Domain=dom_2, Steps=number_slider_2)
prot = RotatePlane(Plane=pframes.Frames, Angle=range)  # -> graft(Plane)
pframes_2 = PerpFrames(Curve=arc_2.Arc, Count=number_slider_2, Align=True)  # -> Frames, Parameters
prot_2 = RotatePlane(Plane=pframes_2.Frames, Angle=range_2)  # -> graft(Plane)
polygon = Polygon(Plane=prot, Radius=Slider(3, range=0..10), Segments=Slider(6, range=0..10), FilletRadius=0)  # -> Polygon, flatten(Length)
disc = Discontinuity(Curve=polygon.Polygon, Level=1)  # -> Points, Parameters
item = ListItem(List=flatten(disc.Points), Index=0, Wrap=True)  # -> Item, Item1
polygon_2 = Polygon(Plane=prot_2, Radius=Slider(3, range=0..10), Segments=Slider(6, range=0..10), FilletRadius=0)  # -> Polygon, flatten(Length)
flip = FlipMatrix(Data=disc.Points)
dist = Distance(PointA=item.Item, PointB=item.Item1)
disc_2 = Discontinuity(Curve=polygon_2.Polygon, Level=1)  # -> Points, Parameters
item_2 = ListItem(List=flatten(disc_2.Points), Index=0, Wrap=True)  # -> Item, Item1
intcrv = Interpolate(Vertices=flip, Degree=3, Periodic=False, KnotStyle=1)  # -> Curve, Length, Domain
xz = XZPlane(Origin=Point(0, 0, 0))
flip_2 = FlipMatrix(Data=disc_2.Points)
yz = YZPlane(Origin=Point(0, 0, 0))
dist_2 = Distance(PointA=item_2.Item, PointB=item_2.Item1)
divide = DivideCurve(Curve=intcrv.Curve, Count="1", Kinks=False)  # -> simplify(Points), Tangents, Parameters
merge = Merge(Data1=xz, Data2=yz)
intcrv_2 = Interpolate(Vertices=flip_2, Degree=3, Periodic=False, KnotStyle=1)  # -> Curve, Length, Domain
pl_origin = PlaneOrigin(Base=merge, Origin=divide.Points)
pframes_3 = PerpFrames(Curve=intcrv_2.Curve, Count="1", Align=True)  # -> Frames, Parameters
cir = Circle(Plane=pl_origin, Radius=expr("x/2", dist))
cir_2 = Circle(Plane=pframes_3.Frames, Radius=expr("x/2", dist_2))
swp1 = Sweep1(Rail=intcrv.Curve, Sections=cir, Miter=1)
swp1_2 = Sweep1(Rail=intcrv_2.Curve, Sections=cir_2, Miter=1)
cap = CapHoles(Brep=swp1)
cap_2 = CapHoles(Brep=swp1_2)
previewmat = CustomPreviewMaterials(Geometry=cap, DiffuseColor=RGB(255, 255, 255))
previewmat_2 = CustomPreviewMaterials(Geometry=cap_2, DiffuseColor=RGB(255, 255, 255))
