# Grasshopper definition 32_Removing Nested Lines to Create a Single Line.gh (Grasshopper 1.0.7)
# plug-ins: LunchBox

crv = Curve(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)
crv_2 = Curve(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)
crvdom = CurveDomain(Curve=crv_2)  # -> Curve, Domain
len = Length(Curve=crv)
len_2 = Length(Curve=crv_2)
panel = Panel(len)
panel_2 = Panel(crvdom.Domain)
panel_3 = Panel(len_2)
# 3 Level - 29
crv_3 = Curve([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])
crv_4 = Curve([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])
crv_5 = Curve([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])
explode = Explode(Curve=crv_3, Recursive=True)  # -> flatten(Segments), flatten(Vertices)

explode_2 = Explode(Curve=crv_4, Recursive=True)  # -> flatten(Segments), Vertices
# 같은 방향 기울기 골라내기
unit = UnitVector(Vector=explode_2.Segments)
sqr = Square(Value=unit)
cset = CreateSet(List=sqr)  # -> Set, Map
mindex = MemberIndex(Set=sqr, Member=cset.Set)  # -> Index, Count
item = ListItem(List=explode_2.Segments, Index=mindex.Index, Wrap=True)

number_slider = Slider(0.95, range=0..5)
neg = Negative(Value=number_slider)
merge = Merge(Data1=neg, Data2=number_slider)
crv_6 = Curve([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])
offset = OffsetCurve(Curve=graft(crv_6), Distance=merge, Corners=1)  # -> simplify(Curve)
pshift = ShiftPaths(Data=offset, Offset=-1)
loft = Loft(Curves=pshift, Options={Adjust=False, Closed=False, LoftEnds=0, LoftSimp=0, LoftType=0, Rebuild=10, Refit=0.01})  # -> flatten(Loft)
runion = RegionUnion(Curves=loft)

explode_3 = Explode(Curve=crv_5, Recursive=True)  # -> flatten(Segments), Vertices
crv_7 = Curve(<curve referenced from the Rhino model>)
number_slider_2 = Slider(3, range=0..10)
number_slider_3 = Slider(60, range=0..120)
crv_8 = Curve(reparameterize(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))
cullpt = CullDuplicates(Points=explode.Vertices, Tolerance=0.1, CullMode=2)  # -> Points, Indices, Valence
crv_9 = Curve(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)
crv_10 = Curve(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)
crv_11 = Curve([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])
unit_2 = UnitVector(Vector=explode_3.Segments)
crvdom_2 = CurveDomain(Curve=crv_9)  # -> Curve, Domain
range = Range(Domain=Domain(0, 1), Steps=Slider(5, range=0..10))
pdecon = Deconstruct(Point=cullpt.Points)  # -> XComponent, YComponent, ZComponent
expression = Expression(Expression="Format(\"{0}, {1}\", x, y)")
divide = DivideCurve(Curve=crv_11, Count="1", Kinks=False)  # -> flatten(Points), Tangents, Parameters
crvdom_3 = CurveDomain(Curve=crv_8)  # -> Curve, Domain
eval = EvaluateCurve(Curve=crv_8, Parameter=Slider(0.5, range=0..1))  # -> Point, Tangent, Angle
crvdom_4 = CurveDomain(Curve=crv_10)  # -> Curve, Domain
len_3 = Length(Curve=crv_7)
range_2 = Range(Domain=Domain(0, 1), Steps=Slider(7, range=0..10))
# Curve (t)parameter
# Surface UV Point
cdiv = Derivatives()  # -> Point, FirstDerivative
line = Line(Line((0, -60, 0), (90, -60, 0)))
sqr_2 = Square(Value=unit_2)
dedomain = DeconstructDomain(Domain=crvdom_2.Domain)  # -> Start, End
line_2 = Line(Line((0, -100, 0), (90, -100, 0)))
graph = GraphMapper(
    range,
    x0=0,
    x1=1,
    y0=0,
    y1=1,
    container_name="Bezier",
    cpx=[0, 0.2221336365, 0.9220969677, 1],
    cpy=[0, 0.6174649, 0.3623934388, 1])
range_3 = Range(Domain=Domain(0, 1), Steps=Slider(7, range=0..10))
sort = SortList(Keys=pdecon.YComponent, ValuesA=cullpt.Points)  # -> Keys, ValuesA
panel_4 = Panel(crvdom_3.Domain)
panel_5 = Panel(len_3)
crv_12 = Curve(crvdom_4.Curve)
end = EndPoints(Curve=line)  # -> Start, End
crv_cp = CurveClosestPoint(Point=divide.Points, Curve=graft(crv_11))  # -> Point, Parameter, Distance
Y = UnitY(Factor=1)
panel_6 = Panel(crvdom_4.Domain)
divide_2 = DivideCurve(Curve=crv_10, Count=10, Kinks=False)  # -> Points, Tangents, Parameters
graph_2 = GraphMapper(range_2, x0=0, x1=1, y0=0, y1=1, container_name="Bezier", cpx=[0, 0.25, 1, 1], cpy=[0, 0.25, 0.06016403437, 1])
eval_2 = EvaluateCurve(Curve=crv_10, Parameter=Slider(60, range=0..120))  # -> Point, Tangent, Angle
division = Division(A=dedomain.End, B="2")
cset_2 = CreateSet(List=sqr_2)  # -> Set, Map
graph_3 = GraphMapper(
    range_3,
    x0=0,
    x1=1,
    y0=0,
    y1=1,
    container_name="Bezier",
    cpx=[0, 0.09959828109, 0.75, 1],
    cpy=[0, 0.6744662523, 0.75, 1])
cset_3 = CreateSet(List=pdecon.XComponent)  # -> Set, Map
pdecon_2 = Deconstruct(Point=sort.ValuesA)  # -> XComponent, YComponent, ZComponent
multiplication = Multiplication(A=graph, B=Slider(40, range=0..100))
bool = Boolean(invert(crv_cp.Distance))
line_3 = LineSDL(Start=end.Start, Direction=Y, Length=Slider(29, range=0..100))
crv_13 = Curve(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)
bnd = Bounds(Numbers=divide_2.Parameters)
eval_3 = EvaluateCurve(Curve=crv_9, Parameter=division)  # -> Point, Tangent, Angle
mindex_2 = MemberIndex(Set=sqr_2, Member=cset_2.Set)  # -> Index, Count
eval_4 = EvaluateCurve(Curve=reparameterize(line), Parameter=graph_2)  # -> Point, Tangent, Angle
bnd_2 = Bounds(Numbers=divide_2.Tangents)
panel_7 = Panel(pdecon.XComponent)
end_2 = EndPoints(Curve=crvdom_4.Curve)  # -> Start, End
panel_8 = Panel(eval_2.Tangent)
sunion = SetUnion()
Y_2 = UnitY(Factor=multiplication)
mindex_3 = MemberIndex(Set=pdecon_2.XComponent, Member=cset_3.Set)  # -> Index, Count
cull = CullPattern(List=crv_cp.Parameter, CullPattern=bool)
eval_5 = EvaluateCurve(Curve=reparameterize(line_3), Parameter=graph_3)  # -> Point, Tangent, Angle
crvdom_5 = CurveDomain(Curve=crv_13)  # -> Curve, Domain
len_4 = Length(Curve=crv_13)
item_2 = ListItem(List=explode_3.Segments, Index=mindex_2.Index, Wrap=True)
pdecon_3 = Deconstruct(Point=[end_2.Start, end_2.End])  # -> XComponent, YComponent, ZComponent
panel_9 = Panel(divide_2.Tangents)
panel_10 = Panel(bnd)
move = Move(Geometry=line_2, Motion=Y_2)  # -> Geometry, Transform
item_3 = ListItem(List=sort.ValuesA, Index=mindex_3.Index, Wrap=True)
panel_11 = Panel(eval_3.Point)
nurbs = NurbsCurve(Vertices=eval_5.Point, Degree=3, Periodic=False)  # -> Curve, Length, Domain
nurbs_2 = NurbsCurve(Vertices=eval_4.Point, Degree=3, Periodic=False)  # -> Curve, Length, Domain
shatter = Shatter(Curve=graft(crv_11), Parameters=cull)  # -> flatten(Segments)

explode_4 = Explode(Curve=item, Recursive=True)  # -> Segments, Vertices
pshift_2 = ShiftPaths(Data=explode_4.Vertices, Offset=-1)
# 같은 열 또는 행이면 그룹으로 묶기
cullpt_2 = CullDuplicates(Points=pshift_2, Tolerance=0.1, CullMode=3)  # -> Points, Indices, Valence
bang = ExplodeTree(Data=cullpt_2.Points)  # -> Branch0, Branch1
pdecon_4 = Deconstruct(Point=bang.Branch0)  # -> XComponent, YComponent, ZComponent
pdecon_5 = Deconstruct(Point=bang.Branch1)  # -> XComponent, YComponent, ZComponent
cset_4 = CreateSet(List=pdecon_4.YComponent)  # -> Set, Map
cset_5 = CreateSet(List=pdecon_5.XComponent)  # -> Set, Map
mindex_4 = MemberIndex(Set=pdecon_4.YComponent, Member=cset_4.Set)  # -> Index, Count
mindex_5 = MemberIndex(Set=pdecon_5.XComponent, Member=cset_5.Set)  # -> Index, Count
item_4 = ListItem(List=bang.Branch0, Index=mindex_4.Index, Wrap=True)
item_5 = ListItem(List=bang.Branch1, Index=mindex_5.Index, Wrap=True)

explode_5 = Explode(Curve=item_2, Recursive=True)  # -> Segments, Vertices
bnd_3 = Bounds(Numbers=pdecon_3.XComponent)
bnd_4 = Bounds(Numbers=pdecon_3.YComponent)
pline = PolyLine(Vertices=item_3, Closed=False)
panel_12 = Panel(item_3)
loft_2 = Loft(Curves=move.Geometry, Options={Adjust=False, Closed=False, LoftEnds=0, LoftSimp=0, LoftType=1, Rebuild=10, Refit=0.01})
Y_3 = UnitY(Factor=Slider(30, range=0..100))
midpt = CurveMiddle(Curve=shatter)
pshift_3 = ShiftPaths(Data=explode_5.Vertices, Offset=-1)
panel_13 = Panel(len_4)
panel_14 = Panel(crvdom_5.Domain)
reb = RebuildCurve(Curve=nurbs.Curve, Degree="1", Count=10, Tangents=False)
panel_15 = Panel(bnd_4)
reb_2 = RebuildCurve(Curve=nurbs_2.Curve, Degree="1", Count=10, Tangents=False)
cullpt_3 = CullDuplicates(Points=midpt, Tolerance=0.1, CullMode=1)  # -> Points, Indices, Valence
number_slider_4 = Slider(0.95, range=0..5)
cullpt_4 = CullDuplicates(Points=pshift_3, Tolerance=0.1, CullMode=3)  # -> Points, Indices, Valence
diamond = DiamondPanels(Surface=loft_2, UDivisions=Slider(21, range=0..100), VDivisions=Slider(46, range=0..100))  # -> DiamondPanels, TriPanels
bang_2 = ExplodeTree(Data=cullpt_4.Points)  # -> Branch0, Branch1
item_6 = ListItem(List=shatter, Index=cullpt_3.Indices, Wrap=True)
sumsrf = SumSurface(CurveA=reb, CurveB=reb_2)
neg_2 = Negative(Value=number_slider_4)
join = JoinCurves(Curves=item_6, Preserve=False)
diamond_2 = DiamondPanels(Surface=sumsrf, UDivisions=Slider(17, range=0..100), VDivisions=Slider(45, range=0..100))  # -> DiamondPanels, TriPanels
pdecon_6 = Deconstruct(Point=bang_2.Branch0)  # -> XComponent, YComponent, ZComponent
pdecon_7 = Deconstruct(Point=bang_2.Branch1)  # -> XComponent, YComponent, ZComponent
merge_2 = Merge(Data1=neg_2, Data2=number_slider_4)
extr = Extrude(Base=nurbs_2.Curve, Direction=Y_3)
cset_6 = CreateSet(List=pdecon_6.YComponent)  # -> Set, Map
cset_7 = CreateSet(List=pdecon_7.XComponent)  # -> Set, Map
offset_2 = OffsetCurve(Curve=graft(join), Distance=merge_2, Corners=1)  # -> simplify(Curve)
mindex_6 = MemberIndex(Set=pdecon_6.YComponent, Member=cset_6.Set)  # -> Index, Count
mindex_7 = MemberIndex(Set=pdecon_7.XComponent, Member=cset_7.Set)  # -> Index, Count
pshift_4 = ShiftPaths(Data=offset_2, Offset=-1)
loft_3 = Loft(Curves=pshift_4, Options={Adjust=False, Closed=False, LoftEnds=0, LoftSimp=0, LoftType=0, Rebuild=10, Refit=0.01})  # -> flatten(Loft)
item_7 = ListItem(List=bang_2.Branch0, Index=mindex_6.Index, Wrap=True)
item_8 = ListItem(List=bang_2.Branch1, Index=mindex_7.Index, Wrap=True)
runion_2 = RegionUnion(Curves=loft_3)

# ----
# 좌표 정렬 (폴리라인으로 긋기 위함)
pdecon_8 = Deconstruct(Point=item_4)  # -> XComponent, YComponent, ZComponent
pdecon_9 = Deconstruct(Point=item_5)  # -> XComponent, YComponent, ZComponent
sort_2 = SortList(Keys=pdecon_8.XComponent, ValuesA=item_4)  # -> Keys, ValuesA
sort_3 = SortList(Keys=pdecon_9.YComponent, ValuesA=item_5)  # -> Keys, ValuesA
pline_2 = PolyLine(Vertices=sort_2.ValuesA, Closed=False)
pline_3 = PolyLine(Vertices=sort_3.ValuesA, Closed=False)
number_slider_5 = Slider(1.1, range=0..3)
merge_3 = Merge(Data1=pline_2, Data2=pline_3)  # -> flatten(Result)
neg_3 = Negative(Value=number_slider_5)
join_2 = JoinCurves(Curves=merge_3, Preserve=False)  # -> simplify(graft(Curves))
merge_4 = Merge(Data1=number_slider_5, Data2=neg_3)

pdecon_10 = Deconstruct(Point=item_7)  # -> XComponent, YComponent, ZComponent
pdecon_11 = Deconstruct(Point=item_8)  # -> XComponent, YComponent, ZComponent
range_4 = Range(Domain=Domain(0, 1), Steps=Slider(5, range=0..10))
range_5 = Range(Domain=Domain(0, 1), Steps=Slider(7, range=0..10))
line_4 = Line(Line((0, -60, 0), (90, -60, 0)))
boundary = BoundarySurfaces(Edges=runion_2)
eval_6 = EvaluateLength(Normalized=True)  # -> Point, Tangent, Parameter
line_5 = Line(Line((0, -100, 0), (90, -100, 0)))
sort_4 = SortList(Keys=pdecon_10.XComponent, ValuesA=item_7)  # -> Keys, ValuesA
sort_5 = SortList(Keys=pdecon_11.YComponent, ValuesA=item_8)  # -> Keys, ValuesA
line_6 = Line(Line((0, -100, 0), (90, -100, 0)))
graph_4 = GraphMapper(
    range_5,
    x0=0,
    x1=1,
    y0=0,
    y1=1,
    container_name="Bezier",
    cpx=[0, 0.1818181872, 0.473326236, 1],
    cpy=[0, 0.5681818128, 0.9186290503, 1])
graph_5 = GraphMapper(
    range_4,
    x0=0,
    x1=1,
    y0=0,
    y1=1,
    container_name="Bezier",
    cpx=[0, 0.2668193579, 0.6527002454, 1],
    cpy=[0, 0.6673861742, 0.749483943, 1])
crvdom_6 = CurveDomain(Curve=line_6)  # -> Curve, Domain
eval_7 = EvaluateCurve()  # -> Point, Tangent, Angle
subcrv = SubCurve(BaseCurve=line_6, Domain="0.2 to 0.6")
pline_4 = PolyLine(Vertices=sort_4.ValuesA, Closed=False)
pline_5 = PolyLine(Vertices=sort_5.ValuesA, Closed=False)
multiplication_2 = Multiplication(A=graph_5, B=Slider(40, range=0..100))
eval_8 = EvaluateCurve(Curve=reparameterize(line_4), Parameter=graph_4)  # -> Point, Tangent, Angle
number_slider_6 = Slider(1.1, range=0..3)
number_slider_7 = Slider(0.5, range=0..1)
number_slider_8 = Slider(0.5, range=0..1)
panel_16 = Panel(crvdom_6.Domain)
crvdom_7 = CurveDomain(Curve=subcrv)  # -> Curve, Domain
merge_5 = Merge(Data1=pline_4, Data2=pline_5)  # -> flatten(Result)
Y_4 = UnitY(Factor=multiplication_2)
pframe = PerpFrame()
nurbs_3 = NurbsCurve(Vertices=eval_8.Point, Degree=3, Periodic=False)  # -> Curve, Length, Domain
panel_17 = Panel(crvdom_7.Domain)
range_6 = Range(Domain=Domain(0, 1), Steps=Slider(5, range=0..10))
range_7 = Range(Domain=Domain(0, 1), Steps=Slider(7, range=0..10))
move_2 = Move(Geometry=line_5, Motion=Y_4)  # -> Geometry, Transform
neg_4 = Negative(Value=number_slider_6)
join_3 = JoinCurves(Curves=merge_5, Preserve=False)
md_slider = MDSlider(
    SliderMode=0,
    slider_value=Point(0.5815620422, 0.2471542358, 0.5),
    x_domain=Domain(0, 1),
    y_domain=Domain(0, 1),
    z_domain=Domain(0, 1))
pframe_2 = PerpFrame(Curve=reparameterize(nurbs_3.Curve), Parameter=range_7)
pframes = PerpFrames(Curve=nurbs_3.Curve, Count=Slider(8, range=0..10), Align=True)  # -> Frames, Parameters
seam = Seam()
merge_6 = Merge(Data1=number_slider_6, Data2=neg_4)  # -> graft(Result)
loft_4 = Loft(Curves=move_2.Geometry, Options={Adjust=False, Closed=False, LoftEnds=0, LoftSimp=0, LoftType=1, Rebuild=10, Refit=0.01})
hframe = HorizontalFrame(Curve=reparameterize(nurbs_3.Curve), Parameter=range_6)
eval_9 = EvaluateCurve(Curve=reparameterize(nurbs_3.Curve), Parameter=number_slider_7)  # -> Point, Tangent, Angle
divide_3 = DivideCurve(Curve=nurbs_3.Curve, Count=Slider(5, range=0..10), Kinks=False)  # -> Points, Tangents, Parameters
eval_10 = EvaluateLength(Curve=nurbs_3.Curve, Length=number_slider_7, Normalized=True)  # -> Point, Tangent, Parameter
offset_3 = OffsetCurve(Curve=join_2, Distance=merge_4, Corners=1)
sframes = SurfaceFrames(Surface=loft_4, UCount=Slider(5, range=0..10), VCount=Slider(6, range=0..10))  # -> Frames, Parameters
sdivide = DivideSurface(Surface=loft_4, UCount=Slider(5, range=0..10), VCount=Slider(6, range=0..10))  # -> Points, Normals, Parameters
evalsrf = EvaluateSurface(Surface=reparameterize(loft_4), Point=md_slider)  # -> Point, Normal, UDirection, VDirection, Frame
pshift_5 = ShiftPaths(Data=offset_3, Offset=-1)
offset_4 = OffsetCurve(Curve=join_3, Distance=merge_6, Corners=1)
srf = Surface(loft_4)
flip = FlipMatrix(Data=pshift_5)
domain² = Domain²(srf)
line_7 = Line(Line((0, -100, 0), (90, -100, 0)))
path_mapper = PathMapper(offset_4, source="{A;B;C}", target="{A;C}")
divide_4 = DivideDomain²(Domain=srf, UCount="1", VCount=Slider(5, range=0..10))
merge_7 = Merge(Data1="0", Data2=Slider(0.2, range=0..1), Data3=Slider(0.36, range=0..1), Data4="1")
crvdom_8 = CurveDomain(Curve=line_7)  # -> Curve, Domain
consec = ConsecutiveDomains(Numbers=merge_7, Additive=invert(True))
path_mapper_2 = PathMapper(flip, source="{A}(i)", target="(i)")
panel_18 = Panel(domain²)
subsrf = Isotrim(Surface=srf, Domain=divide_4)
panel_19 = Panel(crvdom_8.Domain)
crv_14 = Curve(path_mapper)
panel_20 = Panel(merge_7)
range_8 = Range(Domain=Domain(0, 1), Steps=Slider(7, range=0..10))
panel_21 = Panel(consec)
line_8 = Line(Line((0, -60, 0), (90, -60, 0)))
domain²_2 = Domain²(subsrf)
subcrv_2 = SubCurve(BaseCurve=reparameterize(line_7), Domain=consec)
loft_5 = Loft(Curves=path_mapper_2, Options={Adjust=True, Closed=False, LoftEnds=0, LoftSimp=0, LoftType=0, Rebuild=10, Refit=0.01})
eval_11 = EvaluateLength(Curve=line_7, Length=merge_7, Normalized=True)  # -> Point, Tangent, Parameter
graph_6 = GraphMapper(
    range_8,
    x0=0,
    x1=1,
    y0=0,
    y1=1,
    container_name="Bezier",
    cpx=[0, 0.1415100098, 0.4863392115, 1],
    cpy=[0, 0.5213290453, 0.7758456469, 1])
loft_6 = Loft(Curves=path_mapper, Options={Adjust=True, Closed=False, LoftEnds=0, LoftSimp=0, LoftType=0, Rebuild=10, Refit=0.01})
crvdom_9 = CurveDomain(Curve=subcrv_2)  # -> Curve, Domain
panel_22 = Panel(domain²_2)
shatter_2 = Shatter(Curve=line_7, Parameters=eval_11.Parameter)
hframe_2 = HorizontalFrame(Curve=reparameterize(line_8), Parameter=graph_6)
crvdom_10 = CurveDomain(Curve=shatter_2)  # -> Curve, Domain
panel_23 = Panel(crvdom_9.Domain)
panel_24 = Panel(shatter_2)
consec_2 = ConsecutiveDomains(Numbers=[0, 0.5, 1, 1.5, 2], Additive=True)
panel_25 = Panel(crvdom_10.Domain)
