# Grasshopper definition 33_To create a box shape from lines sorted in a branching structure..gh (Grasshopper 1.0.7)

# 3 Level - 30
number_slider = Slider(1, range=0..1)
crv = Curve(Tree({0;0}: [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], {1;0}: [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], {2;0}: [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], {3;0}: [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], {4;0}: [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], {5;0}: [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]))
crv_2 = Curve(Tree({0;0}: [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], {1;0}: [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], {2;0}: [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], {3;0}: [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], {4;0}: [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], {5;0}: [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]))
crv_3 = Curve(Tree({0;0}: [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], {1;0}: [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], {2;0}: [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], {3;0}: [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], {4;0}: [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], {5;0}: [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]))
crv_4 = Curve(Tree({0;0}: [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], {1;0}: [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], {2;0}: [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], {3;0}: [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], {4;0}: [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], {5;0}: [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]))
offset = OffsetCurve(Curve=crv_3, Distance=Slider(1, range=0..1), Corners=1)
offset_2 = OffsetCurve(Curve=crv, Distance=expr("-x", Slider(1, range=0..1)), Corners=1)
offset_3 = OffsetCurve(Curve=crv_2, Distance=expr("-x", Slider(1, range=0..1)), Corners=1)
offset_4 = OffsetCurve(Curve=crv_4, Distance=expr("-x", number_slider), Corners=1)
pshift = ShiftPaths(Data=offset, Offset=-1)
pshift_2 = ShiftPaths(Data=offset_4, Offset=-1)
pshift_3 = ShiftPaths(Data=offset_2, Offset=-1)
pshift_4 = ShiftPaths(Data=offset_3, Offset=-1)
merge = Merge(Data1=graft(crv_3), Data2=graft(pshift))
merge_2 = Merge(Data1=graft(crv_4), Data2=graft(pshift_2))
merge_3 = Merge(Data1=graft(crv), Data2=graft(pshift_3))
merge_4 = Merge(Data1=graft(crv_2), Data2=graft(pshift_4))
loft = Loft(Curves=merge, Options={Adjust=False, Closed=False, LoftEnds=0, LoftSimp=0, LoftType=0, Rebuild=10, Refit=0.01})  # -> simplify(Loft)
loft_2 = Loft(Curves=merge_2, Options={Adjust=False, Closed=False, LoftEnds=0, LoftSimp=0, LoftType=0, Rebuild=10, Refit=0.01})  # -> simplify(Loft)
loft_3 = Loft(Curves=merge_3, Options={Adjust=False, Closed=False, LoftEnds=0, LoftSimp=0, LoftType=0, Rebuild=10, Refit=0.01})  # -> simplify(Loft)
loft_4 = Loft(Curves=merge_4, Options={Adjust=False, Closed=False, LoftEnds=0, LoftSimp=0, LoftType=0, Rebuild=10, Refit=0.01})  # -> simplify(Loft)
pshift_5 = ShiftPaths(Data=loft, Offset=-1)
viewer = ParamViewer(loft_4)
pshift_6 = ShiftPaths(Data=loft_2, Offset=-1)
pshift_7 = ShiftPaths(Data=loft_3, Offset=-1)
pshift_8 = ShiftPaths(Data=loft_4, Offset=-1)
area = Area(Geometry=pshift_5)  # -> Area, Centroid
tstat = TreeStatistics(Tree=pshift_5)  # -> Paths, Length, Count
area_2 = Area(Geometry=pshift_6)  # -> Area, Centroid
tstat_2 = TreeStatistics(Tree=pshift_6)  # -> Paths, Length, Count
area_3 = Area(Geometry=pshift_7)  # -> Area, Centroid
area_4 = Area(Geometry=pshift_8)  # -> Area, Centroid
group = Group(Objects=pshift_7)  # -> flatten(Group)
tstat_3 = TreeStatistics(Tree=pshift_8)  # -> Paths, Length, Count
avr = Average(Input=area.Centroid)  # -> flatten(ArithmeticMean)
number_slider_2 = Slider(2, range=0..10)
avr_2 = Average(Input=area_2.Centroid)  # -> flatten(ArithmeticMean)
avr_3 = Average(Input=area_3.Centroid)  # -> flatten(ArithmeticMean)
avr_4 = Average(Input=area_4.Centroid)  # -> flatten(ArithmeticMean)
number_slider_3 = Slider(2, range=0..10)
panel = Panel(tstat_3.Paths)
pdecon = Deconstruct(Point=avr)  # -> XComponent, YComponent, ZComponent
pdecon_2 = Deconstruct(Point=avr_3)  # -> XComponent, YComponent, ZComponent
pdecon_3 = Deconstruct(Point=avr_2)  # -> XComponent, YComponent, ZComponent
pdecon_4 = Deconstruct(Point=avr_4)  # -> XComponent, YComponent, ZComponent
series = Series(Start=number_slider_2, Step=number_slider_2, Count=tstat.Count)
number_slider_4 = Slider(2, range=0..10)
sort = SortList(Keys=pdecon_2.XComponent, ValuesA=group)  # -> Keys, ValuesA
sort_2 = SortList(Keys=pdecon_4.XComponent, ValuesA=tstat_3.Paths)  # -> Keys, ValuesA
series_2 = Series(Start=number_slider_3, Step=number_slider_3, Count=tstat_2.Count)
sort_3 = SortList(Keys=pdecon.XComponent, ValuesA=series)  # -> Keys, ValuesA
sort_4 = SortList(Keys=pdecon_3.XComponent, ValuesA=tstat_2.Paths)  # -> Keys, ValuesA
lng = ListLength(List=sort.ValuesA)
ungroup = Ungroup(Group=sort.ValuesA)
number_slider_5 = Slider(2, range=0..10)
sort_5 = SortList(Keys=sort_3.ValuesA, ValuesA=series)  # -> Keys, ValuesA
replace = ReplacePaths(Data=pshift_8, Search=sort_2.ValuesA, Replace=tstat_3.Paths)
panel_2 = Panel(sort_2.ValuesA)
Z = UnitZ(Factor=series_2)  # -> graft(UnitVector)
branch = TreeBranch(Tree=pshift_6, Path=sort_4.ValuesA, MaintainPaths=False)
series_3 = Series(Start=number_slider_4, Step=number_slider_4, Count=lng)
Z_2 = UnitZ(Factor=sort_5.ValuesA)  # -> graft(UnitVector)
extr = Extrude(Base=branch, Direction=Z)
Z_3 = UnitZ(Factor=series_3)  # -> graft(UnitVector)
series_4 = Series(Start=number_slider_5, Step=number_slider_5, Count=tstat_3.Count)
extr_2 = Extrude(Base=pshift_5, Direction=Z_2)
extr_3 = Extrude(Base=ungroup, Direction=Z_3)
Z_4 = UnitZ(Factor=series_4)  # -> graft(UnitVector)
extr_4 = Extrude(Base=replace, Direction=Z_4)
