# Grasshopper definition 34_Star shape.gh (Grasshopper 1.0.7)
# plug-ins: Human

# 3 Level - 26
srf = Surface(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)
srf_2 = Surface(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)
srf_3 = Surface(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)
srf_4 = Surface(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)
debrep = DeconstructBrep(Brep=srf)  # -> Faces, Edges, Vertices
edges = BrepEdges(Brep=srf_2)  # -> Naked, Interior, NonManifold
debrep_2 = DeconstructBrep(Brep=srf_3)  # -> Faces, Edges, Vertices
debrep_3 = DeconstructBrep(Brep=srf_4)  # -> Faces, Edges, Vertices
cls = Closed(Curve=debrep.Edges)  # -> Closed, Periodic
srf_5 = Surface(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)
crv = Curve(edges.Naked)
cls_2 = Closed(Curve=debrep_2.Edges)  # -> Closed, Periodic
edges_2 = BrepEdges(Brep=srf_5)  # -> Naked, Interior, NonManifold
cls_3 = Closed(Curve=debrep_3.Edges)  # -> Closed, Periodic
cull = CullPattern(List=debrep.Edges, CullPattern=cls.Closed)
len = Length(Curve=crv)
number_slider = Slider(8, range=3..12)
cull_2 = CullPattern(List=debrep_2.Edges, CullPattern=cls_2.Closed)
crv_2 = Curve(edges_2.Naked)
sort = SortList(Keys=len, ValuesA=crv)  # -> Keys, reverse(ValuesA)
cull_3 = CullPattern(List=debrep_3.Edges, CullPattern=cls_3.Closed)
len_2 = Length(Curve=cull)
len_3 = Length(Curve=crv_2)
number_slider_2 = Slider(6, range=3..20)
len_4 = Length(Curve=cull_2)
sort_2 = SortList(Keys=len_2, ValuesA=cull)  # -> Keys, reverse(ValuesA)
len_5 = Length(Curve=cull_3)
item = ListItem(List=sort.ValuesA, Index=0, Wrap=True)
sort_3 = SortList(Keys=len_3, ValuesA=crv_2)  # -> Keys, reverse(ValuesA)
sort_4 = SortList(Keys=len_4, ValuesA=cull_2)  # -> Keys, reverse(ValuesA)
sort_5 = SortList(Keys=len_5, ValuesA=cull_3)  # -> Keys, reverse(ValuesA)
expression = Expression(n=number_slider, Expression="pi*(n-2)/(n*2)")
planar = IsPlanar(Surface=item, Interior=True)  # -> Planar, Plane
area = Area(Geometry=sort_2.ValuesA)  # -> Area, Centroid
item_2 = ListItem(List=sort_3.ValuesA, Index=0, Wrap=True)
pt = Point(planar.Plane)
area_2 = Area(Geometry=sort_4.ValuesA)  # -> Area, Centroid
range = Range(Domain="0 to 2 * pi", Steps=Slider(4, range=3..12))
area_3 = Area(Geometry=sort_5.ValuesA)  # -> Area, Centroid
item_3 = ListItem(List=area.Centroid, Index=0, Wrap=True)  # -> Item, Item1
cir = Circle(Plane=pt, Radius=Slider(10, range=0..10))
planar_2 = IsPlanar(Surface=item_2, Interior=True)  # -> Planar, Plane
multiplication = Multiplication(A=number_slider_2, B="2")
range_2 = Range(Domain="0 to 2 * pi", Steps=Slider(5, range=0..100))
item_4 = ListItem(List=area_2.Centroid, Index=0, Wrap=True)  # -> Item, Item1
cull_i = CullIndex(List=range, Indices="-1", Wrap=True)
deplane = DeconstructPlane(Plane=planar_2.Plane)  # -> Origin, XAxis, YAxis, ZAxis
item_5 = ListItem(List=area_3.Centroid, Index=0, Wrap=True)  # -> Item, Item1
seam = Seam(Curve=reparameterize(cir), Seam="0.25")
vec2pt = Vector2Pt(PointA=item_3.Item, PointB=item_3.Item1, Unitize=False)  # -> Vector, Length
cull_i_2 = CullIndex(List=range_2, Indices="-1", Wrap=True)
panel = Panel("""1
-1""")
rot3d = Rotate3D(Geometry=planar_2.Plane, Angle=expression, Center=planar_2.Plane, Axis=Vector(0, 0, 1))  # -> Geometry, Transform
vec2pt_2 = Vector2Pt(PointA=item_4.Item, PointB=item_4.Item1, Unitize=False)  # -> Vector, Length
pl = ConstructPlane(Origin=deplane.Origin, XAxis=planar_2.Plane, YAxis=deplane.YAxis)
X = UnitX(Factor=1)
pframes = PerpFrames(Curve=seam, Count=multiplication, Align=True)  # -> Frames, Parameters
vec2pt_3 = Vector2Pt(PointA=item_5.Item, PointB=item_5.Item1, Unitize=False)  # -> Vector, Length
X_2 = UnitX(Factor=1)
pl_2 = ConstructPlane(Origin=item_3.Item, XAxis=vec2pt.Vector, YAxis=Vector(0, 1, 0))
item_6 = ListItem(List=cull_i, Index=panel, Wrap=True)
mirror = Mirror(Geometry=rot3d.Geometry, Plane=pl)  # -> Geometry, Transform
panel_2 = Panel("""1
-1""")
pl_3 = ConstructPlane(Origin=item_5.Item, XAxis=vec2pt_3.Vector, YAxis=X_2)
pl_4 = ConstructPlane(Origin=item_4.Item, XAxis=vec2pt_2.Vector, YAxis=X)
item_7 = ListItem(List=pframes.Frames, Index=panel_2, Wrap=True)
merge = Merge(Data1=mirror.Geometry, Data2=rot3d.Geometry)
deplane_2 = DeconstructPlane(Plane=pl_3)  # -> Origin, XAxis, YAxis, ZAxis
srf_6 = Surface(srf_4)
rotate = Rotate(Angle=item_6, Plane=pl_2)  # -> Geometry, Transform
sec = BrepPlane(Brep=srf_2, Plane=item_7)  # -> flatten(Curves), Points
sec_2 = BrepPlane(Brep=srf_5, Plane=merge)  # -> flatten(Curves), Points
rotate_2 = Rotate(Geometry=srf_3, Angle=cull_i_2, Plane=pl_4)  # -> Geometry, Transform
panel_3 = Panel("""1
-1""")
pl_5 = PlaneNormal(Origin=pl_3, ZAxis=deplane_2.YAxis)
sec_3 = BrepPlane(Brep=srf, Plane=rotate.Geometry)  # -> flatten(Curves), Points
srfsplit = SurfaceSplit(Surface=srf_5, Curves=sec_2.Curves)
srfsplit_2 = SurfaceSplit(Surface=srf_2, Curves=sec.Curves)
range_3 = Range(Domain="0 to 2 * pi", Steps=Slider(4, range=0..100))
shift = ShiftList(List=rotate_2.Geometry, Shift=panel_3, Wrap=True)  # -> simplify(List)
entwine = Entwine(Branch00=srf_6, Branch01=pl_5, FlattenInputs=True)
area_4 = Area(Geometry=srfsplit)  # -> Area, Centroid
pt_2 = Point(pl)
area_5 = Area(Geometry=srfsplit_2)  # -> Area, Centroid
cull_i_3 = CullIndex(List=range_3, Indices="-1", Wrap=True)
join = JoinCurves(Curves=sec_3.Curves, Preserve=False)
sort_6 = SortList(Keys=area_4.Area, ValuesA=srfsplit)  # -> Keys, reverse(ValuesA)
path_mapper = PathMapper(shift, source="{A}(i)", target="(i)")
sort_7 = SortList(Keys=area_5.Area, ValuesA=srfsplit_2)  # -> Keys, reverse(ValuesA)
srfsplit_3 = SurfaceSplit(Surface=srf, Curves=join)
rotate_3 = Rotate(Geometry=entwine, Angle=cull_i_3, Plane=pl_3)  # -> Geometry, Transform
item_8 = ListItem(List=sort_6.ValuesA, Index=0, Wrap=True)
item_9 = ListItem(List=sort_7.ValuesA, Index=0, Wrap=True)
bbx = BrepBrep(BrepA=simplify(graft(rotate_2.Geometry)), BrepB=path_mapper)  # -> Curves, Points
bang = ExplodeTree(Data=rotate_3.Geometry)  # -> graft(Branch0), Branch1
item_10 = ListItem(List=srfsplit_3, Index="-1", Wrap=True)
arrpolar = PolarArray(Geometry=item_8, Plane=pt_2, Count=number_slider, Angle=6.283185307)  # -> Geometry, Transform
arrpolar_2 = PolarArray(Geometry=item_9, Plane=pt, Count=number_slider_2, Angle=6.283185307)  # -> Geometry, Transform
rotate_4 = Rotate(Geometry=item_10, Angle=cull_i, Plane=pl_2)  # -> Geometry, Transform
pshift = ShiftPaths(Data=bbx.Curves, Offset=-1)
sec_4 = BrepPlane(Brep=bang.Branch0, Plane=bang.Branch1)  # -> Curves, Points
srfsplit_4 = SurfaceSplit(Surface=graft(rotate_2.Geometry), Curves=pshift)
cap = CapHoles(Brep=rotate_4.Geometry)
pshift_2 = ShiftPaths(Data=sec_4.Curves, Offset=-1)
sunion = SolidUnion(Breps=cap)
srfsplit_5 = SurfaceSplit(Surface=bang.Branch0, Curves=pshift_2)
area_6 = Area(Geometry=srfsplit_4)  # -> Area, Centroid
area_7 = Area(Geometry=srfsplit_5)  # -> Area, Centroid
panel_4 = Panel(sunion)
sort_8 = SortList(Keys=area_6.Area, ValuesA=srfsplit_4)  # -> Keys, reverse(ValuesA)
sort_9 = SortList(Keys=area_7.Area, ValuesA=srfsplit_5)  # -> Keys, reverse(ValuesA)
item_11 = ListItem(List=sort_8.ValuesA, Index=0, Wrap=True)  # -> flatten(Item)
item_12 = ListItem(List=sort_9.ValuesA, Index=0, Wrap=True)  # -> Item, Item1
panel_5 = Panel(item_11)
join_2 = BrepJoin(Breps=flatten([item_12.Item, item_12.Item1]))  # -> Breps, Closed
item_13 = ListItem(List=join_2.Breps, Index=Slider(0, range=0..100), Wrap=True)
panel_6 = Panel(join_2.Breps)
srf_7 = Surface(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)
edges_3 = BrepEdges(Brep=srf_7)  # -> Naked, Interior, NonManifold
crv_3 = Curve(edges_3.Naked)
len_6 = Length(Curve=crv_3)
sort_10 = SortList(Keys=len_6, ValuesA=crv_3)  # -> Keys, reverse(ValuesA)
number_slider_3 = Slider(6, range=3..12)
item_14 = ListItem(List=sort_10.ValuesA, Index=0, Wrap=True)
planar_3 = IsPlanar(Surface=item_14, Interior=True)  # -> Planar, Plane
deplane_3 = DeconstructPlane(Plane=planar_3.Plane)  # -> Origin, XAxis, YAxis, ZAxis
neg = Negative(Value=number_slider_3)
rev = Reverse(Vector=deplane_3.ZAxis)
merge_2 = Merge(Data1=neg, Data2=number_slider_3)
pl_6 = ConstructPlane(Origin=deplane_3.Origin, XAxis=rev, YAxis=deplane_3.YAxis)
expression_2 = Expression(n=merge_2, Expression="pi/n")
rot3d_2 = Rotate3D(Geometry=pl_6, Angle=expression_2, Center=pl_6, Axis=deplane_3.YAxis)  # -> Geometry, Transform
sec_5 = BrepPlane(Brep=srf_7, Plane=rot3d_2.Geometry)  # -> flatten(Curves), Points
pt_3 = Point(pl_6)
srfsplit_6 = SurfaceSplit(Surface=srf_7, Curves=sec_5.Curves)
area_8 = Area(Geometry=srfsplit_6)  # -> Area, Centroid
sort_11 = SortList(Keys=area_8.Area, ValuesA=srfsplit_6)  # -> Keys, reverse(ValuesA)
item_15 = ListItem(List=sort_11.ValuesA, Index=0, Wrap=True)
arrpolar_3 = PolarArray(Geometry=item_15, Plane=pt_3, Count=number_slider_3, Angle=6.283185307)  # -> Geometry, Transform
join_3 = BrepJoin(Breps=arrpolar_3.Geometry)  # -> Breps, Closed
cap_2 = CapHoles(Brep=join_3.Breps)
panel_7 = Panel(cap_2)
previewmat = CustomPreviewMaterials(Geometry=cap_2, DiffuseColor=RGB(255, 255, 255))
