# Grasshopper definition 35_Applying Fillet Edge to a Given Brep.gh (Grasshopper 1.0.7)
# plug-ins: Human

brep = Brep(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)
# 3 Level - 28
brep_2 = Brep(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)

debrep = DeconstructBrep(Brep=brep)  # -> Faces, Edges, Vertices
midpt = CurveMiddle(Curve=debrep.Edges)
# 가운데 엣지만 골라내기
lng = ListLength(List=debrep.Faces)
avr = Average(Input=midpt)
cps = ClosestPoints(Point=avr, Cloud=midpt, Count=expr("x + 1", lng))  # -> ClosestPoint, CPIndex, Distance

edges = BrepEdges(Brep=brep_2)  # -> Naked, Interior, NonManifold
debrep_2 = DeconstructBrep(Brep=brep_2)  # -> Faces, Edges, Vertices
brep_3 = Brep(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)
brep_4 = Brep(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)
midpt_2 = CurveMiddle(Curve=edges.Interior)
simplify = SimplifyCurve(Curve=debrep_2.Edges, Tolerance=Slider(0, range=0..10))  # -> Curve, Simplified
edges_2 = BrepEdges(Brep=brep_4)  # -> Naked, Interior, NonManifold
debrep_3 = DeconstructBrep(Brep=brep_3)  # -> Faces, Edges, Vertices
debrep_4 = DeconstructBrep(Brep=brep_3)  # -> Faces, Edges, Vertices
fit = FitCurve(Curve=simplify.Curve, Degree=Slider(1, range=0..1))
Y = UnitY(Factor=1)
cset = CreateSet(List=midpt_2)  # -> Set, Map
number_slider = Slider(0.001, range=0..0.001)
midpt_3 = CurveMiddle(Curve=edges_2.Interior)
midpt_4 = CurveMiddle(Curve=simplify.Curve)
reb = RebuildCurve(Curve=fit, Count=10, Tangents=False)
edges_3 = BrepEdges(Brep=debrep_3.Faces)  # -> Naked, Interior, NonManifold
number_slider_2 = Slider(0, range=0..10)
vec = Vector(debrep_4.Edges)
Y_2 = UnitY(Factor=1)
number_slider_3 = Slider(2, range=0..10)
sort = SortList(Keys=midpt_3, ValuesA=edges_2.Interior)  # -> Keys, ValuesA
dprod = DotProduct(VectorA=vec, VectorB=Y, Unitize=False)
vec_2 = Vector(edges_3.Naked)
mindex = MemberIndex(Set=midpt_4, Member=cset.Set)  # -> flatten(Index), Count
item = ListItem(List=sort.ValuesA, Index="-1", Wrap=True)
dprod_2 = DotProduct(VectorA=vec_2, VectorB=Y_2, Unitize=False)
abs = Absolute(Value=dprod)
filedge = FilletEdge(Shape=brep_2, Blend=2, Metric=0, Edges=mindex.Index)

item_2 = ListItem(List=debrep.Edges, Index=cps.CPIndex, Wrap=True)
midpt_5 = CurveMiddle(Curve=item_2)
bbox = BoundingBox(Content=midpt_5, Plane=PlaneXY(0, 0, 0), UnionBox=True)  # -> Box, Box_2
debrep_5 = DeconstructBrep(Brep=bbox.Box)  # -> Faces, Edges, Vertices
area = Area(Geometry=debrep_5.Faces)  # -> Area, Centroid
# 정렬하고 로프트 시키기
sort_2 = SortList(Keys=area.Area, ValuesA=debrep_5.Faces)  # -> Keys, reverse(ValuesA)
avr_2 = Average(Input=midpt_5)
item_3 = ListItem(List=sort_2.ValuesA, Index=0, Wrap=True)
pln = Plane(item_3)
pl_origin = PlaneOrigin(Base=pln, Origin=avr_2)
cir = Circle(Plane=pl_origin, Radius=1)
alongcrv = SortAlongCurve(Points=midpt_5, Curve=cir)  # -> Points, Indices
item_4 = ListItem(List=item_2, Index=alongcrv.Indices, Wrap=True)
loft = Loft(Curves=item_4, Options={Adjust=True, Closed=True, LoftEnds=0, LoftSimp=0, LoftType=3, Rebuild=10, Refit=0.01})

abs_2 = Absolute(Value=dprod_2)
larger = LargerThan(FirstNumber=abs, SecondNumber="0.5")  # -> LargerThan, OrEqualTo
ext = ExtendCurve(Curve=item, Type=0, Start=item, End=item)
larger_2 = LargerThan(FirstNumber=abs_2, SecondNumber="0.5")  # -> LargerThan, OrEqualTo
cull = CullPattern(List=debrep_4.Edges, CullPattern=larger.LargerThan)
pipe = Pipe(Curve=ext, Radius=Slider(5.3, range=0..50), Caps=0)
midpt_6 = CurveMiddle(Curve=cull)
cull_2 = CullPattern(List=edges_3.Naked, CullPattern=larger_2.LargerThan)
splitmul = SplitBrepMultiple(Brep=brep_4, Cutters=pipe)
fcircle = CircleFit(Points=midpt_6)  # -> Circle, Radius, Deviation
loft_2 = Loft(Curves=cull_2, Options={Adjust=True, Closed=False, LoftEnds=0, LoftSimp=0, LoftType=0, Rebuild=10, Refit=0.01})  # -> flatten(Loft)
offset = OffsetSurface(Surface=pipe, Distance="1", Retrim=True)
colom = CollisionOneMany(Collider=splitmul, Obstacles=item)  # -> Collision, Index
eval = EvaluateLength(Curve=fcircle.Circle, Length=Slider(0.64, range=0..1), Normalized=True)  # -> Point, Tangent, Parameter
join = BrepJoin(Breps=loft_2)  # -> Breps, Closed
cull_3 = CullPattern(List=splitmul, CullPattern=invert(colom.Collision))
seam = Seam(Curve=fcircle.Circle, Seam=eval.Parameter)
edges_4 = BrepEdges(Brep=join.Breps)  # -> Naked, Interior, NonManifold
edges_5 = BrepEdges(Brep=cull_3)  # -> flatten(Naked), Interior, NonManifold
midpt_7 = CurveMiddle(Curve=edges_4.Interior)
alongcrv_2 = SortAlongCurve(Points=midpt_6, Curve=seam)  # -> Points, Indices
debrep_6 = DeconstructBrep(Brep=join.Breps)  # -> Faces, Edges, Vertices
colom_2 = CollisionOneMany(Collider=edges_5.Naked, Obstacles=offset)  # -> Collision, Index
sort_3 = SortList(Keys=midpt_7, ValuesA=edges_4.Interior)  # -> Keys, ValuesA
item_5 = ListItem(List=cull, Index=alongcrv_2.Indices, Wrap=True)
midpt_8 = CurveMiddle(Curve=debrep_6.Edges)
cull_4 = CullPattern(List=edges_5.Naked, CullPattern=colom_2.Collision)
item_6 = ListItem(List=sort_3.ValuesA, Index="-1", Wrap=True)
loft_3 = Loft(Curves=item_5, Options={Adjust=True, Closed=False, LoftEnds=0, LoftSimp=0, LoftType=3, Rebuild=10, Refit=0.01})
partition = PartitionList(List=cull_4, Size="2")
crv_cp = CurveClosestPoint(Point=midpt_8, Curve=item_6)  # -> Point, Parameter, Distance
bool = Boolean(crv_cp.Distance)
flip = FlipMatrix(Data=partition)
cull_5 = CullPattern(List=debrep_6.Edges, CullPattern=invert(bool))
item_7 = ListItem(List=flip, Index=0, Wrap=True)  # -> Item, Item1
index = ItemIndex(List=debrep_6.Edges, Item=cull_5)
blendc = BlendCurve(CurveA=item_7.Item, CurveB=item_7.Item1, BulgeA="0.5", BulgeB="0.5", Continuity=1)  # -> flatten(Blend)
filedge_2 = FilletEdge(Shape=join.Breps, Blend=0, Metric=0, Edges=index, Radii=Slider(8.1, range=0..10))
loft_4 = Loft(Curves=blendc, Options={Adjust=False, Closed=False, LoftEnds=0, LoftSimp=0, LoftType=0, Rebuild=10, Refit=0.01})
previewmat = CustomPreviewMaterials(Geometry=filedge_2, DiffuseColor=RGB(255, 255, 255))
join_2 = BrepJoin(Breps=flatten([cull_3, loft_4]))  # -> Breps, Closed

debrep_7 = DeconstructBrep(Brep=loft)  # -> Faces, Edges, Vertices
# 필요 없는 거 빼기
area_2 = Area(Geometry=debrep_7.Faces)  # -> Area, Centroid
sort_4 = SortList(Keys=area_2.Area, ValuesA=debrep_7.Faces)  # -> Keys, ValuesA
cull_i = CullIndex(List=sort_4.ValuesA, Indices="0", Wrap=True)
join_3 = BrepJoin(Breps=cull_i)  # -> Breps, Closed

previewmat_2 = CustomPreviewMaterials(Geometry=join_2.Breps, DiffuseColor=RGB(255, 255, 255))
brep_5 = Brep(join_3.Breps)
edges_6 = BrepEdges(Brep=brep_5)  # -> Naked, Interior, NonManifold
debrep_8 = DeconstructBrep(Brep=brep_5)  # -> Faces, Edges, Vertices
midpt_9 = CurveMiddle(Curve=edges_6.Interior)
midpt_10 = CurveMiddle(Curve=debrep_8.Edges)
cset_2 = CreateSet(List=midpt_9)  # -> Set, Map
mindex_2 = MemberIndex(Set=midpt_10, Member=cset_2.Set)  # -> flatten(Index), Count
item_8 = ListItem(List=mindex_2.Index, Index=Slider(1, range=0..3), Wrap=True)
filedge_3 = FilletEdge(Shape=brep_5, Blend=2, Metric=0, Edges=item_8, Radii=Slider(10, range=0..10))
