# Grasshopper definition 36_Creating the Intersection Area of Given Rectangles.gh (Grasshopper 1.0.7)
# plug-ins: Human, Kangaroo2 Components, Anemone

crv = Curve([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])
# 4 Level - 03
crv_2 = Curve([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])
crv_3 = Curve([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])
crv_4 = Curve([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])
crv_5 = Curve([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])
toggle = BooleanToggle(False)
crv_6 = Curve([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])
crv_7 = Curve([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])
bbox = BoundingBox(Content=crv, Plane=PlaneXY(0, 0, 0), UnionBox=True)  # -> Box, Box_2
crv_8 = Curve([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])
boundary = BoundarySurfaces(Edges=crv_3)
runion = RegionUnion(Curves=crv)
disc = Discontinuity(Curve=crv_4, Level=1)  # -> flatten(Points), Parameters
mcx = MultipleCurves(Curves=crv_4)  # -> Points, IndexA, IndexB, ParamA, ParamB
lng = ListLength(List=crv_6)
lng_2 = ListLength(List=crv_8)
area = Area(Geometry=bbox.Box)  # -> Area, Centroid
bbox_2 = BoundingBox(Content=crv_7, Plane=PlaneXY(0, 0, 0), UnionBox=True)  # -> Box, Box_2
boundary_2 = BoundarySurfaces(Edges=crv_8)
rint = RegionIntersection(CurvesA=crv_2, CurvesB=graft(crv_2))  # -> flatten(Result)
brep = Brep(boundary)
incurve = PointInCurve(Point=disc.Points, Curve=graft(crv_4))  # -> Relationship, Point
bcx = BrepCurve(Brep=crv_5, Curve=graft(crv_5))  # -> flatten(Curves), Points
series = Series(Start=0, Step=1, Count=lng_2)  # -> graft(Series)
scale = Scale(Geometry=bbox.Box, Center=area.Centroid, Factor="1.1")  # -> Geometry, Transform
loop_start = LoopStart(N=lng, T=toggle, D0=crv_6)  # -> port, Counter, Data, Data_2
srfsplit = SurfaceSplit(Surface=bbox_2.Box, Curves=crv_7)
trim = TrimWithBreps(Curve=crv_3, Brep=brep)  # -> Inside, Outside
area_2 = Area(Geometry=crv_2)  # -> Area, Centroid
area_3 = Area(Geometry=rint)  # -> Area, Centroid
expression = Expression(x=incurve.Relationship, Expression="If(x = 2, true, false)")
rec = Rectangle(scale.Geometry)
srfsplit_2 = SurfaceSplit(Surface=scale.Geometry, Curves=crv)
cull_i = CullIndex(List=crv_8, Indices=series, Wrap=True)
midpt = CurveMiddle(Curve=bcx.Curves)
item = ListItem(List=loop_start.Data, Index=loop_start.Counter, Wrap=True)
cull_i_2 = CullIndex(List=loop_start.Data, Indices=loop_start.Counter, Wrap=True)
area_4 = Area(Geometry=srfsplit)  # -> Area, Centroid
crv_9 = Curve(rec)
exdiff = SetDifferenceS(SetA=area_2.Centroid, SetB=area_3.Centroid)
rint_2 = RegionIntersection(CurvesA=cull_i, CurvesB=graft(crv_8))  # -> flatten(Result)
incurve_2 = PointInCurve(Point=midpt, Curve=graft(crv_5))  # -> Relationship, Point
colom = CollisionOneMany(Collider=srfsplit_2, Obstacles=crv_9)  # -> Collision, Index
rint_3 = RegionIntersection(CurvesA=cull_i_2, CurvesB=item)
incurve_3 = PointInCurve(Point=area_4.Centroid, Curve=graft(crv_7))  # -> Relationship, Point
mindex = MemberIndex(Set=area_3.Centroid, Member=exdiff)  # -> Index, Count
area_5 = Area(Geometry=rint_2)  # -> Area, Centroid
cull = CullPattern(List=srfsplit_2, CullPattern=invert(colom.Collision))
expression_2 = Expression(x=incurve_2.Relationship, Expression="If(x = 2, true, false)")
cull_2 = CullPattern(List=disc.Points, CullPattern=expression)
cullpt = CullDuplicates(Points=area_5.Centroid, Tolerance=0.1, CullMode=1)  # -> Points, Indices, Valence
viewer = ParamViewer(srfsplit)
flip = FlipMatrix(Data=incurve_3.Relationship)
loop_end = LoopEnd(
    port=loop_start.port,
    Exit=toggle,
    Data=cull_i_2,
    Data_2=rint_3,
    TimeOutVal=0,
    pausedState=False,
    state="Constant & Record")  # -> D0, flatten(D1)
item_2 = ListItem(List=rint, Index=mindex.Index, Wrap=True)
edges = BrepEdges(Brep=cull)  # -> Naked, Interior, NonManifold
panel = Panel(cull_2)
item_3 = ListItem(List=rint_2, Index=cullpt.Indices, Wrap=True)
ma = MassAddition(Input=flip)  # -> flatten(Result), PartialResults
cull_i_3 = CullIndex(List=item_2, Indices="0", Wrap=True)  # -> flatten(List)
midpt_2 = CurveMiddle(Curve=edges.Naked)
crv_10 = Curve(loop_end.D1)
boundary_3 = BoundarySurfaces(Edges=item_3)
boundary_4 = BoundarySurfaces(Edges=crv_10)
expression_3 = Expression(x=ma.Result, Expression="If(x > 2, true, false)")
pull = PullPoint(Point=midpt_2, Geometry=runion, ClosestOnly=True)  # -> ClosestPoint, Distance
boundary_5 = BoundarySurfaces(Edges=cull_i_3)
explode = Explode(Curve=crv_5, Recursive=True)  # -> flatten(Segments), Vertices
cull_3 = CullPattern(List=bcx.Curves, CullPattern=expression_2)  # -> flatten(List)
bool = Boolean(pull.Distance)
previewmat = CustomPreviewMaterials(Geometry=boundary_4, DiffuseColor=ColourSwatch(SwatchColor=RGB(125, 125, 125)))
cull_4 = CullPattern(List=edges.Naked, CullPattern=bool)  # -> flatten(List)
previewmat_2 = CustomPreviewMaterials(Geometry=boundary_5, DiffuseColor=RGB(255, 255, 255))
midpt_3 = CurveMiddle(Curve=cull_3)
midpt_4 = CurveMiddle(Curve=explode.Segments)
explode_2 = Explode(Curve=cull_4, Recursive=True)  # -> flatten(Segments), Vertices
panel_2 = Panel(expression_3)
difference = SetDifference(SetA=midpt_3, SetB=midpt_4)
cull_5 = CullPattern(List=srfsplit, CullPattern=expression_3)
dupln = RemoveDuplicateLines(Lines=explode_2.Segments, Tolerance=0.01)
mindex_2 = MemberIndex(Set=midpt_3, Member=difference)  # -> flatten(Index), Count
join = JoinCurves(Curves=dupln, Preserve=False)
item_4 = ListItem(List=cull_3, Index=mindex_2.Index, Wrap=True)
boundary_6 = BoundarySurfaces(Edges=join)
join_2 = JoinCurves(Curves=item_4, Preserve=False)
boundary_7 = BoundarySurfaces(Edges=join_2)
