# Grasshopper definition 37_Arranging semi-circular surfaces around a circle.gh (Grasshopper 1.0.7)

crv = Curve(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)
srf = Surface(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)
srf_2 = Surface(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)
crv_2 = Curve(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)
srf_3 = Surface(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)
crv_3 = Curve(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)
edges = BrepEdges(Brep=srf_2)  # -> Naked, Interior, NonManifold
# 4 Level - 04
edges_2 = BrepEdges(Brep=srf)  # -> Naked, Interior, NonManifold
edges_3 = BrepEdges(Brep=srf_3)  # -> Naked, Interior, NonManifold
hframes = HorizontalFrames(Curve=crv_2, Count=Slider(12, range=0..100))  # -> Frames, Parameters
hframes_2 = HorizontalFrames(Curve=crv_3, Count=Slider(12, range=0..100))  # -> Frames, Parameters
hframes_3 = HorizontalFrames(Curve=crv, Count=Slider(12, range=0..100))  # -> Frames, Parameters
item = ListItem(List=edges.Naked, Index=0, Wrap=True)
item_2 = ListItem(List=edges_2.Naked, Index=0, Wrap=True)
item_3 = ListItem(List=edges_3.Naked, Index=0, Wrap=True)
vec = Vector(item_2)
len = Length(Curve=item)
len_2 = Length(Curve=item_3)
midpt = CurveMiddle(Curve=item_2)
arc = Arc(Plane=hframes.Frames, Radius=len, Angle="0.2*pi")  # -> Arc, Length
arc_2 = Arc(Plane=hframes_2.Frames, Radius=len_2, Angle="0.2*pi")  # -> Arc, Length
pl = ConstructPlane(Origin=midpt, XAxis=vec, YAxis=Vector(0, 1, 0))
ccx = CurveCurve(CurveA=crv_2, CurveB=arc.Arc)  # -> flatten(Points), ParamsA, ParamsB
ccx_2 = CurveCurve(CurveA=crv_3, CurveB=arc_2.Arc)  # -> flatten(Points), ParamsA, ParamsB
orient = Orient(Geometry=srf, Source=pl, Target=hframes_3.Frames)  # -> Geometry, Transform
debrep = DeconstructBrep(Brep=orient.Geometry)  # -> Faces, Edges, Vertices
vec2pt = Vector2Pt(PointA=hframes.Frames, PointB=ccx.Points, Unitize=False)  # -> Vector, Length
deplane = DeconstructPlane(Plane=hframes.Frames)  # -> Origin, XAxis, YAxis, ZAxis
vec2pt_2 = Vector2Pt(PointA=hframes_2.Frames, PointB=ccx_2.Points, Unitize=False)  # -> Vector, Length
deplane_2 = DeconstructPlane(Plane=hframes_3.Frames)  # -> Origin, XAxis, YAxis, ZAxis
hframe = HorizontalFrame(Curve=reparameterize(item_3), Parameter="0")
pull = PullPoint(Point=debrep.Vertices, Geometry=crv, ClosestOnly=True)  # -> ClosestPoint, flatten(Distance)
align = AlignPlane(Plane=hframes_2.Frames, Direction=vec2pt_2.Vector)  # -> Plane, Angle
hframe_2 = HorizontalFrame(Curve=reparameterize(item), Parameter="0")
pl_2 = ConstructPlane(Origin=hframes.Frames, XAxis=vec2pt.Vector, YAxis=deplane.YAxis)
item_4 = ListItem(List=pull.Distance, Index=0, Wrap=True)
orient_2 = Orient(Geometry=srf_3, Source=hframe, Target=align.Plane)  # -> Geometry, Transform
orient_3 = Orient(Geometry=srf_2, Source=hframe_2, Target=pl_2)  # -> Geometry, Transform
amp = Amplitude(Vector=deplane_2.YAxis, Amplitude=item_4)
move = Move(Geometry=orient.Geometry, Motion=amp)  # -> Geometry, Transform
