# Grasshopper definition 38_Arranging rectangles (7 pieces) on the XY plane.gh (Grasshopper 1.0.7)

srf = Surface([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])
srf_2 = Surface([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])
xy = XYPlane(Origin=Point(0, 0, 0))
area = Area(Geometry=srf)  # -> Area, Centroid
explode = Explode(Curve=srf, Recursive=True)  # -> Segments, Vertices
explode_2 = Explode(Curve=srf_2, Recursive=True)  # -> Segments, Vertices
points = PointList(Points=area.Centroid)
fline = FitLine(Points=area.Centroid)
midpt = CurveMiddle(Curve=explode_2.Segments)
pull = PullPoint(Point=xy, Geometry=explode.Vertices, ClosestOnly=False)  # -> ClosestPoint, Distance
vec = Vector(explode.Segments)
pdecon = Deconstruct(Point=midpt)  # -> XComponent, YComponent, ZComponent
unit = UnitVector(Vector=fline)
dprod = DotProduct(VectorA=unit, VectorB=vec, Unitize=False)
sort = SortList(Keys=pull.Distance, ValuesA=pull.ClosestPoint)  # -> Keys, ValuesA
sort_2 = SortList(Keys=pdecon.YComponent, ValuesA=explode_2.Segments)  # -> Keys, ValuesA
item = ListItem(List=sort_2.ValuesA, Index=0, Wrap=True)
item_2 = ListItem(List=sort.ValuesA, Index=0, Wrap=True)
abs = Absolute(Value=dprod)
len = Length(Curve=item)  # -> flatten(Length)
flip = FlipCurve(Curve=item)  # -> Curve, Flag
larger = LargerThan(FirstNumber=abs, SecondNumber=Slider(0.87, range=0..1))  # -> LargerThan, OrEqualTo
addition = Addition(A=len, B=Slider(1, range=0..5))
srf_3 = Surface(srf)
hframe = HorizontalFrame(Curve=reparameterize(flip.Curve), Parameter="0")  # -> flatten(Frame)
cull = CullPattern(List=explode.Segments, CullPattern=larger.LargerThan)
ma = MassAddition(Input=addition)  # -> Result, PartialResults
item_3 = ListItem(List=flatten(cull), Index=Slider(1, range=0..1), Wrap=True)
ins = InsertItems(List=ma.PartialResults, Item="0", Indices="0", Wrap=True)
pt = ConstructPoint(XCoordinate=ins, YCoordinate=0, ZCoordinate=0)
flip_2 = FlipCurve(Curve=cull, Guide=item_3)  # -> Curve, Flag
midpt_2 = CurveMiddle(Curve=flip_2.Curve)
cull_i = CullIndex(List=pt, Indices="-1", Wrap=True)
pdecon_2 = Deconstruct(Point=midpt_2)  # -> XComponent, YComponent, ZComponent
orient = Orient(Geometry=srf_2, Source=hframe, Target=cull_i)  # -> Geometry, Transform
sort_3 = SortList(Keys=pdecon_2.YComponent, ValuesA=flip_2.Curve)  # -> Keys, ValuesA
item_4 = ListItem(List=sort_3.ValuesA, Index=0, Wrap=True)
pl = ConstructPlane(Origin=item_2, XAxis=item_4, YAxis=Vector(0, 1, 0))
len_2 = Length(Curve=item_4)
xy_2 = XYPlane(Origin=Point(0, 0, 0))
addition_2 = Addition(A=len_2, B="1")
orient_2 = Orient(Geometry=graft(srf_3), Source=pl, Target=xy_2)  # -> Geometry, Transform
ma_2 = MassAddition(Input=flatten(addition_2))  # -> Result, PartialResults
merge = Merge(Data1="0", Data2=ma_2.PartialResults)
cull_i_2 = CullIndex(List=merge, Indices="-1", Wrap=True)
X = UnitX(Factor=cull_i_2)
move = Move(Geometry=orient_2.Geometry, Motion=graft(X))  # -> Geometry, Transform
