# Grasshopper definition 39_Creating lines that divide the perimeter and interior of a given rectangle.gh (Grasshopper 1.0.7)

# 4 Level - 06
srf = Surface([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])
srf_2 = Surface([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])
area = Area(Geometry=srf)  # -> Area, Centroid
srf_3 = Surface([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])
area_2 = Area(Geometry=srf_2)  # -> Area, Centroid
bbox = BoundingBox(Content=srf_3, Plane=PlaneXY(0, 0, 0), UnionBox=True)  # -> Box, Box_2
explode = Explode(Curve=srf_3, Recursive=True)  # -> Segments, Vertices
avr = Average(Input=area.Centroid)
bbox_2 = BoundingBox(Content=area_2.Centroid, Plane=PlaneXY(0, 0, 0), UnionBox=True)  # -> Box, Box_2
rec = Rectangle(bbox.Box)
midpt = CurveMiddle(Curve=explode.Segments)
cir = Circle(Plane=avr, Radius=1)
crv = Curve(srf_2)
rec_2 = Rectangle(bbox_2.Box)
area_3 = Area(Geometry=rec)  # -> Area, Centroid
panel = Panel("""1
-1""")
avr_2 = Average(Input=flatten(midpt))
trim = TrimWithRegions(Curve=rec_2, Regions=crv)  # -> Inside, flatten(Outside)
alongcrv = SortAlongCurve(Points=area.Centroid, Curve=cir)  # -> Points, Indices
pull = PullCurve()
scale = Scale(Geometry=rec, Center=area_3.Centroid, Factor="1.1")  # -> Geometry, Transform
item = ListItem(List=srf, Index=alongcrv.Indices, Wrap=True)
len = Length(Curve=trim.Outside)
cps = ClosestPoints(Point=avr_2, Cloud=midpt, Count="2")  # -> ClosestPoint, CPIndex, Distance
shift = ShiftList(List=item, Shift=graft(panel), Wrap=True)
disc = Discontinuity(Curve=item, Level=1)  # -> Points, Parameters
sort = SortList(Keys=len)  # -> reverse(Keys), ValuesA
flip = FlipMatrix(Data=shift)
number_slider = Slider(4.47, range=0..10)
cull_i = CullIndex(List=explode.Segments, Indices=cps.CPIndex, Wrap=True)
item_2 = ListItem(List=sort.Keys, Index=0, Wrap=True)
item_3 = ListItem(List=explode.Segments, Index=cps.CPIndex, Wrap=True)
pull_2 = PullPoint(Point=disc.Points, Geometry=flip, ClosestOnly=False)  # -> ClosestPoint, Distance
expression = Expression(x=item_2, Expression="x/2")
join = JoinCurves(Curves=cull_i, Preserve=False)  # -> flatten(Curves)
pshift = ShiftPaths(Data=pull_2.ClosestPoint, Offset=-1)
offset = OffsetCurve(Curve=crv, Distance=expression, Corners=1)  # -> flatten(Curve)
ext = ExtendCurve(Curve=join, Type=0, Start=number_slider, End=number_slider)
cullpt = CullDuplicates(Points=pshift, Tolerance=0.1, CullMode=1)  # -> flatten(Points), Indices, Valence
crv_2 = Curve(srf_3)
runion = RegionUnion(Curves=offset)
explode_2 = Explode(Curve=crv, Recursive=True)  # -> Segments, Vertices
srfsplit = SurfaceSplit(Surface=scale.Geometry, Curves=flatten([ext, crv_2]))
avr_3 = Average(Input=cullpt.Points)
area_4 = Area(Geometry=cullpt.Points)  # -> Area, Centroid
offset_2 = OffsetCurve(Curve=runion, Distance=expr("-x", expression), Corners=1)  # -> flatten(Curve)
midpt_2 = CurveMiddle(Curve=explode_2.Segments)
area_5 = Area(Geometry=srfsplit)  # -> Area, Centroid
cir_2 = Circle(Plane=avr_3, Radius=1)
crv_cp = CurveClosestPoint(Point=midpt_2, Curve=offset_2)  # -> Point, Parameter, Distance
alongcrv_2 = SortAlongCurve(Points=cullpt.Points, Curve=cir_2)  # -> Points, Indices
cp = ClosestPoint(Point=area_3.Centroid, Cloud=area_5.Centroid)  # -> ClosestPoint, CPIndex, Distance
bool = Boolean(crv_cp.Distance)
item_4 = ListItem(List=cullpt.Points, Index=alongcrv_2.Indices, Wrap=True)
cull = CullPattern(List=explode_2.Segments, CullPattern=bool)  # -> flatten(List)
cull_i_2 = CullIndex(List=srfsplit, Indices=cp.CPIndex, Wrap=True)
midpt_3 = CurveMiddle(Curve=cull)
join_2 = BrepJoin(Breps=cull_i_2)  # -> Breps, Closed
alongcrv_3 = SortAlongCurve()  # -> Points, Indices
pline = PolyLine(Vertices=item_4, Closed=invert(False))
edges = BrepEdges(Brep=join_2.Breps)  # -> Naked, Interior, NonManifold
avr_4 = Average(Input=midpt_3)
avr_5 = Average(Input=midpt_3)
avr_6 = Average(Input=midpt_3)
xy = XYPlane(Origin=avr_4)
panel_2 = Panel(cullpt.Points)
join_3 = JoinCurves(Curves=edges.Naked, Preserve=False)
cir_3 = Circle(Plane=avr_5, Radius=1)
cir_4 = Circle(Plane=avr_6, Radius=1)
prot = RotatePlane(Plane=xy, Angle="0.25*pi")
seam = Seam(Curve=reparameterize(cir_3), Seam="0.12")
cir_5 = Circle(Plane=prot, Radius=1)
alongcrv_4 = SortAlongCurve(Points=midpt_3, Curve=cir_4)  # -> Points, Indices
end = EndPoints(Curve=seam)  # -> Start, End
alongcrv_5 = SortAlongCurve(Points=midpt_3, Curve=cir_5)  # -> Points, Indices
shift_2 = ShiftList(Shift=1, Wrap=True)
item_5 = ListItem(List=cull, Index=alongcrv_5.Indices, Wrap=True)
partition = PartitionList(List=item_5, Size="2")
item_6 = ListItem(List=partition, Index=0, Wrap=True)  # -> Item, Item1
flip_2 = FlipCurve(Curve=item_6.Item1)  # -> Curve, Flag
tweencrv = TweenCurve(CurveA=item_6.Item, CurveB=flip_2.Curve, Factor=0.5, BlendType=0)  # -> flatten(Tween)
number_slider_2 = Slider(0.5, range=0..1)
shift_3 = ShiftList(List=tweencrv, Shift=1, Wrap=True)
midpt_4 = CurveMiddle(Curve=tweencrv)
llx = LineLine(Line1=tweencrv, Line2=shift_3)  # -> ParamA, ParamB, PointA, PointB
end_2 = EndPoints(Curve=tweencrv)  # -> Start, End
points = PointList(Points=midpt_4, Size=0.5)
pt = Point(end_2.End)
dist = Distance(PointA=pt, PointB=llx.PointA)
rdiff = RegionDifference()
sdiff = SolidDifference()
ext_2 = ExtendCurve(Curve=tweencrv, Type=0, Start="0", End=dist)
runion_2 = RegionUnion()
sunion = SolidUnion()
trim_2 = TrimWithRegion(Curve=ext_2, Region=offset_2)  # -> Inside, Outside
rint = RegionIntersection()
sint = SolidIntersection()
crv_3 = Curve(trim_2.Inside)
