# Grasshopper definition 3Level-10.gh (Grasshopper 1.0.7)

# 3 Level - 10
crv = Curve([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])
midpt = CurveMiddle(Curve=crv)
avr = Average(Input=midpt)
cir = Circle(Plane=avr, Radius=1)
alongcrv = SortAlongCurve(Points=midpt, Curve=cir)  # -> Points, Indices
item = ListItem(List=crv, Index=alongcrv.Indices, Wrap=True)
loft = Loft(Curves=item, Options={Adjust=True, Closed=True, LoftEnds=0, LoftSimp=1, LoftType=0, Rebuild=10, Refit=0.01})
