# Grasshopper definition 3Level-11.gh (Grasshopper 1.0.7)

crv = Curve(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)
crv_2 = Curve(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)
explode = Explode(Curve=crv_2, Recursive=True)  # -> Segments, Vertices
planar = IsPlanar(Surface=crv, Interior=True)  # -> Planar, Plane
len = Length(Curve=explode.Segments)
panel = Panel("왜 안될까..?")
bbox = BoundingBox(Content=crv, Plane=planar.Plane, UnionBox=True)  # -> Box, Box_2
sort = SortList(Keys=len, ValuesA=explode.Segments)  # -> Keys, reverse(ValuesA)
debrep = DeconstructBrep(Brep=bbox.Box)  # -> Faces, Edges, Vertices
item = ListItem(List=sort.ValuesA, Index=0, Wrap=True)
explode_2 = Explode(Curve=debrep.Edges, Recursive=True)  # -> flatten(Segments), Vertices
pframes = PerpFrames(Curve=item, Count=Slider(43, range=0..100), Align=True)  # -> Frames, Parameters
crv_cp = CurveClosestPoint(Point=explode.Vertices, Curve=item)  # -> Point, Parameter, Distance
len_2 = Length(Curve=explode_2.Segments)
sort_2 = SortList(Keys=len_2, ValuesA=explode_2.Segments)  # -> Keys, reverse(ValuesA)
panel_2 = Panel("""0
1""")
sort_3 = SortList(Keys=crv_cp.Distance)  # -> reverse(Keys), ValuesA
pln = Plane(pframes.Frames)
item_2 = ListItem(List=sort_3.Keys, Index=0, Wrap=True)
item_3 = ListItem(List=sort_2.ValuesA, Index=panel_2, Wrap=True)
deplane = DeconstructPlane(Plane=pln)  # -> Origin, XAxis, YAxis, ZAxis
item_4 = ListItem(List=item_3, Index=0, Wrap=True)
line = LineSDL(Start=pframes.Frames, Direction=deplane.XAxis, Length=item_2)
flip = FlipCurve(Curve=item_3, Guide=item_4)  # -> Curve, Flag
divide = DivideCurve(Curve=flip.Curve, Count=Slider(33, range=0..100), Kinks=False)  # -> Points, Tangents, Parameters
flip_2 = FlipMatrix(Data=divide.Points)
project = Project(Curve=line, Brep=crv_2, Direction=Vector(0, 0, 1))
item_5 = ListItem(List=flip_2, Index=0, Wrap=True)  # -> Item, Item1
ln = Line(StartPoint=item_5.Item, EndPoint=item_5.Item1)
project_2 = Project(Curve=ln, Brep=crv, Direction=Vector(0, 0, 1))
