# Grasshopper definition 3Level-12.gh (Grasshopper 1.0.7)
# plug-ins: LunchBox

# 3 Level - 12
number_slider = Slider(20, range=0..20)
number_slider_2 = Slider(16, range=0..20)
srf = Surface(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)
srf_2 = Surface(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)
quads = QuadPanels(Surface=srf, UDivisions=number_slider, VDivisions=number_slider)
quads_2 = QuadPanels(Surface=srf_2, UDivisions=number_slider_2, VDivisions=number_slider_2)
python = GhPythonScript(Panels=quads, U=number_slider, V=number_slider)  # -> out, DT; inputs Panels: list of Surface, U: Int32, V: Int32
# ---------- python: Python ----------
__author__ = "BaekInchan"
__version__ = "2024.02.11"

import rhinoscriptsyntax as rs
import ghpythonlib.treehelpers as th

T = [[], []]

for i in range(U) : 
    for j in range(V) : 
        if(i <= j) :
            T[0].append(Panels[i * V + j])
        else : 
            T[1].append(Panels[i * V + j])

DT = th.list_to_tree(T, none_and_holes = True)
# ---------- end python ----------
series = Series(Start=0, Step=1, Count=number_slider_2)
partition = PartitionList(List=quads_2, Size=number_slider_2)
tstat = TreeStatistics(Tree=python.DT)  # -> Paths, Length, Count
smaller = SmallerThan(FirstNumber=series, SecondNumber=graft(series))  # -> SmallerThan, OrEqualTo
dispatch = Dispatch(List=tstat.Paths, DispatchPattern=[True, False])  # -> ListA, ListB
cull = CullPattern(List=partition, CullPattern=smaller.SmallerThan)
cull_2 = CullPattern(List=partition, CullPattern=invert(smaller.SmallerThan))
branch = TreeBranch(Tree=python.DT, Path=dispatch.ListA, MaintainPaths=True)
branch_2 = TreeBranch(Tree=python.DT, Path=dispatch.ListB, MaintainPaths=True)
preview = CustomPreview(Geometry=cull, Material=ColourSwatch(SwatchColor=RGB(60, 189, 163)))
preview_2 = CustomPreview(Geometry=cull_2, Material=ColourSwatch(SwatchColor=RGB(177, 57, 163)))
preview_3 = CustomPreview(Geometry=branch, Material=ColourSwatch(SwatchColor=RGB(60, 189, 163)))
preview_4 = CustomPreview(Geometry=branch_2, Material=ColourSwatch(SwatchColor=RGB(177, 57, 163)))
