# Grasshopper definition 3Level-13.gh (Grasshopper 1.0.7)

number_slider = Slider(50, range=0..50)
# 3 Level - 13
xy = XYPlane(Origin=Point(0, 0, 0))
cir = Circle(Plane=xy, Radius=Slider(11, range=0..20))
range = Range(Domain=Domain(0, 1), Steps=expr("x / 2 - 1", number_slider))
divide = DivideCurve(Curve=cir, Count=number_slider, Kinks=False)  # -> Points, Tangents, Parameters
number_slider_2 = Slider(3, range=0..10)
graph = GraphMapper(range, x0=0, x1=1, y0=0, y1=1, Ox=0.4900729358, Oy=0, Px=0.75, Py=0.25, container_name="Parabola")
frame = CurveFrame(Curve=cir, Parameter=divide.Parameters)
dom = ConstructDomain(DomainStart=Slider(3, range=0..10), DomainEnd=Slider(1, range=0..10))
dispatch = Dispatch(List=frame, DispatchPattern=[True, False])  # -> ListA, ListB
dispatch_2 = Dispatch(List=divide.Points, DispatchPattern=[True, False])  # -> ListA, ListB
bnd = Bounds(Numbers=graph)
entwine = Entwine(Branch00=dispatch.ListA, Branch01=dispatch.ListB, FlattenInputs=True)
entwine_2 = Entwine(Branch00=dispatch_2.ListA, Branch01=dispatch_2.ListB, FlattenInputs=True)
remap = RemapNumbers(Value=graph, Source=bnd, Target=dom)  # -> Mapped, Clipped
neg = Negative(Value=remap.Mapped)
deplane = DeconstructPlane(Plane=entwine)  # -> Origin, XAxis, YAxis, ZAxis
entwine_3 = Entwine(Branch00=remap.Mapped, Branch01=neg, FlattenInputs=True)
amp = Amplitude(Vector=deplane.YAxis, Amplitude=expr("x / 2", entwine_3))
move = Move(Geometry=entwine_2, Motion=amp)  # -> flatten(Geometry), Transform
avr = Average(Input=move.Geometry)
cir_2 = Circle(Plane=avr, Radius=1)
alongcrv = SortAlongCurve(Points=move.Geometry, Curve=cir_2)  # -> Points, Indices
pline = PolyLine(Vertices=alongcrv.Points, Closed=invert(False))
