# Grasshopper definition 3Level-14.gh (Grasshopper 1.0.7)

# 3 Level - 14
mesh = Mesh(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)
bbox = BoundingBox(Content=mesh, Plane=PlaneXY(0, 0, 0))  # -> Box, Box_2
debrep = DeconstructBrep(Brep=bbox.Box)  # -> Faces, Edges, Vertices
area = Area(Geometry=debrep.Faces)  # -> Area, Centroid
pdecon = Deconstruct(Point=area.Centroid)  # -> XComponent, YComponent, ZComponent
number_slider = Slider(30, range=0..100)
sort = SortList(Keys=pdecon.ZComponent, ValuesA=debrep.Faces)  # -> Keys, ValuesA
item = ListItem(List=sort.ValuesA, Index=0, Wrap=True)
sdivide = DivideSurface(Surface=item, UCount=number_slider, VCount=number_slider)  # -> flatten(Points), Normals, Parameters
Z = UnitZ(Factor=1)
meshray = MeshRay(Mesh=mesh, Point=sdivide.Points, Direction=Z)  # -> Point, Hit
srfgrid = SurfaceFromPoints(Points=meshray.Point, UCount=expr("x + 1", number_slider), Interpolate=False)
