# Grasshopper definition 3Level-15.gh (Grasshopper 1.0.7)

# 3 Level - 15
srf = Surface(graft([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]))
srf_2 = Surface([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])
tstat = TreeStatistics(Tree=srf)  # -> Paths, Length, Count
srf_3 = Surface([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])
area = Area(Geometry=srf_3)  # -> Area, Centroid
area_2 = Area(Geometry=srf_2)  # -> Area, Centroid
series = Series(Start=0, Step=1, Count=tstat.Count)  # -> graft(Series)
fline = FitLine(Points=area.Centroid)
fline_2 = FitLine(Points=area_2.Centroid)
cull_i = CullIndex(List=tstat.Paths, Indices=series, Wrap=True)
item = ListItem(List=tstat.Paths, Index=series, Wrap=True)
alongcrv = SortAlongCurve(Points=area.Centroid, Curve=fline)  # -> Points, Indices
alongcrv_2 = SortAlongCurve(Points=area_2.Centroid, Curve=fline_2)  # -> Points, Indices
branch = TreeBranch(Tree=srf, Path=cull_i, MaintainPaths=True)
branch_2 = TreeBranch(Tree=srf, Path=item, MaintainPaths=True)
item_2 = ListItem(List=srf_3, Index=alongcrv.Indices, Wrap=True)
item_3 = ListItem(List=srf_2, Index=alongcrv_2.Indices, Wrap=True)
debrep = DeconstructBrep(Brep=branch)  # -> Faces, Edges, Vertices
debrep_2 = DeconstructBrep(Brep=branch_2)  # -> Faces, Edges, Vertices
explode = Explode(Curve=item_2, Recursive=True)  # -> Segments, Vertices
pshift = ShiftPaths(Data=debrep.Edges, Offset=-1)
midpt = CurveMiddle(Curve=debrep_2.Edges)
area_3 = Area(Geometry=branch_2)  # -> Area, Centroid
project = Project(Geometry=item_3, Plane=PlaneXY(0, 0, 0))  # -> Geometry, Transform
project_2 = Project(Geometry=explode.Segments, Plane=PlaneXY(0, 0, 0))  # -> Geometry, Transform
midpt_2 = CurveMiddle(Curve=pshift)
midpt_3 = CurveMiddle(Curve=project_2.Geometry)
cps = ClosestPoints(Point=midpt, Cloud=midpt_2, Count="2")  # -> ClosestPoint, CPIndex, Distance
explode_2 = Explode(Curve=item_3, Recursive=True)  # -> Segments, Vertices
area_4 = Area(Geometry=project.Geometry)  # -> Area, Centroid
explode_3 = Explode(Curve=project.Geometry, Recursive=True)  # -> Segments, Vertices
avr = Average(Input=midpt_3)  # -> flatten(ArithmeticMean)
item_4 = ListItem(List=cps.ClosestPoint, Index=cps.CPIndex, Wrap=True)
panel = Panel(midpt_2)
pline = PolyLine(Vertices=area_4.Centroid, Closed=False)
item_5 = ListItem(List=item_4, Index=0, Wrap=True)
pline_2 = PolyLine(Vertices=avr, Closed=False)
colom = CollisionOneMany(Collider=project_2.Geometry, Obstacles=pline_2)  # -> Collision, Index
colom_2 = CollisionOneMany(Collider=explode_3.Segments, Obstacles=pline)  # -> Collision, Index
cull = CullPattern(List=explode.Segments, CullPattern=colom.Collision)  # -> flatten(List)
cull_2 = CullPattern(List=explode_2.Segments, CullPattern=colom_2.Collision)  # -> flatten(List)
midpt_4 = CurveMiddle(Curve=cull)
midpt_5 = CurveMiddle(Curve=cull_2)
fline_3 = FitLine(Points=midpt_4)
fline_4 = FitLine(Points=midpt_5)
alongcrv_3 = SortAlongCurve(Points=midpt_4, Curve=fline_3)  # -> Points, Indices
alongcrv_4 = SortAlongCurve(Points=midpt_5, Curve=fline_4)  # -> Points, Indices
item_6 = ListItem(List=cull, Index=alongcrv_3.Indices, Wrap=True)
item_7 = ListItem(List=cull_2, Index=alongcrv_4.Indices, Wrap=True)
partition = PartitionList(List=item_6, Size="2")
partition_2 = PartitionList(List=item_7, Size="2")
srf_4 = Surface(srf_3)
srf_5 = Surface(srf_2)
loft = Loft(Curves=partition, Options={Adjust=True, Closed=False, LoftEnds=0, LoftSimp=0, LoftType=0, Rebuild=10, Refit=0.01})  # -> flatten(Loft)
loft_2 = Loft(Curves=partition_2, Options={Adjust=True, Closed=False, LoftEnds=0, LoftSimp=0, LoftType=0, Rebuild=10, Refit=0.01})  # -> flatten(Loft)
join = BrepJoin(Breps=[srf_4, loft])  # -> Breps, Closed
join_2 = BrepJoin(Breps=[srf_5, loft_2])  # -> Breps, Closed
panel_2 = Panel(join.Breps)
panel_3 = Panel(join_2.Breps)
