# Grasshopper definition 3Level-23.gh (Grasshopper 1.0.7)

# 3 Level - 23
brep = Brep(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)
debrep = DeconstructBrep(Brep=brep)  # -> Faces, Edges, Vertices
crv = Curve(debrep.Edges)
tmatch = MatchText(Text=crv, Pattern="Circular*", Case=True)
cull = CullPattern(List=crv, CullPattern=tmatch)
area = Area(Geometry=cull)  # -> Area, Centroid
pdecon = Deconstruct(Point=area.Centroid)  # -> XComponent, YComponent, ZComponent
lng = ListLength(List=cull)
division = Division(A=lng, B="2")
sort = SortList(Keys=reverse(pdecon.ZComponent), ValuesA=cull)  # -> Keys, ValuesA
item = ListItem(Index=0, Wrap=True)
split = SplitList(List=sort.ValuesA, Index=division)  # -> ListA, ListB
crv_2 = Curve(split.ListA)
panel = Panel(split.ListA)
