# Grasshopper definition 3Level-24.gh (Grasshopper 1.0.7)

# ---- group: Region Curve
crv = Curve(graft([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]))

# ---- group: Rectangle Cell
# 3 Level - 24
crv_2 = Curve([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])

# ----
crv_3 = Curve([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])
crv_4 = Curve(graft([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]))
crv_5 = Curve(graft([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]))
crv_6 = Curve([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])
area = Area(Geometry=crv_2)  # -> Area, Centroid
panel = Panel("Polyline Curve")
cls = Closed(Curve=crv_5)  # -> Closed, Periodic
brep = Brep(crv_5)
rint = RegionIntersection(CurvesA=crv_3, CurvesB=crv_4)
area_2 = Area(Geometry=crv_6)  # -> Area, Centroid
incurve = PointInCurve(Point=area.Centroid, Curve=crv)  # -> flatten(Relationship), Point
brepinc = PointInBrep(Brep=brep, Point=area_2.Centroid, Strict=invert(False))
minc = MeshInclusion(Strict=False)
tmatch = MatchText(Text=rint, Pattern="Polyline*", Case=True)
cset = CreateSet(List=incurve.Relationship)  # -> Set, Map
panel_2 = Panel("2")
mindex = MemberIndex(Set=incurve.Relationship, Member=cset.Set)  # -> Index, Count
cull = CullPattern(List=rint, CullPattern=tmatch)
item = ListItem(List=crv_2, Index=mindex.Index, Wrap=True)
crv_7 = Curve(graft([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]))
crv_8 = Curve([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])
bang = ExplodeTree(Data=item)  # -> Branch0, Branch1
bbx = BrepBrep(BrepA=crv_8, BrepB=crv_7)  # -> flatten(Curves), Points
crv_9 = Curve(bang.Branch1)
colom = CollisionOneMany(Collider=crv_9, Obstacles=flatten(crv))  # -> Collision, Index
tmatch_2 = MatchText(Text=bbx.Curves, Pattern="Polyline*", Case=True)
cull_2 = CullPattern(List=bbx.Curves, CullPattern=tmatch_2)
cull_3 = CullPattern(List=crv_9, CullPattern=invert(colom.Collision))
crv_10 = Curve(graft([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]))
crv_11 = Curve([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])
bbx_2 = BrepBrep(BrepA=crv_11, BrepB=crv_10)  # -> flatten(Curves), Points
colom_2 = CollisionOneMany(Collider=bbx_2.Curves, Obstacles=flatten(crv_10))  # -> Collision, Index
cull_4 = CullPattern(List=bbx_2.Curves, CullPattern=invert(colom_2.Collision))
