# Grasshopper definition 3Level-25.gh (Grasshopper 1.0.7)

crv = Curve([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])
# 3 Level - 25
crv_2 = Curve([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])
project = Project(Geometry=crv, Plane=PlaneXY(0, 0, 0))  # -> Geometry, Transform
project_2 = Project(Geometry=crv_2, Plane=PlaneXY(0, 0, 0))  # -> Geometry, Transform
shift = ShiftList(List=project.Geometry, Shift=1, Wrap=invert(True))
disc = Discontinuity(Curve=project_2.Geometry, Level=1)  # -> flatten(Points), Parameters
srf = Surface(project_2.Geometry)
srf_2 = Surface(project_2.Geometry)
short = ShortestList(ListA=project.Geometry, ListB=shift, TrimMode=2)  # -> ListA, ListB
disc_2 = Discontinuity(Curve=short.ListA, Level=1)  # -> Points, Parameters
disc_3 = Discontinuity(Curve=short.ListB, Level=1)  # -> Points, Parameters
srf_cp = SurfaceClosestPoint(Point=disc.Points, Surface=srf)  # -> Point, UVPoint, Distance
crv_cp = CurveClosestPoint(Point=disc_2.Points, Curve=graft(short.ListB))  # -> Point, Parameter, Distance
crv_cp_2 = CurveClosestPoint(Point=disc_3.Points, Curve=graft(short.ListA))  # -> Point, Parameter, Distance
iso = IsoCurve(Surface=srf, UVPoint=srf_cp.UVPoint)  # -> UIsocurve, VIsocurve
merge = Merge(Data1=crv_cp.Point, Data2=crv_cp_2.Point)
crv_3 = Curve(flatten([iso.UIsocurve, iso.VIsocurve]))
bbox = BoundingBox(Content=merge, Plane=PlaneXY(0, 0, 0), UnionBox=True)  # -> Box, Box_2
srfsplit = SurfaceSplit(Surface=srf_2, Curves=crv_3)
srf_3 = Surface(flatten(bbox.Box))
panel = Panel(srfsplit)
rdiff = RegionDifference(CurvesA=srf_3, CurvesB=project.Geometry)
boundary = BoundarySurfaces(Edges=rdiff)
