# Grasshopper definition 3Level-26.gh (Grasshopper 1.0.7)

# 3 Level - 26
srf = Surface(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)
# 3 Level - 26
srf_2 = Surface(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)
srf_3 = Surface(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)
debrep = DeconstructBrep(Brep=srf)  # -> Faces, Edges, Vertices
debrep_2 = DeconstructBrep(Brep=srf_2)  # -> Faces, Edges, Vertices
debrep_3 = DeconstructBrep(Brep=srf_3)  # -> Faces, Edges, Vertices
cls = Closed(Curve=debrep.Edges)  # -> Closed, Periodic
cls_2 = Closed(Curve=debrep_2.Edges)  # -> Closed, Periodic
cls_3 = Closed(Curve=debrep_3.Edges)  # -> Closed, Periodic
cull = CullPattern(List=debrep.Edges, CullPattern=cls.Closed)
cull_2 = CullPattern(List=debrep_2.Edges, CullPattern=cls_2.Closed)
cull_3 = CullPattern(List=debrep_3.Edges, CullPattern=cls_3.Closed)
len = Length(Curve=cull)
len_2 = Length(Curve=cull_2)
len_3 = Length(Curve=cull_3)
sort = SortList(Keys=len, ValuesA=cull)  # -> Keys, reverse(ValuesA)
sort_2 = SortList(Keys=len_2, ValuesA=cull_2)  # -> Keys, reverse(ValuesA)
sort_3 = SortList(Keys=len_3, ValuesA=cull_3)  # -> Keys, reverse(ValuesA)
area = Area(Geometry=sort.ValuesA)  # -> Area, Centroid
area_2 = Area(Geometry=sort_2.ValuesA)  # -> Area, Centroid
area_3 = Area(Geometry=sort_3.ValuesA)  # -> Area, Centroid
range = Range(Domain="0 to 2 * pi", Steps=Slider(5, range=0..100))
item = ListItem(List=area.Centroid, Index=0, Wrap=True)  # -> Item, Item1
range_2 = Range(Domain="0 to 2 * pi", Steps=Slider(5, range=0..100))
item_2 = ListItem(List=area_2.Centroid, Index=0, Wrap=True)  # -> Item, Item1
item_3 = ListItem(List=area_3.Centroid, Index=0, Wrap=True)  # -> Item, Item1
cull_i = CullIndex(List=range, Indices="-1", Wrap=True)
vec2pt = Vector2Pt(PointA=item.Item, PointB=item.Item1, Unitize=False)  # -> Vector, Length
X = UnitX(Factor=1)
cull_i_2 = CullIndex(List=range_2, Indices="-1", Wrap=True)
panel = Panel("""1
-1""")
vec2pt_2 = Vector2Pt(PointA=item_2.Item, PointB=item_2.Item1, Unitize=False)  # -> Vector, Length
X_2 = UnitX(Factor=1)
vec2pt_3 = Vector2Pt(PointA=item_3.Item, PointB=item_3.Item1, Unitize=False)  # -> Vector, Length
X_3 = UnitX(Factor=1)
pl = ConstructPlane(Origin=item.Item, XAxis=vec2pt.Vector, YAxis=X)
item_4 = ListItem(List=cull_i, Index=panel, Wrap=True)
pl_2 = ConstructPlane(Origin=item_2.Item, XAxis=vec2pt_2.Vector, YAxis=X_2)
pl_3 = ConstructPlane(Origin=item_3.Item, XAxis=vec2pt_3.Vector, YAxis=X_3)
deplane = DeconstructPlane(Plane=pl)  # -> Origin, XAxis, YAxis, ZAxis
deplane_2 = DeconstructPlane(Plane=pl_3)  # -> Origin, XAxis, YAxis, ZAxis
srf_4 = Surface(srf_3)
pl_4 = PlaneNormal(Origin=pl, ZAxis=deplane.YAxis)
rotate = Rotate(Geometry=pl_4, Angle=item_4, Plane=pl)  # -> Geometry, Transform
rotate_2 = Rotate(Geometry=srf_2, Angle=cull_i_2, Plane=pl_2)  # -> Geometry, Transform
panel_2 = Panel("""1
-1""")
pl_5 = PlaneNormal(Origin=pl_3, ZAxis=deplane_2.YAxis)
range_3 = Range(Domain="0 to 2 * pi", Steps=Slider(4, range=0..100))
shift = ShiftList(List=rotate_2.Geometry, Shift=panel_2, Wrap=True)  # -> simplify(List)
sec = BrepPlane(Brep=srf, Plane=rotate.Geometry)  # -> flatten(Curves), Points
entwine = Entwine(Branch00=srf_4, Branch01=pl_5, FlattenInputs=True)
cull_i_3 = CullIndex(List=range_3, Indices="-1", Wrap=True)
join = JoinCurves(Curves=sec.Curves, Preserve=False)
path_mapper = PathMapper(shift, source="{A}(i)", target="(i)")
srfsplit = SurfaceSplit(Surface=srf, Curves=join)
rotate_3 = Rotate(Geometry=entwine, Angle=cull_i_3, Plane=pl_3)  # -> Geometry, Transform
bbx = BrepBrep(BrepA=simplify(graft(rotate_2.Geometry)), BrepB=path_mapper)  # -> Curves, Points
bang = ExplodeTree(Data=rotate_3.Geometry)  # -> graft(Branch0), Branch1
item_5 = ListItem(List=srfsplit, Index="-1", Wrap=True)
pshift = ShiftPaths(Data=bbx.Curves, Offset=-1)
sec_2 = BrepPlane(Brep=bang.Branch0, Plane=bang.Branch1)  # -> Curves, Points
rotate_4 = Rotate(Geometry=item_5, Angle=cull_i, Plane=pl)  # -> Geometry, Transform
srfsplit_2 = SurfaceSplit(Surface=graft(rotate_2.Geometry), Curves=pshift)
pshift_2 = ShiftPaths(Data=sec_2.Curves, Offset=-1)
srfsplit_3 = SurfaceSplit(Surface=bang.Branch0, Curves=pshift_2)
area_4 = Area(Geometry=srfsplit_2)  # -> Area, Centroid
area_5 = Area(Geometry=srfsplit_3)  # -> Area, Centroid
sort_4 = SortList(Keys=area_4.Area, ValuesA=srfsplit_2)  # -> Keys, reverse(ValuesA)
sort_5 = SortList(Keys=area_5.Area, ValuesA=srfsplit_3)  # -> Keys, reverse(ValuesA)
item_6 = ListItem(List=sort_4.ValuesA, Index=0, Wrap=True)  # -> flatten(Item)
item_7 = ListItem(List=sort_5.ValuesA, Index=0, Wrap=True)  # -> Item, Item1
panel_3 = Panel(item_6)
join_2 = BrepJoin(Breps=flatten([item_7.Item, item_7.Item1]))  # -> Breps, Closed
item_8 = ListItem(List=join_2.Breps, Index=Slider(0, range=0..100), Wrap=True)
panel_4 = Panel(join_2.Breps)
