# Grasshopper definition 3Level-27.gh (Grasshopper 1.0.7)

# 3 Level - 27
crv = Curve(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)
crv_2 = Curve(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)
crv_3 = Curve(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)
crv_4 = Curve(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)
crv_5 = Curve(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)
crv_6 = Curve(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)
disc = Discontinuity(Curve=crv, Level=1)  # -> Points, Parameters
disc_2 = Discontinuity(Curve=crv_3, Level=1)  # -> Points, Parameters
ccx = CurveCurve(CurveA=crv_5, CurveB=crv_6)  # -> Points, ParamsA, ParamsB
crv_cp = CurveClosestPoint(Point=disc.Points, Curve=crv_2)  # -> Point, Parameter, Distance
crv_cp_2 = CurveClosestPoint(Point=disc_2.Points, Curve=crv_4)  # -> Point, Parameter, Distance
shatter = Shatter(Curve=crv_2, Parameters=crv_cp.Parameter)
explode = Explode(Curve=crv_3, Recursive=True)  # -> Segments, Vertices
shatter_2 = Shatter(Curve=crv_4, Parameters=crv_cp_2.Parameter)
shatter_3 = Shatter(Curve=crv_6, Parameters=ccx.ParamsB)  # -> graft(Segments)
explode_2 = Explode(Curve=shatter, Recursive=True)  # -> flatten(Segments), Vertices
end = EndPoints(Curve=shatter_3)  # -> Start, End
merge = Merge(Data1=simplify(graft(explode.Segments)), Data2=simplify(graft(shatter_2)))
ln = Line(StartPoint=end.Start, EndPoint=end.End)
midpt = CurveMiddle(Curve=explode_2.Segments)
join = JoinCurves(Curves=merge, Preserve=False)
merge_2 = Merge(Data1=ln, Data2=shatter_3)
alongcrv = SortAlongCurve(Points=midpt, Curve=crv)  # -> Points, Indices
disc_3 = Discontinuity(Curve=join, Level=1)  # -> Points, Parameters
join_2 = JoinCurves(Curves=merge_2, Preserve=False)
item = ListItem(List=disc_3.Points, Index=0, Wrap=True)  # -> Item, Item1, Item2
item_2 = ListItem(List=explode_2.Segments, Index=alongcrv.Indices, Wrap=True)
explode_3 = Explode(Curve=crv, Recursive=True)  # -> graft(Segments), Vertices
disc_4 = Discontinuity(Curve=join_2, Level=1)  # -> Points, Parameters
incircle = InCircle(CornerA=item.Item, CornerB=item.Item1, CornerC=item.Item2)  # -> Circle, Plane, Radius
partition = PartitionList(List=item_2, Size="2")
item_3 = ListItem(List=disc_4.Points, Index=0, Wrap=True)  # -> Item, Item1, Item2
merge_3 = Merge(Data1=partition, Data2=explode_3.Segments)
incircle_2 = InCircle(CornerA=item_3.Item, CornerB=item_3.Item1, CornerC=item_3.Item2)  # -> Circle, Plane, Radius
join_3 = JoinCurves(Curves=merge_3, Preserve=False)
disc_5 = Discontinuity(Curve=join_3, Level=1)  # -> Points, Parameters
item_4 = ListItem(List=disc_5.Points, Index=0, Wrap=True)  # -> Item, Item1, Item2
incircle_3 = InCircle(CornerA=item_4.Item, CornerB=item_4.Item1, CornerC=item_4.Item2)  # -> Circle, Plane, Radius
