# Grasshopper definition 3Level-28.gh (Grasshopper 1.0.7)

brep = Brep(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)
# 3 Level - 28
brep_2 = Brep(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)

debrep = DeconstructBrep(Brep=brep)  # -> Faces, Edges, Vertices
midpt = CurveMiddle(Curve=debrep.Edges)
# 가운데 엣지만 골라내기
lng = ListLength(List=debrep.Faces)
avr = Average(Input=midpt)
cps = ClosestPoints(Point=avr, Cloud=midpt, Count=expr("x + 1", lng))  # -> ClosestPoint, CPIndex, Distance

edges = BrepEdges(Brep=brep_2)  # -> Naked, Interior, NonManifold
debrep_2 = DeconstructBrep(Brep=brep_2)  # -> Faces, Edges, Vertices
midpt_2 = CurveMiddle(Curve=edges.Interior)
simplify = SimplifyCurve(Curve=debrep_2.Edges, Tolerance=Slider(0, range=0..10))  # -> Curve, Simplified
fit = FitCurve(Curve=simplify.Curve, Degree=Slider(1, range=0..1))
cset = CreateSet(List=midpt_2)  # -> Set, Map
number_slider = Slider(0.001, range=0..0.001)
midpt_3 = CurveMiddle(Curve=simplify.Curve)
reb = RebuildCurve(Curve=fit, Count=10, Tangents=False)
number_slider_2 = Slider(0, range=0..10)
number_slider_3 = Slider(2, range=0..10)
mindex = MemberIndex(Set=midpt_3, Member=cset.Set)  # -> flatten(Index), Count
filedge = FilletEdge(Shape=brep_2, Blend=2, Metric=0, Edges=mindex.Index)

item = ListItem(List=debrep.Edges, Index=cps.CPIndex, Wrap=True)
midpt_4 = CurveMiddle(Curve=item)
bbox = BoundingBox(Content=midpt_4, Plane=PlaneXY(0, 0, 0), UnionBox=True)  # -> Box, Box_2
debrep_3 = DeconstructBrep(Brep=bbox.Box)  # -> Faces, Edges, Vertices
area = Area(Geometry=debrep_3.Faces)  # -> Area, Centroid
# 정렬하고 로프트 시키기
sort = SortList(Keys=area.Area, ValuesA=debrep_3.Faces)  # -> Keys, reverse(ValuesA)
avr_2 = Average(Input=midpt_4)
item_2 = ListItem(List=sort.ValuesA, Index=0, Wrap=True)
pln = Plane(item_2)
pl_origin = PlaneOrigin(Base=pln, Origin=avr_2)
cir = Circle(Plane=pl_origin, Radius=1)
alongcrv = SortAlongCurve(Points=midpt_4, Curve=cir)  # -> Points, Indices
item_3 = ListItem(List=item, Index=alongcrv.Indices, Wrap=True)
loft = Loft(Curves=item_3, Options={Adjust=True, Closed=True, LoftEnds=0, LoftSimp=0, LoftType=3, Rebuild=10, Refit=0.01})

debrep_4 = DeconstructBrep(Brep=loft)  # -> Faces, Edges, Vertices
# 필요 없는 거 빼기
area_2 = Area(Geometry=debrep_4.Faces)  # -> Area, Centroid
sort_2 = SortList(Keys=area_2.Area, ValuesA=debrep_4.Faces)  # -> Keys, ValuesA
cull_i = CullIndex(List=sort_2.ValuesA, Indices="0", Wrap=True)
join = BrepJoin(Breps=cull_i)  # -> Breps, Closed

brep_3 = Brep(join.Breps)
edges_2 = BrepEdges(Brep=brep_3)  # -> Naked, Interior, NonManifold
debrep_5 = DeconstructBrep(Brep=brep_3)  # -> Faces, Edges, Vertices
midpt_5 = CurveMiddle(Curve=edges_2.Interior)
midpt_6 = CurveMiddle(Curve=debrep_5.Edges)
cset_2 = CreateSet(List=midpt_5)  # -> Set, Map
mindex_2 = MemberIndex(Set=midpt_6, Member=cset_2.Set)  # -> flatten(Index), Count
item_4 = ListItem(List=mindex_2.Index, Index=Slider(1, range=0..3), Wrap=True)
filedge_2 = FilletEdge(Shape=brep_3, Blend=2, Metric=0, Edges=item_4, Radii=Slider(10, range=0..10))
