# Grasshopper definition 3Level-29.gh (Grasshopper 1.0.7)

# 3 Level - 29
crv = Curve([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])
crv_2 = Curve([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])
crv_3 = Curve([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])
explode = Explode(Curve=crv, Recursive=True)  # -> flatten(Segments), flatten(Vertices)

explode_2 = Explode(Curve=crv_2, Recursive=True)  # -> flatten(Segments), Vertices
# 같은 방향 기울기 골라내기
unit = UnitVector(Vector=explode_2.Segments)
sqr = Square(Value=unit)
cset = CreateSet(List=sqr)  # -> Set, Map
mindex = MemberIndex(Set=sqr, Member=cset.Set)  # -> Index, Count
item = ListItem(List=explode_2.Segments, Index=mindex.Index, Wrap=True)

explode_3 = Explode(Curve=crv_3, Recursive=True)  # -> flatten(Segments), Vertices
cullpt = CullDuplicates(Points=explode.Vertices, Tolerance=0.1, CullMode=2)  # -> Points, Indices, Valence
unit_2 = UnitVector(Vector=explode_3.Segments)
expression = Expression(Expression="Format(\"{0}, {1}\", x, y)")
pdecon = Deconstruct(Point=cullpt.Points)  # -> XComponent, YComponent, ZComponent
sqr_2 = Square(Value=unit_2)
cset_2 = CreateSet(List=sqr_2)  # -> Set, Map
sort = SortList(Keys=pdecon.YComponent, ValuesA=cullpt.Points)  # -> Keys, ValuesA
cset_3 = CreateSet(List=pdecon.XComponent)  # -> Set, Map
pdecon_2 = Deconstruct(Point=sort.ValuesA)  # -> XComponent, YComponent, ZComponent
mindex_2 = MemberIndex(Set=sqr_2, Member=cset_2.Set)  # -> Index, Count
panel = Panel(pdecon.XComponent)
sunion = SetUnion()
mindex_3 = MemberIndex(Set=pdecon_2.XComponent, Member=cset_3.Set)  # -> Index, Count
item_2 = ListItem(List=explode_3.Segments, Index=mindex_2.Index, Wrap=True)
item_3 = ListItem(List=sort.ValuesA, Index=mindex_3.Index, Wrap=True)

explode_4 = Explode(Curve=item, Recursive=True)  # -> Segments, Vertices
pshift = ShiftPaths(Data=explode_4.Vertices, Offset=-1)
# 같은 열 또는 행이면 그룹으로 묶기
cullpt_2 = CullDuplicates(Points=pshift, Tolerance=0.1, CullMode=3)  # -> Points, Indices, Valence
bang = ExplodeTree(Data=cullpt_2.Points)  # -> Branch0, Branch1
pdecon_3 = Deconstruct(Point=bang.Branch0)  # -> XComponent, YComponent, ZComponent
pdecon_4 = Deconstruct(Point=bang.Branch1)  # -> XComponent, YComponent, ZComponent
cset_4 = CreateSet(List=pdecon_3.YComponent)  # -> Set, Map
cset_5 = CreateSet(List=pdecon_4.XComponent)  # -> Set, Map
mindex_4 = MemberIndex(Set=pdecon_3.YComponent, Member=cset_4.Set)  # -> Index, Count
mindex_5 = MemberIndex(Set=pdecon_4.XComponent, Member=cset_5.Set)  # -> Index, Count
item_4 = ListItem(List=bang.Branch0, Index=mindex_4.Index, Wrap=True)
item_5 = ListItem(List=bang.Branch1, Index=mindex_5.Index, Wrap=True)

explode_5 = Explode(Curve=item_2, Recursive=True)  # -> Segments, Vertices
panel_2 = Panel(item_3)
pline = PolyLine(Vertices=item_3, Closed=False)
pshift_2 = ShiftPaths(Data=explode_5.Vertices, Offset=-1)
cullpt_3 = CullDuplicates(Points=pshift_2, Tolerance=0.1, CullMode=3)  # -> Points, Indices, Valence
bang_2 = ExplodeTree(Data=cullpt_3.Points)  # -> Branch0, Branch1
pdecon_5 = Deconstruct(Point=bang_2.Branch0)  # -> XComponent, YComponent, ZComponent
pdecon_6 = Deconstruct(Point=bang_2.Branch1)  # -> XComponent, YComponent, ZComponent
cset_6 = CreateSet(List=pdecon_5.YComponent)  # -> Set, Map
cset_7 = CreateSet(List=pdecon_6.XComponent)  # -> Set, Map
mindex_6 = MemberIndex(Set=pdecon_5.YComponent, Member=cset_6.Set)  # -> Index, Count
mindex_7 = MemberIndex(Set=pdecon_6.XComponent, Member=cset_7.Set)  # -> Index, Count
item_6 = ListItem(List=bang_2.Branch0, Index=mindex_6.Index, Wrap=True)
item_7 = ListItem(List=bang_2.Branch1, Index=mindex_7.Index, Wrap=True)

# ----
# 좌표 정렬 (폴리라인으로 긋기 위함)
pdecon_7 = Deconstruct(Point=item_4)  # -> XComponent, YComponent, ZComponent
pdecon_8 = Deconstruct(Point=item_5)  # -> XComponent, YComponent, ZComponent
sort_2 = SortList(Keys=pdecon_7.XComponent, ValuesA=item_4)  # -> Keys, ValuesA
sort_3 = SortList(Keys=pdecon_8.YComponent, ValuesA=item_5)  # -> Keys, ValuesA
pline_2 = PolyLine(Vertices=sort_2.ValuesA, Closed=False)
pline_3 = PolyLine(Vertices=sort_3.ValuesA, Closed=False)
number_slider = Slider(1.1, range=0..3)
merge = Merge(Data1=pline_2, Data2=pline_3)  # -> flatten(Result)
neg = Negative(Value=number_slider)
join = JoinCurves(Curves=merge, Preserve=False)  # -> simplify(graft(Curves))
merge_2 = Merge(Data1=number_slider, Data2=neg)

pdecon_9 = Deconstruct(Point=item_6)  # -> XComponent, YComponent, ZComponent
pdecon_10 = Deconstruct(Point=item_7)  # -> XComponent, YComponent, ZComponent
sort_4 = SortList(Keys=pdecon_9.XComponent, ValuesA=item_6)  # -> Keys, ValuesA
sort_5 = SortList(Keys=pdecon_10.YComponent, ValuesA=item_7)  # -> Keys, ValuesA
pline_4 = PolyLine(Vertices=sort_4.ValuesA, Closed=False)
pline_5 = PolyLine(Vertices=sort_5.ValuesA, Closed=False)
number_slider_2 = Slider(1.1, range=0..3)
merge_3 = Merge(Data1=pline_4, Data2=pline_5)  # -> flatten(Result)
neg_2 = Negative(Value=number_slider_2)
join_2 = JoinCurves(Curves=merge_3, Preserve=False)
merge_4 = Merge(Data1=number_slider_2, Data2=neg_2)  # -> graft(Result)
offset = OffsetCurve(Curve=join, Distance=merge_2, Corners=1)
offset_2 = OffsetCurve(Curve=join_2, Distance=merge_4, Corners=1)
pshift_3 = ShiftPaths(Data=offset, Offset=-1)
path_mapper = PathMapper(offset_2, source="{A;B;C}", target="{A;C}")
flip = FlipMatrix(Data=pshift_3)
path_mapper_2 = PathMapper(flip, source="{A}(i)", target="(i)")
crv_4 = Curve(path_mapper)
loft = Loft(Curves=path_mapper, Options={Adjust=True, Closed=False, LoftEnds=0, LoftSimp=0, LoftType=0, Rebuild=10, Refit=0.01})
loft_2 = Loft(Curves=path_mapper_2, Options={Adjust=True, Closed=False, LoftEnds=0, LoftSimp=0, LoftType=0, Rebuild=10, Refit=0.01})
