# Grasshopper definition 3Level-30.gh (Grasshopper 1.0.7)

crv = Curve(Tree({0;0}: [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], {1;0}: [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], {2;0}: [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], {3;0}: [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], {4;0}: [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], {5;0}: [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]))
# 3 Level - 30
crv_2 = Curve(Tree({0;0}: [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], {1;0}: [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], {2;0}: [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], {3;0}: [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], {4;0}: [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], {5;0}: [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]))
offset = OffsetCurve(Curve=crv, Distance=Slider(1, range=0..1), Corners=1)
offset_2 = OffsetCurve(Curve=crv_2, Distance=Slider(1, range=0..1), Corners=1)
pshift = ShiftPaths(Data=offset, Offset=-1)
pshift_2 = ShiftPaths(Data=offset_2, Offset=-1)
merge = Merge(Data1=graft(crv), Data2=graft(pshift))
merge_2 = Merge(Data1=graft(crv_2), Data2=graft(pshift_2))
loft = Loft(Curves=merge, Options={Adjust=False, Closed=False, LoftEnds=0, LoftSimp=0, LoftType=0, Rebuild=10, Refit=0.01})
loft_2 = Loft(Curves=merge_2, Options={Adjust=False, Closed=False, LoftEnds=0, LoftSimp=0, LoftType=0, Rebuild=10, Refit=0.01})
path_mapper = PathMapper(loft, source="{A ; B ; C}", target="{A ; B}")
path_mapper_2 = PathMapper(loft_2, source="{A ; B ; C}", target="{A ; B}")
area = Area(Geometry=path_mapper)  # -> Area, Centroid
tstat = TreeStatistics(Tree=path_mapper)  # -> Paths, Length, Count
area_2 = Area(Geometry=path_mapper_2)  # -> Area, Centroid
tstat_2 = TreeStatistics(Tree=path_mapper_2)  # -> Paths, Length, Count
avr = Average(Input=area.Centroid)  # -> flatten(ArithmeticMean)
number_slider = Slider(2, range=0..10)
number_slider_2 = Slider(2, range=0..10)
avr_2 = Average(Input=area_2.Centroid)  # -> flatten(ArithmeticMean)
pdecon = Deconstruct(Point=avr)  # -> XComponent, YComponent, ZComponent
series = Series(Start=number_slider, Step=number_slider, Count=tstat.Count)
pdecon_2 = Deconstruct(Point=avr_2)  # -> XComponent, YComponent, ZComponent
series_2 = Series(Start=number_slider_2, Step=number_slider_2, Count=tstat_2.Count)
sort = SortList(Keys=pdecon.XComponent, ValuesA=series)  # -> Keys, ValuesA
sort_2 = SortList(Keys=pdecon_2.XComponent, ValuesA=tstat_2.Paths)  # -> Keys, ValuesA
sort_3 = SortList(Keys=sort.ValuesA, ValuesA=series)  # -> Keys, ValuesA
Z = UnitZ(Factor=series_2)  # -> graft(UnitVector)
branch = TreeBranch(Tree=path_mapper_2, Path=sort_2.ValuesA, MaintainPaths=False)
Z_2 = UnitZ(Factor=sort_3.ValuesA)  # -> graft(UnitVector)
extr = Extrude(Base=branch, Direction=Z)
extr_2 = Extrude(Base=path_mapper, Direction=Z_2)
