# Grasshopper definition 4 Level - 01.gh (Grasshopper 1.0.7)

int = Integer([0, 1, 3, 4, 8, 10, 11, 15, 16, 21, 23, 24, 26, 29, 30, 31, 35, 38, 50, 51, 53, 55, 59, 60, 61, 64, 66])
# 4 Level - 01
int_2 = Integer([0, 1, 3, 4, 8, 10, 11, 15, 16, 21, 23, 24, 26, 29, 30, 31, 35, 38, 50, 51, 53, 55, 59, 60, 61, 64, 66])
integer_division = IntegerDivision(A=int, B=Slider(10, range=0..10))
python = GhPythonScript(x=int_2)  # -> out, DT; inputs x: list of Int32
# ---------- python: Python ----------
__author__ = "BaekInchan"
__version__ = "2024.02.26"

import rhinoscriptsyntax as rs
import ghpythonlib.treehelpers as th

T = [[] for _ in range(10)]

for i in x : 
    T[i // 10].append(i)    

DT = th.list_to_tree(T, none_and_holes = False)
# ---------- end python ----------
cset = CreateSet(List=integer_division)  # -> Set, Map
mindex = MemberIndex(Set=integer_division, Member=cset.Set)  # -> Index, Count
item = ListItem(List=int, Index=mindex.Index, Wrap=True)
panel = Panel(python.DT)
