# Grasshopper definition 4 Level - 03.gh (Grasshopper 1.0.7)
# plug-ins: Human

crv = Curve([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])
# 4 Level - 03
crv_2 = Curve([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])
crv_3 = Curve([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])
crv_4 = Curve([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])
crv_5 = Curve([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])
crv_6 = Curve([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])
boundary = BoundarySurfaces(Edges=crv_3)
lng = ListLength(List=crv)
disc = Discontinuity(Curve=crv_4, Level=1)  # -> flatten(Points), Parameters
mcx = MultipleCurves(Curves=crv_4)  # -> Points, IndexA, IndexB, ParamA, ParamB
bbox = BoundingBox(Content=crv_6, Plane=PlaneXY(0, 0, 0), UnionBox=True)  # -> Box, Box_2
rint = RegionIntersection(CurvesA=crv_2, CurvesB=graft(crv_2))  # -> flatten(Result)
brep = Brep(boundary)
series = Series(Start=0, Step=1, Count=lng)  # -> graft(Series)
incurve = PointInCurve(Point=disc.Points, Curve=graft(crv_4))  # -> Relationship, Point
bcx = BrepCurve(Brep=crv_5, Curve=graft(crv_5))  # -> flatten(Curves), Points
srfsplit = SurfaceSplit(Surface=bbox.Box, Curves=crv_6)
trim = TrimWithBreps(Curve=crv_3, Brep=brep)  # -> Inside, Outside
cull_i = CullIndex(List=crv, Indices=series, Wrap=True)
area = Area(Geometry=crv_2)  # -> Area, Centroid
area_2 = Area(Geometry=rint)  # -> Area, Centroid
expression = Expression(x=incurve.Relationship, Expression="If(x = 2, true, false)")
midpt = CurveMiddle(Curve=bcx.Curves)
area_3 = Area(Geometry=srfsplit)  # -> Area, Centroid
exdiff = SetDifferenceS(SetA=area.Centroid, SetB=area_2.Centroid)
rint_2 = RegionIntersection(CurvesA=cull_i, CurvesB=graft(crv))  # -> flatten(Result)
incurve_2 = PointInCurve(Point=midpt, Curve=graft(crv_5))  # -> Relationship, Point
incurve_3 = PointInCurve(Point=area_3.Centroid, Curve=graft(crv_6))  # -> Relationship, Point
mindex = MemberIndex(Set=area_2.Centroid, Member=exdiff)  # -> Index, Count
area_4 = Area(Geometry=rint_2)  # -> Area, Centroid
expression_2 = Expression(x=incurve_2.Relationship, Expression="If(x = 2, true, false)")
cull = CullPattern(List=disc.Points, CullPattern=expression)
viewer = ParamViewer(srfsplit)
flip = FlipMatrix(Data=incurve_3.Relationship)
item = ListItem(List=rint, Index=mindex.Index, Wrap=True)
cset = CreateSet(List=area_4.Centroid)  # -> Set, Map
panel = Panel(cull)
ma = MassAddition(Input=flip)  # -> flatten(Result), PartialResults
cull_i_2 = CullIndex(List=item, Indices="0", Wrap=True)  # -> flatten(List)
mindex_2 = MemberIndex(Set=area_4.Centroid, Member=cset.Set)  # -> Index, Count
expression_3 = Expression(x=ma.Result, Expression="If(x > 2, true, false)")
boundary_2 = BoundarySurfaces(Edges=cull_i_2)
explode = Explode(Curve=crv_5, Recursive=True)  # -> flatten(Segments), Vertices
cull_2 = CullPattern(List=bcx.Curves, CullPattern=expression_2)  # -> flatten(List)
item_2 = ListItem(List=rint_2, Index=mindex_2.Index, Wrap=True)
previewmat = CustomPreviewMaterials(Geometry=boundary_2, DiffuseColor=RGB(255, 255, 255))
midpt_2 = CurveMiddle(Curve=cull_2)
midpt_3 = CurveMiddle(Curve=explode.Segments)
cull_i_3 = CullIndex(List=item_2, Indices="0", Wrap=True)
panel_2 = Panel(expression_3)
difference = SetDifference(SetA=midpt_2, SetB=midpt_3)
cull_3 = CullPattern(List=srfsplit, CullPattern=expression_3)
boundary_3 = BoundarySurfaces(Edges=cull_i_3)
mindex_3 = MemberIndex(Set=midpt_2, Member=difference)  # -> flatten(Index), Count
item_3 = ListItem(List=cull_2, Index=mindex_3.Index, Wrap=True)
join = JoinCurves(Curves=item_3, Preserve=False)
boundary_4 = BoundarySurfaces(Edges=join)
