# Grasshopper definition 4 Level - 04.gh (Grasshopper 1.0.7)

# 4 Level - 04
srf = Surface(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)
crv = Curve(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)
edges = BrepEdges(Brep=srf)  # -> Naked, Interior, NonManifold
hframes = HorizontalFrames(Curve=crv, Count=Slider(12, range=0..100))  # -> Frames, Parameters
item = ListItem(List=edges.Naked, Index=0, Wrap=True)
midpt = CurveMiddle(Curve=item)
vec = Vector(item)
pl = ConstructPlane(Origin=midpt, XAxis=vec, YAxis=Vector(0, 1, 0))
orient = Orient(Geometry=srf, Source=pl, Target=hframes.Frames)  # -> Geometry, Transform
debrep = DeconstructBrep(Brep=orient.Geometry)  # -> Faces, Edges, Vertices
pull = PullPoint(Point=debrep.Vertices, Geometry=crv, ClosestOnly=True)  # -> ClosestPoint, Distance
deplane = DeconstructPlane(Plane=hframes.Frames)  # -> Origin, XAxis, YAxis, ZAxis
amp = Amplitude(Vector=deplane.YAxis, Amplitude=pull.Distance)
move = Move(Geometry=orient.Geometry, Motion=amp)  # -> Geometry, Transform
