# Grasshopper definition 4 Level - 05 (1).gh (Grasshopper 1.0.7)

srf = Surface([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])
xy = XYPlane(Origin=Point(0, 0, 0))
area = Area(Geometry=srf)  # -> Area, Centroid
explode = Explode(Curve=srf, Recursive=True)  # -> Segments, Vertices
pull = PullPoint(Point=xy, Geometry=explode.Vertices, ClosestOnly=False)  # -> ClosestPoint, Distance
fline = FitLine(Points=area.Centroid)
vec = Vector(explode.Segments)
unit = UnitVector(Vector=fline)
sort = SortList(Keys=pull.Distance, ValuesA=pull.ClosestPoint)  # -> Keys, ValuesA
dprod = DotProduct(VectorA=unit, VectorB=vec, Unitize=False)
item = ListItem(List=sort.ValuesA, Index=0, Wrap=True)
abs = Absolute(Value=dprod)
larger = LargerThan(FirstNumber=abs, SecondNumber=Slider(0.87, range=0..1))  # -> LargerThan, OrEqualTo
srf_2 = Surface(srf)
cull = CullPattern(List=explode.Segments, CullPattern=larger.LargerThan)
item_2 = ListItem(List=flatten(cull), Index=Slider(1, range=0..1), Wrap=True)
flip = FlipCurve(Curve=cull, Guide=item_2)  # -> Curve, Flag
midpt = CurveMiddle(Curve=flip.Curve)
pdecon = Deconstruct(Point=midpt)  # -> XComponent, YComponent, ZComponent
sort_2 = SortList(Keys=pdecon.YComponent, ValuesA=flip.Curve)  # -> Keys, ValuesA
item_3 = ListItem(List=sort_2.ValuesA, Index=0, Wrap=True)
xy_2 = XYPlane(Origin=Point(0, 0, 0))
pl = ConstructPlane(Origin=item, XAxis=item_3, YAxis=Vector(0, 1, 0))
len = Length(Curve=item_3)
addition = Addition(A=len, B="1")
orient = Orient(Geometry=graft(srf_2), Source=pl, Target=xy_2)  # -> Geometry, Transform
ma = MassAddition(Input=flatten(addition))  # -> Result, PartialResults
merge = Merge(Data1="0", Data2=ma.PartialResults)
cull_i = CullIndex(List=merge, Indices="-1", Wrap=True)
X = UnitX(Factor=cull_i)
move = Move(Geometry=orient.Geometry, Motion=graft(X))  # -> Geometry, Transform
