# Grasshopper definition 4 Level - 06.gh (Grasshopper 1.0.7)

srf = Surface([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])
# 4 Level - 06
area = Area(Geometry=srf)  # -> Area, Centroid
avr = Average(Input=area.Centroid)
cir = Circle(Plane=avr, Radius=1)
panel = Panel("""1
-1""")
alongcrv = SortAlongCurve(Points=area.Centroid, Curve=cir)  # -> Points, Indices
pull = PullCurve()
item = ListItem(List=srf, Index=alongcrv.Indices, Wrap=True)
shift = ShiftList(List=item, Shift=graft(panel), Wrap=True)
disc = Discontinuity(Curve=item, Level=1)  # -> Points, Parameters
flip = FlipMatrix(Data=shift)
pull_2 = PullPoint(Point=disc.Points, Geometry=flip, ClosestOnly=False)  # -> ClosestPoint, Distance
pshift = ShiftPaths(Data=pull_2.ClosestPoint, Offset=-1)
cullpt = CullDuplicates(Points=pshift, Tolerance=0.1, CullMode=1)  # -> flatten(Points), Indices, Valence
avr_2 = Average(Input=cullpt.Points)
area_2 = Area(Geometry=cullpt.Points)  # -> Area, Centroid
cir_2 = Circle(Plane=avr_2, Radius=1)
alongcrv_2 = SortAlongCurve(Points=cullpt.Points, Curve=cir_2)  # -> Points, Indices
item_2 = ListItem(List=cullpt.Points, Index=alongcrv_2.Indices, Wrap=True)
pline = PolyLine(Vertices=item_2, Closed=invert(False))
alongcrv_3 = SortAlongCurve()  # -> Points, Indices
panel_2 = Panel(cullpt.Points)
