# Grasshopper definition 4 Level - 08.gh (Grasshopper 1.0.7)

# 4 Level - 08
crv = Curve([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])
shift = ShiftList(List=crv, Shift=1, Wrap=invert(True))
cull_i = CullIndex(List=crv, Indices="-1", Wrap=True)
merge = Merge(Data1=graft(cull_i), Data2=graft(shift))
item = ListItem(List=merge, Index=0, Wrap=True)  # -> Item, Item1
ccx = CurveCurve(CurveA=item.Item, CurveB=item.Item1)  # -> Points, ParamsA, ParamsB
angle = Angle(VectorA=item.Item, VectorB=item.Item1)  # -> Angle, Reflex
number_slider = Slider(12.5, range=0..100)
Z = UnitZ(Factor=1)
division = Division(A=angle.Angle, B="2")
vrot = Rotate(Vector=item.Item, Axis=Z, Angle=division)
sin = Sine(Value=division)
division_2 = Division(A=number_slider, B=sin)
line = LineSDL(Start=ccx.Points, Direction=vrot, Length=division_2)
eval = EvaluateCurve(Curve=line, Parameter="1")  # -> Point, Tangent, Angle
cir = Circle(Plane=eval.Point, Radius=number_slider)
