# Grasshopper definition 4 Level - 09.gh (Grasshopper 1.0.7)

# 4 Level - 09
number_slider = Slider(16.35, range=0..50)
xy = XYPlane(Origin=Point(0, 0, 0))
crv = Curve(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)
polygon = Polygon(Plane=xy, Radius=number_slider, Segments="24", FilletRadius=0)  # -> Polygon, Length
disc = Discontinuity(Curve=polygon.Polygon, Level=1)  # -> Points, Parameters
shift = ShiftList(List=disc.Points, Shift=1, Wrap=True)
merge = Merge(Data1=simplify(graft(shift)), Data2=simplify(graft(disc.Points)))
item = ListItem(List=merge, Index=0, Wrap=True)  # -> Item, Item1
vec2pt = Vector2Pt(PointA=item.Item1, PointB=item.Item, Unitize=False)  # -> flatten(Vector), Length
pl = ConstructPlane(Origin=disc.Points, XAxis=vec2pt.Vector, YAxis=Vector(0, 1, 0))
