# Grasshopper definition 4 Level - 11.gh (Grasshopper 1.0.7)

# 4 Level - 11
srf = Surface([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])
xy = XYPlane(Origin=Point(0, 0, 0))
project = Project(Geometry=srf, Plane=xy)  # -> Geometry, Transform
merge = Merge(Data1=graft(srf), Data2=graft(project.Geometry))
loft = Loft(Curves=merge, Options={Adjust=False, Closed=False, LoftEnds=0, LoftSimp=0, LoftType=0, Rebuild=10, Refit=0.01})  # -> flatten(Loft)
join = BrepJoin(Breps=loft)  # -> Breps, Closed
