# Grasshopper definition 4 Level - 12.gh (Grasshopper 1.0.7)

# 4 Level - 12
srf = Surface([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])
number_slider = Slider(2.4, range=0..10)
explode = Explode(Curve=srf, Recursive=True)  # -> Segments, Vertices
disc = Discontinuity(Curve=srf, Level=1)  # -> flatten(Points), Parameters
midpt = CurveMiddle(Curve=explode.Segments)  # -> flatten(Midpoint)
pgroups = PointGroups(Points=disc.Points, Distance=number_slider)  # -> Groups, Indices
tstat = TreeStatistics(Tree=pgroups.Groups)  # -> Paths, Length, Count
pgroups_2 = PointGroups(Points=midpt, Distance=number_slider)  # -> Groups, Indices
larger = LargerThan(FirstNumber=tstat.Length, SecondNumber=Slider(3, range=0..10))  # -> LargerThan, OrEqualTo
tstat_2 = TreeStatistics(Tree=pgroups_2.Indices)  # -> Paths, Length, Count
cull = CullPattern(List=tstat.Paths, CullPattern=larger.OrEqualTo)
larger_2 = LargerThan(FirstNumber=tstat_2.Length, SecondNumber=Slider(2, range=0..10))  # -> LargerThan, OrEqualTo
branch = TreeBranch(Tree=pgroups.Groups, Path=cull, MaintainPaths=False)
cull_2 = CullPattern(List=tstat_2.Paths, CullPattern=larger_2.OrEqualTo)
pline = PolyLine(Vertices=branch, Closed=invert(False))
branch_2 = TreeBranch(Tree=pgroups_2.Indices, Path=cull_2, MaintainPaths=False)
boundary = BoundarySurfaces(Edges=pline)
item = ListItem(List=flatten(explode.Segments), Index=branch_2, Wrap=True)
loft = Loft(Curves=item, Options={Adjust=True, Closed=False, LoftEnds=0, LoftSimp=0, LoftType=0, Rebuild=10, Refit=0.01})
preview = CustomPreview(Geometry=boundary, Material=ColourSwatch(SwatchColor=RGB(201, 50, 50)))
preview_2 = CustomPreview(Geometry=loft, Material=ColourSwatch(SwatchColor=RGB(50, 151, 201)))
