# Grasshopper definition 40_Connecting given lines and creating areas.gh (Grasshopper 1.0.7)

crv = Curve([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])
crv_2 = Curve([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])
# 4 Level - 07
crv_3 = Curve([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])
crv_4 = Curve([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])
number_slider = Slider(6, range=0..10)
item = ListItem(List=crv_2, Index=0, Wrap=True)
llx = LineLine(Line1=crv_3, Line2=graft(crv_4))  # -> ParamA, ParamB, PointA, PointB
eval = EvaluateLength(Curve=item, Length="1", Normalized=True)  # -> Point, Tangent, Parameter
crv_5 = Curve([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])
pt = Point(llx.PointA)
number_slider_2 = Slider(4, range=0..10)
midpt = CurveMiddle(Curve=crv_5)
project = ProjectPoint(Point=eval.Point, Direction=item, Geometry=crv)  # -> Point, Index
panel = Panel(llx.ParamA)
ext = ExtendCurve(Curve=crv_3, Type=0, Start=number_slider, End=number_slider)
dist = Distance(PointA=eval.Point, PointB=project.Point)  # -> expr("x+0.3", Distance)
pdecon = Deconstruct(Point=midpt)  # -> XComponent, YComponent, ZComponent
expression = Expression(x=pdecon.YComponent, Expression="round(x, 2)")
crv_cp = CurveClosestPoint()  # -> Point, Parameter, Distance
int = Integer(pdecon.YComponent)
sort = SortList(Keys=int, ValuesA=crv_5)  # -> Keys, ValuesA
ext_2 = ExtendCurve(Curve=crv_2, Type=0, Start=dist, End=dist)
panel_2 = Panel(expression)
cset = CreateSet(List=sort.Keys)  # -> Set, Map
ccx = CurveCurve(CurveA=ext_2, CurveB=graft(crv))  # -> simplify(Points), ParamsA, ParamsB
crv_6 = Curve([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])
mindex = MemberIndex(Set=sort.Keys, Member=cset.Set)  # -> Index, Count
bbox = BoundingBox(Content=crv_6, Plane=PlaneXY(0, 0, 0), UnionBox=True)  # -> Box, Box_2
item_2 = ListItem(List=crv_6, Index=0, Wrap=True)  # -> Item, Item1
pshift = ShiftPaths(Data=ccx.ParamsB, Offset=-1)
pshift_2 = ShiftPaths(Data=ccx.Points, Offset=-1)
item_3 = ListItem(List=sort.ValuesA, Index=mindex.Index, Wrap=True)
rec = Rectangle(bbox.Box)
crvprox = CurveProximity(CurveA=item_2.Item, CurveB=item_2.Item1)  # -> PointA, PointB, Distance
alongcrv = SortAlongCurve(Points=pshift_2, Curve=graft(crv))  # -> Points, Indices
tstat = TreeStatistics(Tree=item_3)  # -> Paths, Length, Count
shatter = Shatter(Curve=graft(crv), Parameters=pshift)
dim = Dimensions(Surface=rec)  # -> UDimension, VDimension
panel_3 = Panel(crvprox.Distance)
partition = PartitionList(List=alongcrv.Points, Size="2")
shift = ShiftList(List=tstat.Paths, Shift=1, Wrap=invert(True))
panel_4 = Panel([dim.UDimension, dim.VDimension])
panel_5 = Panel("""0
1""")
crv_7 = Curve(crv_2)
pline = PolyLine(Vertices=partition, Closed=False)  # -> simplify(flatten(Polyline))
cull = CullPattern(List=shatter, CullPattern=panel_5)
short = ShortestList(ListA=tstat.Paths, ListB=shift, TrimMode=2)  # -> ListA, ListB
crv_8 = Curve([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])
divide = DivideCurve(Curve=pline, Count="1", Kinks=False)  # -> graft(Points), Tangents, Parameters
divide_2 = DivideCurve(Curve=crv_7, Count="1", Kinks=False)  # -> flatten(Points), Tangents, Parameters
branch = TreeBranch(Tree=item_3, Path=short.ListB, MaintainPaths=True)
branch_2 = TreeBranch(Tree=item_3, Path=short.ListA, MaintainPaths=True)
number_slider_3 = Slider(0.5, range=0..1)
viewer = ParamViewer(divide_2.Points)
llx_2 = LineLine(Line1=graft(crv_8), Line2=branch_2)  # -> ParamA, ParamB, PointA, PointB
cp = ClosestPoint(Point=divide.Points, Cloud=divide_2.Points)  # -> ClosestPoint, CPIndex, Distance
divide_3 = DivideCurve(Curve=branch_2, Count="1", Kinks=False)  # -> flatten(Points), Tangents, Parameters
ln = Line(StartPoint=cp.ClosestPoint, EndPoint=divide.Points)
cp_2 = ClosestPoint(Point=llx_2.PointB, Cloud=divide_3.Points)  # -> ClosestPoint, CPIndex, Distance
neg = Negative(Value=number_slider_3)
join = JoinCurves(Curves=flatten([ln, pline]), Preserve=False)
ln_2 = Line(StartPoint=llx_2.PointB, EndPoint=cp_2.ClosestPoint)
merge = Merge(Data1=neg, Data2=number_slider_3)
offset = OffsetCurve(Curve=graft(join), Distance=merge, Corners=1)  # -> simplify(Curve)
viewer_2 = ParamViewer(ln_2)
path_mapper = PathMapper(offset, source="{A;B}", target="{A}")
pshift_3 = ShiftPaths(Data=offset, Offset=-1)
loft = Loft(Curves=pshift_3, Options={Adjust=False, Closed=False, LoftEnds=0, LoftSimp=0, LoftType=0, Rebuild=10, Refit=0.01})  # -> flatten(Loft)
viewer_3 = ParamViewer(pshift_3)
crv_9 = Curve([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])
item_4 = ListItem(List=crv_9, Index=0, Wrap=True)
edges = BrepEdges(Brep=loft)  # -> Naked, Interior, NonManifold
flip = FlipCurve(Curve=crv_9, Guide=item_4)  # -> Curve, Flag
join_2 = JoinCurves(Curves=edges.Naked, Preserve=False)  # -> flatten(Curves)
boundary = BoundarySurfaces(Edges=flip.Curve)
boundary_2 = BoundarySurfaces(Edges=join_2)
item_5 = ListItem(List=join_2, Index=0, Wrap=True)
item_6 = ListItem(List=boundary_2, Index=0, Wrap=True)
flip_2 = FlipCurve(Curve=join_2, Guide=item_5)  # -> Curve, Flag
flip_3 = FlipCurve(Curve=flip_2.Curve)  # -> Curve, Flag
flip_4 = Flip(Surface=boundary_2, Guide=item_6)  # -> Surface, Result
boundary_3 = BoundarySurfaces(Edges=flip_2.Curve)
boundary_4 = BoundarySurfaces(Edges=flip_3.Curve)
flip_5 = Flip(Surface=flip_4.Surface)  # -> Surface, Result
flip_6 = Flip(Surface=boundary_3)  # -> Surface, Result
