# Grasshopper definition 3Level-03_(Extruding a quadrilateral polyline according to given conditions.).gh (Grasshopper 1.0.7)

# 3 Level - 03
crv = Curve([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])
neg = Negative(Value=Slider(0.2, range=0..1))
offset = OffsetCurve(Curve=crv, Distance=neg, Corners=1)  # -> flatten(Curve)
area = Area(Geometry=offset)  # -> Area, Centroid
avr = Average(Input=flatten(area.Centroid))
dist = Distance(PointA=area.Centroid, PointB=avr)
sort = SortList(Keys=dist, ValuesA=offset)  # -> Keys, ValuesA
item = ListItem(List=sort.ValuesA, Index=0, Wrap=True)
series = Series(Start=Slider(0.4, range=0..10), Step=Slider(2, range=0..10), Count=Slider(4, range=0..10))
area_2 = Area(Geometry=item)  # -> Area, Centroid
scale = Scale(Geometry=item, Center=area_2.Centroid, Factor=series)  # -> Geometry, Transform
deplane = DeconstructPlane(Plane=item)  # -> Origin, XAxis, YAxis, ZAxis
crv_cp = CurveClosestPoint(Point=area.Centroid, Curve=graft(scale.Geometry))  # -> Point, Parameter, Distance
smaller = SmallerThan(FirstNumber=crv_cp.Distance, SecondNumber=Slider(3, range=0..10))  # -> SmallerThan, OrEqualTo
cull = CullPattern(List=offset, CullPattern=smaller.SmallerThan)
number_slider = Slider(2, range=0..10)
tstat = TreeStatistics(Tree=cull)  # -> Paths, Length, Count
series_2 = Series(Start=number_slider, Step=number_slider, Count=tstat.Count)  # -> reverse(Series)
amp = Amplitude(Vector=deplane.ZAxis, Amplitude=series_2)
extr = Extrude(Base=cull, Direction=graft(amp))
cap = CapHoles(Brep=extr)
